% Simulink data dictionary MCU_CmdTrans_Sldd_objects.sldd
% references PublicParameters.sldd
% references MCU_ParamCfg_Sldd_objects.sldd

M_CmdTrans_WorkCmdSourceRunCmd_u16 = myPackage.Signal(DoubleProperty=0, Int32Property=int32(0), LogicalProperty=false, OnOffCharProperty="off", ColorCharProperty="red", StorageClass="YS_SelectRAMSignal", HeaderFile="MCU_CmdTransSignals.h", DefinitionFile="MCU_CmdTransSignals.c", DataType="uint16", InitialValue="0")
M_CmdTrans_WorkCmdSourceCurrentCmd_f32 = myPackage.Signal(DoubleProperty=0, Int32Property=int32(0), LogicalProperty=false, OnOffCharProperty="off", ColorCharProperty="red", StorageClass="YS_SelectRAMSignal", HeaderFile="MCU_CmdTransSignals.h", DefinitionFile="MCU_CmdTransSignals.c", DataType="single", InitialValue="0")
M_CmdTrans_WorkCmdSourceDisChargeCmd_u16 = myPackage.Signal(DoubleProperty=0, Int32Property=int32(0), LogicalProperty=false, OnOffCharProperty="off", ColorCharProperty="red", StorageClass="YS_SelectRAMSignal", HeaderFile="MCU_CmdTransSignals.h", DefinitionFile="MCU_CmdTransSignals.c", DataType="uint16", InitialValue="0")
M_CmdTrans_WorkCmdSourceFreqCmd_f32 = myPackage.Signal(DoubleProperty=0, Int32Property=int32(0), LogicalProperty=false, OnOffCharProperty="off", ColorCharProperty="red", StorageClass="YS_SelectRAMSignal", HeaderFile="MCU_CmdTransSignals.h", DefinitionFile="MCU_CmdTransSignals.c", DataType="single", InitialValue="0")
M_CmdTrans_WorkCmdSourceIsdCmd_f32 = myPackage.Signal(DoubleProperty=0, Int32Property=int32(0), LogicalProperty=false, OnOffCharProperty="off", ColorCharProperty="red", StorageClass="YS_SelectRAMSignal", HeaderFile="MCU_CmdTransSignals.h", DefinitionFile="MCU_CmdTransSignals.c", DataType="single", InitialValue="0")
M_CmdTrans_WorkCmdSourceIsqCmd_f32 = myPackage.Signal(DoubleProperty=0, Int32Property=int32(0), LogicalProperty=false, OnOffCharProperty="off", ColorCharProperty="red", StorageClass="YS_SelectRAMSignal", HeaderFile="MCU_CmdTransSignals.h", DefinitionFile="MCU_CmdTransSignals.c", DataType="single", InitialValue="0")
M_CmdTrans_WorkCmdSourceModeCmd_u16 = myPackage.Signal(DoubleProperty=0, Int32Property=int32(0), LogicalProperty=false, OnOffCharProperty="off", ColorCharProperty="red", StorageClass="YS_SelectRAMSignal", HeaderFile="MCU_CmdTransSignals.h", DefinitionFile="MCU_CmdTransSignals.c", DataType="uint16", InitialValue="0")
M_CmdTrans_WorkCmdSourceSpeedCmd_f32 = myPackage.Signal(DoubleProperty=0, Int32Property=int32(0), LogicalProperty=false, OnOffCharProperty="off", ColorCharProperty="red", StorageClass="YS_SelectRAMSignal", HeaderFile="MCU_CmdTransSignals.h", DefinitionFile="MCU_CmdTransSignals.c", DataType="single", InitialValue="0")
M_CmdTrans_WorkCmdSourceThetaCmd_f32 = myPackage.Signal(DoubleProperty=0, Int32Property=int32(0), LogicalProperty=false, OnOffCharProperty="off", ColorCharProperty="red", StorageClass="YS_SelectRAMSignal", HeaderFile="MCU_CmdTransSignals.h", DefinitionFile="MCU_CmdTransSignals.c", DataType="single", InitialValue="0")
M_CmdTrans_WorkCmdSourceTorqueCmd_f32 = myPackage.Signal(DoubleProperty=0, Int32Property=int32(0), LogicalProperty=false, OnOffCharProperty="off", ColorCharProperty="red", StorageClass="YS_SelectRAMSignal", HeaderFile="MCU_CmdTransSignals.h", DefinitionFile="MCU_CmdTransSignals.c", DataType="single", InitialValue="0")