% Simulink data dictionary MCU_FOC_Sldd.sldd
% references PublicParameters.sldd
% references MCU_ParamCfg_Sldd_objects.sldd

M_PwmPrdChg_Flg_u8 = myPackage.Signal(DoubleProperty=0, Int32Property=int32(0), LogicalProperty=false, OnOffCharProperty="off", ColorCharProperty="red", StorageClass="YS_SelectRAMSignal", HeaderFile="MCU_PWMPrdChg_Signals.h", DefinitionFile="MCU_PWMPrdChg_Signals.c", DataType="uint8", InitialValue="0")
C_FOC_IgnoreShunt_u8 = myPackage.Parameter(3, DoubleProperty=0, Int32Property=int32(0), LogicalProperty=false, OnOffCharProperty="off", ColorCharProperty="red", StorageClass="YS_SelectRAMPara", HeaderFile="MCU_FOC_Params.h", DefinitionFile="MCU_FOC_Params.c", DataType="uint8")
C_FOC_DecoupleEn_u8 = myPackage.Parameter(0, DoubleProperty=0, Int32Property=int32(0), LogicalProperty=false, OnOffCharProperty="off", ColorCharProperty="red", StorageClass="YS_SelectRAMPara", HeaderFile="MCU_FOC_Params.h", DefinitionFile="MCU_FOC_Params.c", DataType="uint8")
C_FOC_DecoupleUdCoeff_f32 = myPackage.Parameter(0, DoubleProperty=0, Int32Property=int32(0), LogicalProperty=false, OnOffCharProperty="off", ColorCharProperty="red", StorageClass="YS_SelectRAMPara", HeaderFile="MCU_FOC_Params.h", DefinitionFile="MCU_FOC_Params.c", DataType="single")
C_FOC_DecoupleUeCoeff_f32 = myPackage.Parameter(0, DoubleProperty=0, Int32Property=int32(0), LogicalProperty=false, OnOffCharProperty="off", ColorCharProperty="red", StorageClass="YS_SelectRAMPara", HeaderFile="MCU_FOC_Params.h", DefinitionFile="MCU_FOC_Params.c", DataType="single")
C_FOC_DecoupleUqCoeff_f32 = myPackage.Parameter(0, DoubleProperty=0, Int32Property=int32(0), LogicalProperty=false, OnOffCharProperty="off", ColorCharProperty="red", StorageClass="YS_SelectRAMPara", HeaderFile="MCU_FOC_Params.h", DefinitionFile="MCU_FOC_Params.c", DataType="single")
C_FOC_ThetaOffsetCoeff_f32 = myPackage.Parameter(1, DoubleProperty=0, Int32Property=int32(0), LogicalProperty=false, OnOffCharProperty="off", ColorCharProperty="red", StorageClass="YS_SelectRAMPara", HeaderFile="MCU_FOC_Params.h", DefinitionFile="MCU_FOC_Params.c", DataType="single")
C_FOC_DPWMEN_u8 = myPackage.Parameter(0, DoubleProperty=0, Int32Property=int32(0), LogicalProperty=false, OnOffCharProperty="off", ColorCharProperty="red", StorageClass="YS_SelectRAMPara", HeaderFile="MCU_FOC_Params.h", DefinitionFile="MCU_FOC_Params.c", DataType="uint8")