% Simulink data dictionary MCU_FaultDiag_Datadictionary.sldd
% references PublicParameters.sldd
% references MCU_ParamCfg_Sldd_objects.sldd

C_Fault_CntDectiontime_u32 = myPackage.Parameter(60000, DoubleProperty=0, Int32Property=int32(0), LogicalProperty=false, OnOffCharProperty="off", ColorCharProperty="red", StorageClass="YS_SelectRAMPara", HeaderFile="MCU_Fault_Paras.h", DefinitionFile="MCU_Fault_Paras.c", DataType="uint32")
C_Fault_IGBTCircuitFaultDiagEn_u8 = myPackage.Parameter(0, DoubleProperty=0, Int32Property=int32(0), LogicalProperty=false, OnOffCharProperty="off", ColorCharProperty="red", StorageClass="YS_SelectRAMPara", HeaderFile="MCU_FaultDiag_Paras.h", DefinitionFile="MCU_FaultDiag_Paras.c", DataType="uint8")
C_Fault_IGBTCircutConfirmCnt_u16 = myPackage.Parameter(100, DoubleProperty=0, Int32Property=int32(0), LogicalProperty=false, OnOffCharProperty="off", ColorCharProperty="red", StorageClass="YS_SelectRAMPara", HeaderFile="MCU_Fault_Paras.h", DefinitionFile="MCU_Fault_Paras.c", DataType="uint16")  % Igbt温度采样故障触发计次阈值
C_Fault_IGBTCircutConfirmTh_u16 = myPackage.Parameter(3800, DoubleProperty=0, Int32Property=int32(0), LogicalProperty=false, OnOffCharProperty="off", ColorCharProperty="red", StorageClass="YS_SelectRAMPara", HeaderFile="MCU_Fault_Paras.h", DefinitionFile="MCU_Fault_Paras.c", DataType="uint16")  % Igbt温度采样故障ADC阈值
C_Fault_IGBTCircutFaultCoeff_f32 = myPackage.Parameter(0, DoubleProperty=0, Int32Property=int32(0), LogicalProperty=false, OnOffCharProperty="off", ColorCharProperty="red", StorageClass="YS_SelectRAMPara", HeaderFile="MCU_Fault_Paras.h", DefinitionFile="MCU_Fault_Paras.c", DataType="single")
C_Fault_IGBTCircutFaultLevel_u8 = myPackage.Parameter(0, DoubleProperty=0, Int32Property=int32(0), LogicalProperty=false, OnOffCharProperty="off", ColorCharProperty="red", StorageClass="YS_SelectRAMPara", HeaderFile="MCU_Fault_Paras.h", DefinitionFile="MCU_Fault_Paras.c", DataType="uint8")
C_Fault_IaInstantFaultCoeff_f32 = myPackage.Parameter(1, DoubleProperty=0, Int32Property=int32(0), LogicalProperty=false, OnOffCharProperty="off", ColorCharProperty="red", StorageClass="YS_SelectRAMPara", HeaderFile="MCU_FaultDiag_Paras.h", DefinitionFile="MCU_FaultDiag_Paras.c", DataType="single")
C_Fault_IaInstantFaultDiagEn_u8 = myPackage.Parameter(0, DoubleProperty=0, Int32Property=int32(0), LogicalProperty=false, OnOffCharProperty="off", ColorCharProperty="red", StorageClass="YS_SelectRAMPara", HeaderFile="MCU_FaultDiag_Paras.h", DefinitionFile="MCU_FaultDiag_Paras.c", DataType="uint8")
C_Fault_IaInstantFaultErrCode_u16 = myPackage.Parameter([], DoubleProperty=0, Int32Property=int32(0), LogicalProperty=false, OnOffCharProperty="off", ColorCharProperty="red", StorageClass="YS_SelectRAMPara", HeaderFile="MCU_FaultDiag_Paras.h", DefinitionFile="MCU_FaultDiag_Paras.c", DataType="uint16")
C_Fault_IaInstantFaultLevel_u8 = myPackage.Parameter(1, DoubleProperty=0, Int32Property=int32(0), LogicalProperty=false, OnOffCharProperty="off", ColorCharProperty="red", StorageClass="YS_SelectRAMPara", HeaderFile="MCU_FaultDiag_Paras.h", DefinitionFile="MCU_FaultDiag_Paras.c", DataType="uint8")
C_Fault_IaLimit_s32 = myPackage.Parameter(600, DoubleProperty=0, Int32Property=int32(0), LogicalProperty=false, OnOffCharProperty="off", ColorCharProperty="red", StorageClass="YS_SelectRAMPara", HeaderFile="MCU_Fault_Paras.h", DefinitionFile="MCU_Fault_Paras.c", DataType="single")  % a相电流故障限值设置
C_Fault_IaSensorFault_u32 = myPackage.Parameter(1, DoubleProperty=0, Int32Property=int32(0), LogicalProperty=false, OnOffCharProperty="off", ColorCharProperty="red", StorageClass="YS_SelectRAMPara", HeaderFile="MCU_Fault_Paras.h", DefinitionFile="MCU_Fault_Paras.c", DataType="uint32")  % a相电流瞬时故障检测使能开关
C_Fault_IbInstantFaultCoeff_f32 = myPackage.Parameter(1, DoubleProperty=0, Int32Property=int32(0), LogicalProperty=false, OnOffCharProperty="off", ColorCharProperty="red", StorageClass="YS_SelectRAMPara", HeaderFile="MCU_FaultDiag_Paras.h", DefinitionFile="MCU_FaultDiag_Paras.c", DataType="single")
C_Fault_IbInstantFaultDiagEn_u8 = myPackage.Parameter(0, DoubleProperty=0, Int32Property=int32(0), LogicalProperty=false, OnOffCharProperty="off", ColorCharProperty="red", StorageClass="YS_SelectRAMPara", HeaderFile="MCU_FaultDiag_Paras.h", DefinitionFile="MCU_FaultDiag_Paras.c", DataType="uint8")
C_Fault_IbInstantFaultErrCode_u16 = myPackage.Parameter([], DoubleProperty=0, Int32Property=int32(0), LogicalProperty=false, OnOffCharProperty="off", ColorCharProperty="red", StorageClass="YS_SelectRAMPara", HeaderFile="MCU_FaultDiag_Paras.h", DefinitionFile="MCU_FaultDiag_Paras.c", DataType="uint16")
C_Fault_IbInstantFaultLevel_u8 = myPackage.Parameter(1, DoubleProperty=0, Int32Property=int32(0), LogicalProperty=false, OnOffCharProperty="off", ColorCharProperty="red", StorageClass="YS_SelectRAMPara", HeaderFile="MCU_FaultDiag_Paras.h", DefinitionFile="MCU_FaultDiag_Paras.c", DataType="uint8")
C_Fault_IbLimit_s32 = myPackage.Parameter(600, DoubleProperty=0, Int32Property=int32(0), LogicalProperty=false, OnOffCharProperty="off", ColorCharProperty="red", StorageClass="YS_SelectRAMPara", HeaderFile="MCU_Fault_Paras.h", DefinitionFile="MCU_Fault_Paras.c", DataType="single")  % b相电流故障限值设置
C_Fault_IbSensorFault_u32 = myPackage.Parameter(1, DoubleProperty=0, Int32Property=int32(0), LogicalProperty=false, OnOffCharProperty="off", ColorCharProperty="red", StorageClass="YS_SelectRAMPara", HeaderFile="MCU_Fault_Paras.h", DefinitionFile="MCU_Fault_Paras.c", DataType="uint32")  % b相电流瞬时故障检测使能开关
C_Fault_IcInstantFaultCoeff_f32 = myPackage.Parameter(1, DoubleProperty=0, Int32Property=int32(0), LogicalProperty=false, OnOffCharProperty="off", ColorCharProperty="red", StorageClass="YS_SelectRAMPara", HeaderFile="MCU_FaultDiag_Paras.h", DefinitionFile="MCU_FaultDiag_Paras.c", DataType="single")
C_Fault_IcInstantFaultDiagEn_u8 = myPackage.Parameter(0, DoubleProperty=0, Int32Property=int32(0), LogicalProperty=false, OnOffCharProperty="off", ColorCharProperty="red", StorageClass="YS_SelectRAMPara", HeaderFile="MCU_FaultDiag_Paras.h", DefinitionFile="MCU_FaultDiag_Paras.c", DataType="uint8")
C_Fault_IcInstantFaultErrCode_u16 = myPackage.Parameter([], DoubleProperty=0, Int32Property=int32(0), LogicalProperty=false, OnOffCharProperty="off", ColorCharProperty="red", StorageClass="YS_SelectRAMPara", HeaderFile="MCU_FaultDiag_Paras.h", DefinitionFile="MCU_FaultDiag_Paras.c", DataType="uint16")
C_Fault_IcInstantFaultLevel_u8 = myPackage.Parameter(1, DoubleProperty=0, Int32Property=int32(0), LogicalProperty=false, OnOffCharProperty="off", ColorCharProperty="red", StorageClass="YS_SelectRAMPara", HeaderFile="MCU_FaultDiag_Paras.h", DefinitionFile="MCU_FaultDiag_Paras.c", DataType="uint8")
C_Fault_IcLimit_s32 = myPackage.Parameter(600, DoubleProperty=0, Int32Property=int32(0), LogicalProperty=false, OnOffCharProperty="off", ColorCharProperty="red", StorageClass="YS_SelectRAMPara", HeaderFile="MCU_Fault_Paras.h", DefinitionFile="MCU_Fault_Paras.c", DataType="single")  % c相电流故障限值设置
C_Fault_IcSensorFault_u32 = myPackage.Parameter(1, DoubleProperty=0, Int32Property=int32(0), LogicalProperty=false, OnOffCharProperty="off", ColorCharProperty="red", StorageClass="YS_SelectRAMPara", HeaderFile="MCU_Fault_Paras.h", DefinitionFile="MCU_Fault_Paras.c", DataType="uint32")  % c相电流瞬时故障检测使能开关
C_Fault_IphaseLimitStart_s32 = myPackage.Parameter(720, DoubleProperty=0, Int32Property=int32(0), LogicalProperty=false, OnOffCharProperty="off", ColorCharProperty="red", StorageClass="YS_SelectRAMPara", HeaderFile="MCU_Fault_Paras.h", DefinitionFile="MCU_Fault_Paras.c", DataType="single")
C_Fault_MotorTempSensor_i16 = myPackage.Parameter(0, DoubleProperty=0, Int32Property=int32(0), LogicalProperty=false, OnOffCharProperty="off", ColorCharProperty="red", StorageClass="YS_SelectRAMPara", HeaderFile="MCU_Fault_Paras.h", DefinitionFile="MCU_Fault_Paras.c", DataType="int16")  % 电机温度传感器选择0：传感器无效；1：PTC100/KTY82
C_Fault_SpdUpFaultConfirmCnt_u16 = myPackage.Parameter(0, DoubleProperty=0, Int32Property=int32(0), LogicalProperty=false, OnOffCharProperty="off", ColorCharProperty="red", StorageClass="YS_SelectRAMPara", HeaderFile="MCU_Fault_Paras.h", DefinitionFile="MCU_Fault_Paras.c", DataType="uint16")
C_Fault_SpdUpLimitStart_i16 = myPackage.Parameter(8600, DoubleProperty=0, Int32Property=int32(0), LogicalProperty=false, OnOffCharProperty="off", ColorCharProperty="red", StorageClass="YS_SelectRAMPara", HeaderFile="MCU_Fault_Paras.h", DefinitionFile="MCU_Fault_Paras.c", DataType="single")
C_Fault_SpdUpLimitStop_i16 = myPackage.Parameter(9000, DoubleProperty=0, Int32Property=int32(0), LogicalProperty=false, OnOffCharProperty="off", ColorCharProperty="red", StorageClass="YS_SelectRAMPara", HeaderFile="MCU_Fault_Paras.h", DefinitionFile="MCU_Fault_Paras.c", DataType="single")
C_Fault_SpdUpWarnConfirmCnt_u16 = myPackage.Parameter(0, DoubleProperty=0, Int32Property=int32(0), LogicalProperty=false, OnOffCharProperty="off", ColorCharProperty="red", StorageClass="YS_SelectRAMPara", HeaderFile="MCU_Fault_Paras.h", DefinitionFile="MCU_Fault_Paras.c", DataType="uint16")
C_Fault_TigbtLimitStart_i16 = myPackage.Parameter(85, DoubleProperty=0, Int32Property=int32(0), LogicalProperty=false, OnOffCharProperty="off", ColorCharProperty="red", StorageClass="YS_SelectRAMPara", HeaderFile="MCU_Fault_Paras.h", DefinitionFile="MCU_Fault_Paras.c", DataType="int16")  % IGBT降功率起始温度
C_Fault_TigbtLimitStop_i16 = myPackage.Parameter(95, DoubleProperty=0, Int32Property=int32(0), LogicalProperty=false, OnOffCharProperty="off", ColorCharProperty="red", StorageClass="YS_SelectRAMPara", HeaderFile="MCU_Fault_Paras.h", DefinitionFile="MCU_Fault_Paras.c", DataType="int16")  % IGBT降功率终止温度
C_Fault_TmotorCircutConfirmCnt_u16 = myPackage.Parameter(100, DoubleProperty=0, Int32Property=int32(0), LogicalProperty=false, OnOffCharProperty="off", ColorCharProperty="red", StorageClass="YS_SelectRAMPara", HeaderFile="MCU_Fault_Paras.h", DefinitionFile="MCU_Fault_Paras.c", DataType="uint16")  % 电机温度采样故障触发计次阈值
C_Fault_TmotorCircutConfirmTh_u16 = myPackage.Parameter(3800, DoubleProperty=0, Int32Property=int32(0), LogicalProperty=false, OnOffCharProperty="off", ColorCharProperty="red", StorageClass="YS_SelectRAMPara", HeaderFile="MCU_Fault_Paras.h", DefinitionFile="MCU_Fault_Paras.c", DataType="uint16")  % 电机温度采样故障ADC阈值
C_Fault_TmotorCircutFaultEn_u8 = myPackage.Parameter(0, DoubleProperty=0, Int32Property=int32(0), LogicalProperty=false, OnOffCharProperty="off", ColorCharProperty="red", StorageClass="YS_SelectRAMPara", HeaderFile="MCU_Fault_Paras.h", DefinitionFile="MCU_Fault_Paras.c", DataType="uint8")  % 电机温度采样故障开关
C_Fault_TmotorCircutLimitStart_i16 = myPackage.Parameter(140, DoubleProperty=0, Int32Property=int32(0), LogicalProperty=false, OnOffCharProperty="off", ColorCharProperty="red", StorageClass="YS_SelectRAMPara", HeaderFile="MCU_Fault_Paras.h", DefinitionFile="MCU_Fault_Paras.c", DataType="int16")  % 电机降功率起始温度
C_Fault_TmotorCircutLimitStop_i16 = myPackage.Parameter(160, DoubleProperty=0, Int32Property=int32(0), LogicalProperty=false, OnOffCharProperty="off", ColorCharProperty="red", StorageClass="YS_SelectRAMPara", HeaderFile="MCU_Fault_Paras.h", DefinitionFile="MCU_Fault_Paras.c", DataType="int16")  % 电机降功率终止温度
C_Fault_TmotorLimitStart_i16 = myPackage.Parameter(140, DoubleProperty=0, Int32Property=int32(0), LogicalProperty=false, OnOffCharProperty="off", ColorCharProperty="red", StorageClass="YS_SelectRAMPara", HeaderFile="MCU_Fault_Paras.h", DefinitionFile="MCU_Fault_Paras.c", DataType="int16")
C_Fault_TmotorLimitStop_i16 = myPackage.Parameter(160, DoubleProperty=0, Int32Property=int32(0), LogicalProperty=false, OnOffCharProperty="off", ColorCharProperty="red", StorageClass="YS_SelectRAMPara", HeaderFile="MCU_Fault_Paras.h", DefinitionFile="MCU_Fault_Paras.c", DataType="int16")
C_Fault_TmotorWarnConfirmCnt_u16 = myPackage.Parameter(0, DoubleProperty=0, Int32Property=int32(0), LogicalProperty=false, OnOffCharProperty="off", ColorCharProperty="red", StorageClass="YS_SelectRAMPara", HeaderFile="MCU_Fault_Paras.h", DefinitionFile="MCU_Fault_Paras.c", DataType="uint16")
C_Fault_UdcLoFaultConfirmCnt_u16 = myPackage.Parameter(0, DoubleProperty=0, Int32Property=int32(0), LogicalProperty=false, OnOffCharProperty="off", ColorCharProperty="red", StorageClass="YS_SelectRAMPara", HeaderFile="MCU_Fault_Paras.h", DefinitionFile="MCU_Fault_Paras.c", DataType="uint16")
C_Fault_UdcLoWarnConfirmCnt_u16 = myPackage.Parameter(0, DoubleProperty=0, Int32Property=int32(0), LogicalProperty=false, OnOffCharProperty="off", ColorCharProperty="red", StorageClass="YS_SelectRAMPara", HeaderFile="MCU_Fault_Paras.h", DefinitionFile="MCU_Fault_Paras.c", DataType="uint16")
C_Fault_UdcUpFaultConfirmCnt_u16 = myPackage.Parameter(0, DoubleProperty=0, Int32Property=int32(0), LogicalProperty=false, OnOffCharProperty="off", ColorCharProperty="red", StorageClass="YS_SelectRAMPara", HeaderFile="MCU_Fault_Paras.h", DefinitionFile="MCU_Fault_Paras.c", DataType="uint16")
C_Fault_UdcUpWarnConfirmCnt_u16 = myPackage.Parameter(0, DoubleProperty=0, Int32Property=int32(0), LogicalProperty=false, OnOffCharProperty="off", ColorCharProperty="red", StorageClass="YS_SelectRAMPara", HeaderFile="MCU_Fault_Paras.h", DefinitionFile="MCU_Fault_Paras.c", DataType="uint16")
M_Fault_CommandSource_i16 = myPackage.Signal(DoubleProperty=0, Int32Property=int32(0), LogicalProperty=false, OnOffCharProperty="off", ColorCharProperty="red", StorageClass="YS_SelectRAMSignal", HeaderFile="MCU_Fault_Signals.h", DefinitionFile="MCU_Fault_Signals.c", DataType="int16")
M_Fault_IaInstantFaultFlg_u8 = myPackage.Signal(DoubleProperty=0, Int32Property=int32(0), LogicalProperty=false, OnOffCharProperty="off", ColorCharProperty="red", StorageClass="YS_SelectRAMSignal", HeaderFile="MCU_FaultDiag_Signals.h", DefinitionFile="MCU_Fault_Signals.c", DataType="uint8", InitialValue="0")  % a相电流瞬时故障标志
M_Fault_IaInstantFaultNoDeb_u8 = myPackage.Signal(DoubleProperty=0, Int32Property=int32(0), LogicalProperty=false, OnOffCharProperty="off", ColorCharProperty="red", StorageClass="YS_SelectRAMSignal", HeaderFile="MCU_Fault_Signals.h", DefinitionFile="MCU_Fault_Signals.c", DataType="uint8")
M_Fault_IaSensorFault_u32 = myPackage.Signal(DoubleProperty=0, Int32Property=int32(0), LogicalProperty=false, OnOffCharProperty="off", ColorCharProperty="red", StorageClass="YS_SelectRAMSignal", HeaderFile="MCU_Fault_Signals.h", DefinitionFile="MCU_Fault_Signals.c", DataType="uint32")
M_Fault_IaSensorFault_u8 = myPackage.Signal(DoubleProperty=0, Int32Property=int32(0), LogicalProperty=false, OnOffCharProperty="off", ColorCharProperty="red", StorageClass="YS_SelectRAMSignal", HeaderFile="MCU_Fault_Signals.h", DefinitionFile="MCU_Fault_Signals.c", DataType="uint8")
M_Fault_IaValue_s32 = myPackage.Signal(DoubleProperty=0, Int32Property=int32(0), LogicalProperty=false, OnOffCharProperty="off", ColorCharProperty="red", StorageClass="YS_SelectRAMSignal", HeaderFile="MCU_Fault_Signals.h", DefinitionFile="MCU_Fault_Signals.c", DataType="single")
M_Fault_IbInstantFaultFlg_u8 = myPackage.Signal(DoubleProperty=0, Int32Property=int32(0), LogicalProperty=false, OnOffCharProperty="off", ColorCharProperty="red", StorageClass="YS_SelectRAMSignal", HeaderFile="MCU_FaultDiag_Signals.h", DefinitionFile="MCU_Fault_Signals.c", DataType="uint8", InitialValue="0")  % b相电流瞬时故障标志
M_Fault_IbInstantFaultNoDeb_u8 = myPackage.Signal(DoubleProperty=0, Int32Property=int32(0), LogicalProperty=false, OnOffCharProperty="off", ColorCharProperty="red", StorageClass="YS_SelectRAMSignal", HeaderFile="MCU_Fault_Signals.h", DefinitionFile="MCU_Fault_Signals.c", DataType="uint8")
M_Fault_IbSensorFault_u32 = myPackage.Signal(DoubleProperty=0, Int32Property=int32(0), LogicalProperty=false, OnOffCharProperty="off", ColorCharProperty="red", StorageClass="YS_SelectRAMSignal", HeaderFile="MCU_Fault_Signals.h", DefinitionFile="MCU_Fault_Signals.c", DataType="uint32")
M_Fault_IbSensorFault_u8 = myPackage.Signal(DoubleProperty=0, Int32Property=int32(0), LogicalProperty=false, OnOffCharProperty="off", ColorCharProperty="red", StorageClass="YS_SelectRAMSignal", HeaderFile="MCU_Fault_Signals.h", DefinitionFile="MCU_Fault_Signals.c", DataType="uint8")
M_Fault_IbValue_s32 = myPackage.Signal(DoubleProperty=0, Int32Property=int32(0), LogicalProperty=false, OnOffCharProperty="off", ColorCharProperty="red", StorageClass="YS_SelectRAMSignal", HeaderFile="MCU_Fault_Signals.h", DefinitionFile="MCU_Fault_Signals.c", DataType="single")
M_Fault_IcInstantFaultFlg_u8 = myPackage.Signal(DoubleProperty=0, Int32Property=int32(0), LogicalProperty=false, OnOffCharProperty="off", ColorCharProperty="red", StorageClass="YS_SelectRAMSignal", HeaderFile="MCU_FaultDiag_Signals.h", DefinitionFile="MCU_Fault_Signals.c", DataType="uint8", InitialValue="0")  % c相电流瞬时故障标志
M_Fault_IcInstantFaultNoDeb_u8 = myPackage.Signal(DoubleProperty=0, Int32Property=int32(0), LogicalProperty=false, OnOffCharProperty="off", ColorCharProperty="red", StorageClass="YS_SelectRAMSignal", HeaderFile="MCU_Fault_Signals.h", DefinitionFile="MCU_Fault_Signals.c", DataType="uint8")
M_Fault_IcSensorFault_u32 = myPackage.Signal(DoubleProperty=0, Int32Property=int32(0), LogicalProperty=false, OnOffCharProperty="off", ColorCharProperty="red", StorageClass="YS_SelectRAMSignal", HeaderFile="MCU_Fault_Signals.h", DefinitionFile="MCU_Fault_Signals.c", DataType="uint32")
M_Fault_IcSensorFault_u8 = myPackage.Signal(DoubleProperty=0, Int32Property=int32(0), LogicalProperty=false, OnOffCharProperty="off", ColorCharProperty="red", StorageClass="YS_SelectRAMSignal", HeaderFile="MCU_Fault_Signals.h", DefinitionFile="MCU_Fault_Signals.c", DataType="uint8")
M_Fault_IcValue_s32 = myPackage.Signal(DoubleProperty=0, Int32Property=int32(0), LogicalProperty=false, OnOffCharProperty="off", ColorCharProperty="red", StorageClass="YS_SelectRAMSignal", HeaderFile="MCU_Fault_Signals.h", DefinitionFile="MCU_Fault_Signals.c", DataType="single")
M_Fault_IgbtEnCmd_u16 = myPackage.Signal(DoubleProperty=0, Int32Property=int32(0), LogicalProperty=false, OnOffCharProperty="off", ColorCharProperty="red", StorageClass="YS_SelectRAMSignal", HeaderFile="MCU_Fault_Signals.h", DefinitionFile="MCU_Fault_Signals.c", DataType="uint16")
M_Fault_PhaseOVIaWarn_u32 = myPackage.Signal(DoubleProperty=0, Int32Property=int32(0), LogicalProperty=false, OnOffCharProperty="off", ColorCharProperty="red", StorageClass="YS_SelectRAMSignal", HeaderFile="MCU_Fault_Signals.h", DefinitionFile="MCU_Fault_Signals.c", DataType="uint32")
M_Fault_PhaseOVIbWarn_u32 = myPackage.Signal(DoubleProperty=0, Int32Property=int32(0), LogicalProperty=false, OnOffCharProperty="off", ColorCharProperty="red", StorageClass="YS_SelectRAMSignal", HeaderFile="MCU_Fault_Signals.h", DefinitionFile="MCU_Fault_Signals.c", DataType="uint32")
M_Fault_PhaseOVIcWarn_u32 = myPackage.Signal(DoubleProperty=0, Int32Property=int32(0), LogicalProperty=false, OnOffCharProperty="off", ColorCharProperty="red", StorageClass="YS_SelectRAMSignal", HeaderFile="MCU_Fault_Signals.h", DefinitionFile="MCU_Fault_Signals.c", DataType="uint32")
M_Fault_PrechargeOverFlg_u16 = myPackage.Signal(DoubleProperty=0, Int32Property=int32(0), LogicalProperty=false, OnOffCharProperty="off", ColorCharProperty="red", StorageClass="YS_SelectRAMSignal", HeaderFile="MCU_Fault_Signals.h", DefinitionFile="MCU_Fault_Signals.c", DataType="uint16")
M_Fault_SpdUpOverFault_u32 = myPackage.Signal(DoubleProperty=0, Int32Property=int32(0), LogicalProperty=false, OnOffCharProperty="off", ColorCharProperty="red", StorageClass="YS_SelectRAMSignal", HeaderFile="MCU_Fault_Signals.h", DefinitionFile="MCU_Fault_Signals.c", DataType="uint32")
M_Fault_SpdUpWarnFault_u32 = myPackage.Signal(DoubleProperty=0, Int32Property=int32(0), LogicalProperty=false, OnOffCharProperty="off", ColorCharProperty="red", StorageClass="YS_SelectRAMSignal", HeaderFile="MCU_Fault_Signals.h", DefinitionFile="MCU_Fault_Signals.c", DataType="uint32")
M_Fault_SpeedCal20msAbs_f32 = myPackage.Signal(DoubleProperty=0, Int32Property=int32(0), LogicalProperty=false, OnOffCharProperty="off", ColorCharProperty="red", StorageClass="YS_SelectRAMSignal", HeaderFile="MCU_Fault_Signals.h", DefinitionFile="MCU_Fault_Signals.c", DataType="single")
M_Fault_TigbtCircuitFault_u32 = myPackage.Signal(DoubleProperty=0, Int32Property=int32(0), LogicalProperty=false, OnOffCharProperty="off", ColorCharProperty="red", StorageClass="YS_SelectRAMSignal", HeaderFile="MCU_Fault_Signals.h", DefinitionFile="MCU_Fault_Signals.c", DataType="uint32")  % IGBT温度采样电路故障标志
M_Fault_TmotorCircuitFault_u32 = myPackage.Signal(DoubleProperty=0, Int32Property=int32(0), LogicalProperty=false, OnOffCharProperty="off", ColorCharProperty="red", StorageClass="YS_SelectRAMSignal", HeaderFile="MCU_Fault_Signals.h", DefinitionFile="MCU_Fault_Signals.c", DataType="uint32")  % 电机温度采样电路故障标志
M_Fault_TmotorOverFault_u32 = myPackage.Signal(DoubleProperty=0, Int32Property=int32(0), LogicalProperty=false, OnOffCharProperty="off", ColorCharProperty="red", StorageClass="YS_SelectRAMSignal", HeaderFile="MCU_Fault_Signals.h", DefinitionFile="MCU_Fault_Signals.c", DataType="uint32")  % 电机过温故障标志
M_Fault_TmotorWarnFault_u32 = myPackage.Signal(DoubleProperty=0, Int32Property=int32(0), LogicalProperty=false, OnOffCharProperty="off", ColorCharProperty="red", StorageClass="YS_SelectRAMSignal", HeaderFile="MCU_Fault_Signals.h", DefinitionFile="MCU_Fault_Signals.c", DataType="uint32")  % 电机过温警告标志
M_Fault_TrqCmdFilter_s32 = myPackage.Signal(DoubleProperty=0, Int32Property=int32(0), LogicalProperty=false, OnOffCharProperty="off", ColorCharProperty="red", StorageClass="YS_SelectRAMSignal", HeaderFile="MCU_Fault_Signals.h", DefinitionFile="MCU_Fault_Signals.c", DataType="single")
M_Fault_UdcLowerLimitStart_s32 = myPackage.Signal(DoubleProperty=0, Int32Property=int32(0), LogicalProperty=false, OnOffCharProperty="off", ColorCharProperty="red", StorageClass="YS_SelectRAMSignal", HeaderFile="MCU_Fault_Signals.h", DefinitionFile="MCU_Fault_Signals.c", DataType="single")
M_Fault_UdcLowerLimitStop_s32 = myPackage.Signal(DoubleProperty=0, Int32Property=int32(0), LogicalProperty=false, OnOffCharProperty="off", ColorCharProperty="red", StorageClass="YS_SelectRAMSignal", HeaderFile="MCU_Fault_Signals.h", DefinitionFile="MCU_Fault_Signals.c", DataType="single")
M_Fault_UdcReal_s32 = myPackage.Signal(DoubleProperty=0, Int32Property=int32(0), LogicalProperty=false, OnOffCharProperty="off", ColorCharProperty="red", StorageClass="YS_SelectRAMSignal", HeaderFile="MCU_Fault_Signals.h", DefinitionFile="MCU_Fault_Signals.c", DataType="single")
M_Fault_UdcUpFault_u32 = myPackage.Signal(DoubleProperty=0, Int32Property=int32(0), LogicalProperty=false, OnOffCharProperty="off", ColorCharProperty="red", StorageClass="YS_SelectRAMSignal", HeaderFile="MCU_Fault_Signals.h", DefinitionFile="MCU_Fault_Signals.c", DataType="uint32")
M_Fault_UdcUpLimitStart_s32 = myPackage.Signal(DoubleProperty=0, Int32Property=int32(0), LogicalProperty=false, OnOffCharProperty="off", ColorCharProperty="red", StorageClass="YS_SelectRAMSignal", HeaderFile="MCU_Fault_Signals.h", DefinitionFile="MCU_Fault_Signals.c", DataType="single")
M_Fault_UdcUpLimitStop_s32 = myPackage.Signal(DoubleProperty=0, Int32Property=int32(0), LogicalProperty=false, OnOffCharProperty="off", ColorCharProperty="red", StorageClass="YS_SelectRAMSignal", HeaderFile="MCU_Fault_Signals.h", DefinitionFile="MCU_Fault_Signals.c", DataType="single")
M_Fault_UdcUpWarn_u32 = myPackage.Signal(DoubleProperty=0, Int32Property=int32(0), LogicalProperty=false, OnOffCharProperty="off", ColorCharProperty="red", StorageClass="YS_SelectRAMSignal", HeaderFile="MCU_Fault_Signals.h", DefinitionFile="MCU_Fault_Signals.c", DataType="uint32")
M_Fault_VCUKeyState_u16 = myPackage.Signal(DoubleProperty=0, Int32Property=int32(0), LogicalProperty=false, OnOffCharProperty="off", ColorCharProperty="red", StorageClass="YS_SelectRAMSignal", HeaderFile="MCU_Fault_Signals.h", DefinitionFile="MCU_Fault_Signals.c", DataType="uint16")
M_Fault_VdcUnderFault_u32 = myPackage.Signal(DoubleProperty=0, Int32Property=int32(0), LogicalProperty=false, OnOffCharProperty="off", ColorCharProperty="red", StorageClass="YS_SelectRAMSignal", HeaderFile="MCU_Fault_Signals.h", DefinitionFile="MCU_Fault_Signals.c", DataType="uint32")
M_Fault_VdcUnderWarn_u32 = myPackage.Signal(DoubleProperty=0, Int32Property=int32(0), LogicalProperty=false, OnOffCharProperty="off", ColorCharProperty="red", StorageClass="YS_SelectRAMSignal", HeaderFile="MCU_Fault_Signals.h", DefinitionFile="MCU_Fault_Signals.c", DataType="uint32")

FaultBus = Simulink.Bus(HeaderFile="MCU_FaultDiag_Signals.h")
  FaultFlg: uint8
  FaultLevel: uint8
  FaultCoeff: single

C_Fault_TigbtCircuitFaultDiagEn_u8 = myPackage.Parameter(0, DoubleProperty=0, Int32Property=int32(0), LogicalProperty=false, OnOffCharProperty="off", ColorCharProperty="red", StorageClass="YS_SelectRAMPara", HeaderFile="MCU_FaultDiag_Paras.h", DefinitionFile="MCU_FaultDiag_Paras.c", DataType="uint8")
C_Fault_TigbtCircutFaultEn_u8 = myPackage.Parameter(0, DoubleProperty=0, Int32Property=int32(0), LogicalProperty=false, OnOffCharProperty="off", ColorCharProperty="red", StorageClass="YS_SelectRAMPara", HeaderFile="MCU_Fault_Paras.h", DefinitionFile="MCU_Fault_Paras.c", DataType="uint8")  % Igbt温度采样故障开关
M_Fault_IaInstantFault_u8 = myPackage.Signal(DoubleProperty=0, Int32Property=int32(0), LogicalProperty=false, OnOffCharProperty="off", ColorCharProperty="red", StorageClass="YS_SelectRAMSignal", HeaderFile="MCU_Fault_Signals.h", DefinitionFile="MCU_Fault_Signals.c", DataType="uint8", InitialValue="0")  % a相电流瞬时故障标志
M_Fault_IbInstantFault_u8 = myPackage.Signal(DoubleProperty=0, Int32Property=int32(0), LogicalProperty=false, OnOffCharProperty="off", ColorCharProperty="red", StorageClass="YS_SelectRAMSignal", HeaderFile="MCU_Fault_Signals.h", DefinitionFile="MCU_Fault_Signals.c", DataType="uint8", InitialValue="0")  % b相电流瞬时故障标志
M_Fault_IcInstantFault_u8 = myPackage.Signal(DoubleProperty=0, Int32Property=int32(0), LogicalProperty=false, OnOffCharProperty="off", ColorCharProperty="red", StorageClass="YS_SelectRAMSignal", HeaderFile="MCU_Fault_Signals.h", DefinitionFile="MCU_Fault_Signals.c", DataType="uint8", InitialValue="0")  % c相电流瞬时故障标志
M_Fault_IaInstantFltInfo_bus = myPackage.Signal(DoubleProperty=0, Int32Property=int32(0), LogicalProperty=false, OnOffCharProperty="off", ColorCharProperty="red", StorageClass="YS_SelectRAMSignal", DataType="Bus: FaultBus")
C_Fault_IaConfirmCnt_u16 = myPackage.Parameter(0, DoubleProperty=0, Int32Property=int32(0), LogicalProperty=false, OnOffCharProperty="off", ColorCharProperty="red", StorageClass="YS_SelectRAMPara", HeaderFile="MCU_FaultDiag_Paras.h", DefinitionFile="MCU_FaultDiag_Paras.c", DataType="uint16")  % a相电流故障触发计次阈值
C_Fault_IbConfirmCnt_u16 = myPackage.Parameter(0, DoubleProperty=0, Int32Property=int32(0), LogicalProperty=false, OnOffCharProperty="off", ColorCharProperty="red", StorageClass="YS_SelectRAMPara", HeaderFile="MCU_FaultDiag_Paras.h", DefinitionFile="MCU_FaultDiag_Paras.c", DataType="uint16")  % b相电流故障触发计次阈值
C_Fault_IcConfirmCnt_u16 = myPackage.Parameter(0, DoubleProperty=0, Int32Property=int32(0), LogicalProperty=false, OnOffCharProperty="off", ColorCharProperty="red", StorageClass="YS_SelectRAMPara", HeaderFile="MCU_FaultDiag_Paras.h", DefinitionFile="MCU_FaultDiag_Paras.c", DataType="uint16")  % c相电流故障触发计次阈值
C_Fault_TigbtCircutConfirmCnt_u16 = myPackage.Parameter(100, DoubleProperty=0, Int32Property=int32(0), LogicalProperty=false, OnOffCharProperty="off", ColorCharProperty="red", StorageClass="YS_SelectRAMPara", HeaderFile="MCU_FaultDiag_Paras.h", DefinitionFile="MCU_FaultDiag_Paras.c", DataType="uint16")  % Igbt温度采样故障触发计次阈值
C_Fault_TigbtCircutConfirmTh_u16 = myPackage.Parameter(3800, DoubleProperty=0, Int32Property=int32(0), LogicalProperty=false, OnOffCharProperty="off", ColorCharProperty="red", StorageClass="YS_SelectRAMPara", HeaderFile="MCU_FaultDiag_Paras.h", DefinitionFile="MCU_FaultDiag_Paras.c", DataType="uint16")  % Igbt温度采样故障ADC阈值
C_Fault_TigbtCircutFaultCoeff_f32 = myPackage.Parameter(0, DoubleProperty=0, Int32Property=int32(0), LogicalProperty=false, OnOffCharProperty="off", ColorCharProperty="red", StorageClass="YS_SelectRAMPara", HeaderFile="MCU_FaultDiag_Paras.h", DefinitionFile="MCU_FaultDiag_Paras.c", DataType="single")
C_Fault_TigbtCircutFaultErrCode_u16 = myPackage.Parameter([], DoubleProperty=0, Int32Property=int32(0), LogicalProperty=false, OnOffCharProperty="off", ColorCharProperty="red", StorageClass="YS_SelectRAMPara", HeaderFile="MCU_FaultDiag_Paras.h", DefinitionFile="MCU_FaultDiag_Paras.c", DataType="uint16")
C_Fault_TigbtCircutFaultLevel_u8 = myPackage.Parameter(0, DoubleProperty=0, Int32Property=int32(0), LogicalProperty=false, OnOffCharProperty="off", ColorCharProperty="red", StorageClass="YS_SelectRAMPara", HeaderFile="MCU_FaultDiag_Paras.h", DefinitionFile="MCU_FaultDiag_Paras.c", DataType="uint8")
M_Fault_TigbtCircuitFltInfo_bus = myPackage.Signal(DoubleProperty=0, Int32Property=int32(0), LogicalProperty=false, OnOffCharProperty="off", ColorCharProperty="red", StorageClass="YS_SelectRAMSignal", HeaderFile="MCU_FaultDiag_Signals.h", DefinitionFile="MCU_Fault_Signals.c", DataType="Bus: FaultBus")
C_Fault_IdcCircuitConfirmCnt_u16 = myPackage.Parameter(10, DoubleProperty=0, Int32Property=int32(0), LogicalProperty=false, OnOffCharProperty="off", ColorCharProperty="red", StorageClass="YS_SelectRAMPara", HeaderFile="MCU_FaultDiag_Paras.h", DefinitionFile="MCU_FaultDiag_Paras.c", DataType="uint16")
C_Fault_IdcCircuitConfirmDownTh_u16 = myPackage.Parameter(300, DoubleProperty=0, Int32Property=int32(0), LogicalProperty=false, OnOffCharProperty="off", ColorCharProperty="red", StorageClass="YS_SelectRAMPara", HeaderFile="MCU_FaultDiag_Paras.h", DefinitionFile="MCU_FaultDiag_Paras.c", DataType="uint16")
C_Fault_IdcCircuitConfirmUpTh_u16 = myPackage.Parameter(3800, DoubleProperty=0, Int32Property=int32(0), LogicalProperty=false, OnOffCharProperty="off", ColorCharProperty="red", StorageClass="YS_SelectRAMPara", HeaderFile="MCU_FaultDiag_Paras.h", DefinitionFile="MCU_FaultDiag_Paras.c", DataType="uint16")
C_Fault_IdcCircuitFaultCoeff_f32 = myPackage.Parameter(0, DoubleProperty=0, Int32Property=int32(0), LogicalProperty=false, OnOffCharProperty="off", ColorCharProperty="red", StorageClass="YS_SelectRAMPara", HeaderFile="MCU_FaultDiag_Paras.h", DefinitionFile="MCU_FaultDiag_Paras.c", DataType="single")
C_Fault_IdcCircuitFaultDiagEn_u8 = myPackage.Parameter(0, DoubleProperty=0, Int32Property=int32(0), LogicalProperty=false, OnOffCharProperty="off", ColorCharProperty="red", StorageClass="YS_SelectRAMPara", HeaderFile="MCU_FaultDiag_Paras.h", DefinitionFile="MCU_FaultDiag_Paras.c", DataType="uint8")
C_Fault_IdcCircuitFaultLevel_u8 = myPackage.Parameter(0, DoubleProperty=0, Int32Property=int32(0), LogicalProperty=false, OnOffCharProperty="off", ColorCharProperty="red", StorageClass="YS_SelectRAMPara", HeaderFile="MCU_FaultDiag_Paras.h", DefinitionFile="MCU_FaultDiag_Paras.c", DataType="uint8")
C_Fault_TigbtCircuitConfirmCnt_u16 = myPackage.Parameter(100, DoubleProperty=0, Int32Property=int32(0), LogicalProperty=false, OnOffCharProperty="off", ColorCharProperty="red", StorageClass="YS_SelectRAMPara", HeaderFile="MCU_FaultDiag_Paras.h", DefinitionFile="MCU_FaultDiag_Paras.c", DataType="uint16")  % Igbt温度采样故障触发计次阈值
C_Fault_TigbtCircuitConfirmTh_u16 = myPackage.Parameter(3800, DoubleProperty=0, Int32Property=int32(0), LogicalProperty=false, OnOffCharProperty="off", ColorCharProperty="red", StorageClass="YS_SelectRAMPara", HeaderFile="MCU_FaultDiag_Paras.h", DefinitionFile="MCU_FaultDiag_Paras.c", DataType="uint16")  % Igbt温度采样故障ADC阈值
C_Fault_TigbtCircuitFaultCoeff_f32 = myPackage.Parameter(0, DoubleProperty=0, Int32Property=int32(0), LogicalProperty=false, OnOffCharProperty="off", ColorCharProperty="red", StorageClass="YS_SelectRAMPara", HeaderFile="MCU_FaultDiag_Paras.h", DefinitionFile="MCU_FaultDiag_Paras.c", DataType="single")
C_Fault_TigbtCircuitFaultLevel_u8 = myPackage.Parameter(0, DoubleProperty=0, Int32Property=int32(0), LogicalProperty=false, OnOffCharProperty="off", ColorCharProperty="red", StorageClass="YS_SelectRAMPara", HeaderFile="MCU_FaultDiag_Paras.h", DefinitionFile="MCU_FaultDiag_Paras.c", DataType="uint8")
C_Fault_TigbtCircuitFaultErrCode_u16 = myPackage.Parameter(1, DoubleProperty=0, Int32Property=int32(0), LogicalProperty=false, OnOffCharProperty="off", ColorCharProperty="red", StorageClass="YS_SelectRAMPara", HeaderFile="MCU_FaultDiag_Paras.h", DefinitionFile="MCU_FaultDiag_Paras.c", DataType="uint16")
C_Fault_IdcCircuitFaultErrCode_u16 = myPackage.Parameter(1, DoubleProperty=0, Int32Property=int32(0), LogicalProperty=false, OnOffCharProperty="off", ColorCharProperty="red", StorageClass="YS_SelectRAMPara", HeaderFile="MCU_FaultDiag_Paras.h", DefinitionFile="MCU_FaultDiag_Paras.c", DataType="uint16")
M_Fault_IdcCircuitFltInfo_bus = myPackage.Signal(DoubleProperty=0, Int32Property=int32(0), LogicalProperty=false, OnOffCharProperty="off", ColorCharProperty="red", StorageClass="YS_SelectRAMSignal", HeaderFile="MCU_FaultDiag_Signals.h", DefinitionFile="MCU_Fault_Signals.c", DataType="Bus: FaultBus")
M_Fault_IaCircuitFltInfo_bus = myPackage.Signal(DoubleProperty=0, Int32Property=int32(0), LogicalProperty=false, OnOffCharProperty="off", ColorCharProperty="red", StorageClass="YS_SelectRAMSignal", HeaderFile="MCU_FaultDiag_Signals.h", DefinitionFile="MCU_Fault_Signals.c", DataType="Bus: FaultBus")
M_Fault_IbCircuitFltInfo_bus = myPackage.Signal(DoubleProperty=0, Int32Property=int32(0), LogicalProperty=false, OnOffCharProperty="off", ColorCharProperty="red", StorageClass="YS_SelectRAMSignal", HeaderFile="MCU_FaultDiag_Signals.h", DefinitionFile="MCU_Fault_Signals.c", DataType="Bus: FaultBus")
M_Fault_IcCircuitFltInfo_bus = myPackage.Signal(DoubleProperty=0, Int32Property=int32(0), LogicalProperty=false, OnOffCharProperty="off", ColorCharProperty="red", StorageClass="YS_SelectRAMSignal", HeaderFile="MCU_FaultDiag_Signals.h", DefinitionFile="MCU_Fault_Signals.c", DataType="Bus: FaultBus")
C_Fault_IaCircuitConfirmCnt_u16 = myPackage.Parameter(10, DoubleProperty=0, Int32Property=int32(0), LogicalProperty=false, OnOffCharProperty="off", ColorCharProperty="red", StorageClass="YS_SelectRAMPara", HeaderFile="MCU_FaultDiag_Paras.h", DefinitionFile="MCU_FaultDiag_Paras.c", DataType="uint16")
C_Fault_IaCircuitConfirmDownTh_u16 = myPackage.Parameter(300, DoubleProperty=0, Int32Property=int32(0), LogicalProperty=false, OnOffCharProperty="off", ColorCharProperty="red", StorageClass="YS_SelectRAMPara", HeaderFile="MCU_FaultDiag_Paras.h", DefinitionFile="MCU_FaultDiag_Paras.c", DataType="uint16")
C_Fault_IaCircuitConfirmUpTh_u16 = myPackage.Parameter(3800, DoubleProperty=0, Int32Property=int32(0), LogicalProperty=false, OnOffCharProperty="off", ColorCharProperty="red", StorageClass="YS_SelectRAMPara", HeaderFile="MCU_FaultDiag_Paras.h", DefinitionFile="MCU_FaultDiag_Paras.c", DataType="uint16")
C_Fault_IaCircuitFaultCoeff_f32 = myPackage.Parameter(0, DoubleProperty=0, Int32Property=int32(0), LogicalProperty=false, OnOffCharProperty="off", ColorCharProperty="red", StorageClass="YS_SelectRAMPara", HeaderFile="MCU_FaultDiag_Paras.h", DefinitionFile="MCU_FaultDiag_Paras.c", DataType="single")
C_Fault_IaCircuitFaultDiagEn_u8 = myPackage.Parameter(0, DoubleProperty=0, Int32Property=int32(0), LogicalProperty=false, OnOffCharProperty="off", ColorCharProperty="red", StorageClass="YS_SelectRAMPara", HeaderFile="MCU_FaultDiag_Paras.h", DefinitionFile="MCU_FaultDiag_Paras.c", DataType="uint8")
C_Fault_IaCircuitFaultErrCode_u16 = myPackage.Parameter(1, DoubleProperty=0, Int32Property=int32(0), LogicalProperty=false, OnOffCharProperty="off", ColorCharProperty="red", StorageClass="YS_SelectRAMPara", HeaderFile="MCU_FaultDiag_Paras.h", DefinitionFile="MCU_FaultDiag_Paras.c", DataType="uint16")
C_Fault_IaCircuitFaultLevel_u8 = myPackage.Parameter(0, DoubleProperty=0, Int32Property=int32(0), LogicalProperty=false, OnOffCharProperty="off", ColorCharProperty="red", StorageClass="YS_SelectRAMPara", HeaderFile="MCU_FaultDiag_Paras.h", DefinitionFile="MCU_FaultDiag_Paras.c", DataType="uint8")
C_Fault_IbCircuitConfirmCnt_u16 = myPackage.Parameter(10, DoubleProperty=0, Int32Property=int32(0), LogicalProperty=false, OnOffCharProperty="off", ColorCharProperty="red", StorageClass="YS_SelectRAMPara", HeaderFile="MCU_FaultDiag_Paras.h", DefinitionFile="MCU_FaultDiag_Paras.c", DataType="uint16")
C_Fault_IbCircuitConfirmDownTh_u16 = myPackage.Parameter(300, DoubleProperty=0, Int32Property=int32(0), LogicalProperty=false, OnOffCharProperty="off", ColorCharProperty="red", StorageClass="YS_SelectRAMPara", HeaderFile="MCU_FaultDiag_Paras.h", DefinitionFile="MCU_FaultDiag_Paras.c", DataType="uint16")
C_Fault_IbCircuitConfirmUpTh_u16 = myPackage.Parameter(3800, DoubleProperty=0, Int32Property=int32(0), LogicalProperty=false, OnOffCharProperty="off", ColorCharProperty="red", StorageClass="YS_SelectRAMPara", HeaderFile="MCU_FaultDiag_Paras.h", DefinitionFile="MCU_FaultDiag_Paras.c", DataType="uint16")
C_Fault_IbCircuitFaultCoeff_f32 = myPackage.Parameter(0, DoubleProperty=0, Int32Property=int32(0), LogicalProperty=false, OnOffCharProperty="off", ColorCharProperty="red", StorageClass="YS_SelectRAMPara", HeaderFile="MCU_FaultDiag_Paras.h", DefinitionFile="MCU_FaultDiag_Paras.c", DataType="single")
C_Fault_IbCircuitFaultDiagEn_u8 = myPackage.Parameter(0, DoubleProperty=0, Int32Property=int32(0), LogicalProperty=false, OnOffCharProperty="off", ColorCharProperty="red", StorageClass="YS_SelectRAMPara", HeaderFile="MCU_FaultDiag_Paras.h", DefinitionFile="MCU_FaultDiag_Paras.c", DataType="uint8")
C_Fault_IbCircuitFaultErrCode_u16 = myPackage.Parameter(1, DoubleProperty=0, Int32Property=int32(0), LogicalProperty=false, OnOffCharProperty="off", ColorCharProperty="red", StorageClass="YS_SelectRAMPara", HeaderFile="MCU_FaultDiag_Paras.h", DefinitionFile="MCU_FaultDiag_Paras.c", DataType="uint16")
C_Fault_IbCircuitFaultLevel_u8 = myPackage.Parameter(0, DoubleProperty=0, Int32Property=int32(0), LogicalProperty=false, OnOffCharProperty="off", ColorCharProperty="red", StorageClass="YS_SelectRAMPara", HeaderFile="MCU_FaultDiag_Paras.h", DefinitionFile="MCU_FaultDiag_Paras.c", DataType="uint8")
C_Fault_IcCircuitConfirmCnt_u16 = myPackage.Parameter(10, DoubleProperty=0, Int32Property=int32(0), LogicalProperty=false, OnOffCharProperty="off", ColorCharProperty="red", StorageClass="YS_SelectRAMPara", HeaderFile="MCU_FaultDiag_Paras.h", DefinitionFile="MCU_FaultDiag_Paras.c", DataType="uint16")
C_Fault_IcCircuitConfirmDownTh_u16 = myPackage.Parameter(300, DoubleProperty=0, Int32Property=int32(0), LogicalProperty=false, OnOffCharProperty="off", ColorCharProperty="red", StorageClass="YS_SelectRAMPara", HeaderFile="MCU_FaultDiag_Paras.h", DefinitionFile="MCU_FaultDiag_Paras.c", DataType="uint16")
C_Fault_IcCircuitConfirmUpTh_u16 = myPackage.Parameter(3800, DoubleProperty=0, Int32Property=int32(0), LogicalProperty=false, OnOffCharProperty="off", ColorCharProperty="red", StorageClass="YS_SelectRAMPara", HeaderFile="MCU_FaultDiag_Paras.h", DefinitionFile="MCU_FaultDiag_Paras.c", DataType="uint16")
C_Fault_IcCircuitFaultCoeff_f32 = myPackage.Parameter(0, DoubleProperty=0, Int32Property=int32(0), LogicalProperty=false, OnOffCharProperty="off", ColorCharProperty="red", StorageClass="YS_SelectRAMPara", HeaderFile="MCU_FaultDiag_Paras.h", DefinitionFile="MCU_FaultDiag_Paras.c", DataType="single")
C_Fault_IcCircuitFaultDiagEn_u8 = myPackage.Parameter(0, DoubleProperty=0, Int32Property=int32(0), LogicalProperty=false, OnOffCharProperty="off", ColorCharProperty="red", StorageClass="YS_SelectRAMPara", HeaderFile="MCU_FaultDiag_Paras.h", DefinitionFile="MCU_FaultDiag_Paras.c", DataType="uint8")
C_Fault_IcCircuitFaultErrCode_u16 = myPackage.Parameter(1, DoubleProperty=0, Int32Property=int32(0), LogicalProperty=false, OnOffCharProperty="off", ColorCharProperty="red", StorageClass="YS_SelectRAMPara", HeaderFile="MCU_FaultDiag_Paras.h", DefinitionFile="MCU_FaultDiag_Paras.c", DataType="uint16")
C_Fault_IcCircuitFaultLevel_u8 = myPackage.Parameter(0, DoubleProperty=0, Int32Property=int32(0), LogicalProperty=false, OnOffCharProperty="off", ColorCharProperty="red", StorageClass="YS_SelectRAMPara", HeaderFile="MCU_FaultDiag_Paras.h", DefinitionFile="MCU_FaultDiag_Paras.c", DataType="uint8")
C_Fault_TpcuCircuitConfirmCnt_u16 = myPackage.Parameter(100, DoubleProperty=0, Int32Property=int32(0), LogicalProperty=false, OnOffCharProperty="off", ColorCharProperty="red", StorageClass="YS_SelectRAMPara", HeaderFile="MCU_FaultDiag_Paras.h", DefinitionFile="MCU_FaultDiag_Paras.c", DataType="uint16")  % Igbt温度采样故障触发计次阈值
C_Fault_TpcuCircuitConfirmTh_u16 = myPackage.Parameter(3800, DoubleProperty=0, Int32Property=int32(0), LogicalProperty=false, OnOffCharProperty="off", ColorCharProperty="red", StorageClass="YS_SelectRAMPara", HeaderFile="MCU_FaultDiag_Paras.h", DefinitionFile="MCU_FaultDiag_Paras.c", DataType="uint16")  % Igbt温度采样故障ADC阈值
C_Fault_TpcuCircuitFaultCoeff_f32 = myPackage.Parameter(0, DoubleProperty=0, Int32Property=int32(0), LogicalProperty=false, OnOffCharProperty="off", ColorCharProperty="red", StorageClass="YS_SelectRAMPara", HeaderFile="MCU_FaultDiag_Paras.h", DefinitionFile="MCU_FaultDiag_Paras.c", DataType="single")
C_Fault_TpcuCircuitFaultDiagEn_u8 = myPackage.Parameter(0, DoubleProperty=0, Int32Property=int32(0), LogicalProperty=false, OnOffCharProperty="off", ColorCharProperty="red", StorageClass="YS_SelectRAMPara", HeaderFile="MCU_FaultDiag_Paras.h", DefinitionFile="MCU_FaultDiag_Paras.c", DataType="uint8")
C_Fault_TpcuCircuitFaultErrCode_u16 = myPackage.Parameter(1, DoubleProperty=0, Int32Property=int32(0), LogicalProperty=false, OnOffCharProperty="off", ColorCharProperty="red", StorageClass="YS_SelectRAMPara", HeaderFile="MCU_FaultDiag_Paras.h", DefinitionFile="MCU_FaultDiag_Paras.c", DataType="uint16")
C_Fault_TpcuCircuitFaultLevel_u8 = myPackage.Parameter(0, DoubleProperty=0, Int32Property=int32(0), LogicalProperty=false, OnOffCharProperty="off", ColorCharProperty="red", StorageClass="YS_SelectRAMPara", HeaderFile="MCU_FaultDiag_Paras.h", DefinitionFile="MCU_FaultDiag_Paras.c", DataType="uint8")
M_Fault_TpcuCircuitFltInfo_bus = myPackage.Signal(DoubleProperty=0, Int32Property=int32(0), LogicalProperty=false, OnOffCharProperty="off", ColorCharProperty="red", StorageClass="YS_SelectRAMSignal", HeaderFile="MCU_FaultDiag_Signals.h", DefinitionFile="MCU_Fault_Signals.c", DataType="Bus: FaultBus")
C_Fault_TmotorCircuitConfirmCnt_u16 = myPackage.Parameter(100, DoubleProperty=0, Int32Property=int32(0), LogicalProperty=false, OnOffCharProperty="off", ColorCharProperty="red", StorageClass="YS_SelectRAMPara", HeaderFile="MCU_FaultDiag_Paras.h", DefinitionFile="MCU_FaultDiag_Paras.c", DataType="uint16")  % Igbt温度采样故障触发计次阈值
C_Fault_TmotorCircuitConfirmTh_u16 = myPackage.Parameter(3800, DoubleProperty=0, Int32Property=int32(0), LogicalProperty=false, OnOffCharProperty="off", ColorCharProperty="red", StorageClass="YS_SelectRAMPara", HeaderFile="MCU_FaultDiag_Paras.h", DefinitionFile="MCU_FaultDiag_Paras.c", DataType="uint16")  % Igbt温度采样故障ADC阈值
C_Fault_TmotorCircuitFaultCoeff_f32 = myPackage.Parameter(0, DoubleProperty=0, Int32Property=int32(0), LogicalProperty=false, OnOffCharProperty="off", ColorCharProperty="red", StorageClass="YS_SelectRAMPara", HeaderFile="MCU_FaultDiag_Paras.h", DefinitionFile="MCU_FaultDiag_Paras.c", DataType="single")
C_Fault_TmotorCircuitFaultDiagEn_u8 = myPackage.Parameter(0, DoubleProperty=0, Int32Property=int32(0), LogicalProperty=false, OnOffCharProperty="off", ColorCharProperty="red", StorageClass="YS_SelectRAMPara", HeaderFile="MCU_FaultDiag_Paras.h", DefinitionFile="MCU_FaultDiag_Paras.c", DataType="uint8")
C_Fault_TmotorCircuitFaultErrCode_u16 = myPackage.Parameter(1, DoubleProperty=0, Int32Property=int32(0), LogicalProperty=false, OnOffCharProperty="off", ColorCharProperty="red", StorageClass="YS_SelectRAMPara", HeaderFile="MCU_FaultDiag_Paras.h", DefinitionFile="MCU_FaultDiag_Paras.c", DataType="uint16")
C_Fault_TmotorCircuitFaultLevel_u8 = myPackage.Parameter(0, DoubleProperty=0, Int32Property=int32(0), LogicalProperty=false, OnOffCharProperty="off", ColorCharProperty="red", StorageClass="YS_SelectRAMPara", HeaderFile="MCU_FaultDiag_Paras.h", DefinitionFile="MCU_FaultDiag_Paras.c", DataType="uint8")
M_Fault_TmotorCircuitFltInfo_bus = myPackage.Signal(DoubleProperty=0, Int32Property=int32(0), LogicalProperty=false, OnOffCharProperty="off", ColorCharProperty="red", StorageClass="YS_SelectRAMSignal", HeaderFile="MCU_FaultDiag_Signals.h", DefinitionFile="MCU_Fault_Signals.c", DataType="Bus: FaultBus")
C_Fault_UdcCircuitConfirmTh_u16 = myPackage.Parameter(4070, DoubleProperty=0, Int32Property=int32(0), LogicalProperty=false, OnOffCharProperty="off", ColorCharProperty="red", StorageClass="YS_SelectRAMPara", HeaderFile="MCU_FaultDiag_Paras.h", DefinitionFile="MCU_FaultDiag_Paras.c", DataType="uint16")  % Igbt温度采样故障ADC阈值
C_Fault_UdcCircuitFaultCoeff_f32 = myPackage.Parameter(0, DoubleProperty=0, Int32Property=int32(0), LogicalProperty=false, OnOffCharProperty="off", ColorCharProperty="red", StorageClass="YS_SelectRAMPara", HeaderFile="MCU_FaultDiag_Paras.h", DefinitionFile="MCU_FaultDiag_Paras.c", DataType="single")
C_Fault_UdcCircuitFaultDiagEn_u8 = myPackage.Parameter(0, DoubleProperty=0, Int32Property=int32(0), LogicalProperty=false, OnOffCharProperty="off", ColorCharProperty="red", StorageClass="YS_SelectRAMPara", HeaderFile="MCU_FaultDiag_Paras.h", DefinitionFile="MCU_FaultDiag_Paras.c", DataType="uint8")
C_Fault_UdcCircuitFaultErrCode_u16 = myPackage.Parameter(1, DoubleProperty=0, Int32Property=int32(0), LogicalProperty=false, OnOffCharProperty="off", ColorCharProperty="red", StorageClass="YS_SelectRAMPara", HeaderFile="MCU_FaultDiag_Paras.h", DefinitionFile="MCU_FaultDiag_Paras.c", DataType="uint16")
C_Fault_UdcCircuitFaultLevel_u8 = myPackage.Parameter(0, DoubleProperty=0, Int32Property=int32(0), LogicalProperty=false, OnOffCharProperty="off", ColorCharProperty="red", StorageClass="YS_SelectRAMPara", HeaderFile="MCU_FaultDiag_Paras.h", DefinitionFile="MCU_FaultDiag_Paras.c", DataType="uint8")
M_Fault_UdcCircuitFltInfo_bus = myPackage.Signal(DoubleProperty=0, Int32Property=int32(0), LogicalProperty=false, OnOffCharProperty="off", ColorCharProperty="red", StorageClass="YS_SelectRAMSignal", HeaderFile="MCU_FaultDiag_Signals.h", DefinitionFile="MCU_Fault_Signals.c", DataType="Bus: FaultBus")
M_Fault_TigbtOverFault_u32 = myPackage.Signal(DoubleProperty=0, Int32Property=int32(0), LogicalProperty=false, OnOffCharProperty="off", ColorCharProperty="red", StorageClass="YS_SelectRAMSignal", HeaderFile="MCU_FaultDiag_Signals.h", DefinitionFile="MCU_Fault_Signals.c", DataType="uint8")  % IGBT过温故障标志
M_Fault_TigbtWarnFault_u32 = myPackage.Signal(DoubleProperty=0, Int32Property=int32(0), LogicalProperty=false, OnOffCharProperty="off", ColorCharProperty="red", StorageClass="YS_SelectRAMSignal", HeaderFile="MCU_FaultDiag_Signals.h", DefinitionFile="MCU_Fault_Signals.c", DataType="uint8")  % IGBT过温警告标志
M_Fault_TigbtOverFault_u8 = myPackage.Signal(DoubleProperty=0, Int32Property=int32(0), LogicalProperty=false, OnOffCharProperty="off", ColorCharProperty="red", StorageClass="YS_SelectRAMSignal", HeaderFile="MCU_FaultDiag_Signals.h", DefinitionFile="MCU_Fault_Signals.c", DataType="uint8")  % IGBT过温故障标志
M_Fault_TigbtWarnFault_u8 = myPackage.Signal(DoubleProperty=0, Int32Property=int32(0), LogicalProperty=false, OnOffCharProperty="off", ColorCharProperty="red", StorageClass="YS_SelectRAMSignal", HeaderFile="MCU_FaultDiag_Signals.h", DefinitionFile="MCU_Fault_Signals.c", DataType="uint8")  % IGBT过温警告标志
C_Fault_TigbtFaultDiagEn_u8 = myPackage.Parameter(0, DoubleProperty=0, Int32Property=int32(0), LogicalProperty=false, OnOffCharProperty="off", ColorCharProperty="red", StorageClass="YS_SelectRAMPara", HeaderFile="MCU_FaultDiag_Paras.h", DefinitionFile="MCU_FaultDiag_Paras.c", DataType="uint8")
C_Fault_TigbtConfirmCnt_u16 = myPackage.Parameter(0, DoubleProperty=0, Int32Property=int32(0), LogicalProperty=false, OnOffCharProperty="off", ColorCharProperty="red", StorageClass="YS_SelectRAMPara", HeaderFile="MCU_FaultDiag_Paras.h", DefinitionFile="MCU_FaultDiag_Paras.c", DataType="uint16")  % Igbt温度采样故障触发计次阈值
C_Fault_TigbtFaultCoeff_f32 = myPackage.Parameter(0, DoubleProperty=0, Int32Property=int32(0), LogicalProperty=false, OnOffCharProperty="off", ColorCharProperty="red", StorageClass="YS_SelectRAMPara", HeaderFile="MCU_FaultDiag_Paras.h", DefinitionFile="MCU_FaultDiag_Paras.c", DataType="single")
C_Fault_TigbtFaultErrCode_u16 = myPackage.Parameter(1, DoubleProperty=0, Int32Property=int32(0), LogicalProperty=false, OnOffCharProperty="off", ColorCharProperty="red", StorageClass="YS_SelectRAMPara", HeaderFile="MCU_FaultDiag_Paras.h", DefinitionFile="MCU_FaultDiag_Paras.c", DataType="uint16")
C_Fault_TigbtFaultLevel_u8 = myPackage.Parameter(0, DoubleProperty=0, Int32Property=int32(0), LogicalProperty=false, OnOffCharProperty="off", ColorCharProperty="red", StorageClass="YS_SelectRAMPara", HeaderFile="MCU_FaultDiag_Paras.h", DefinitionFile="MCU_FaultDiag_Paras.c", DataType="uint8")
C_Fault_UdcCircuitConfirmCnt_u16 = myPackage.Parameter(100, DoubleProperty=0, Int32Property=int32(0), LogicalProperty=false, OnOffCharProperty="off", ColorCharProperty="red", StorageClass="YS_SelectRAMPara", HeaderFile="MCU_FaultDiag_Paras.h", DefinitionFile="MCU_FaultDiag_Paras.c", DataType="uint16")  % Igbt温度采样故障触发计次阈值
C_Fault_TigbtOverConfirmCnt_u16 = myPackage.Parameter(0, DoubleProperty=0, Int32Property=int32(0), LogicalProperty=false, OnOffCharProperty="off", ColorCharProperty="red", StorageClass="YS_SelectRAMPara", HeaderFile="MCU_FaultDiag_Paras.h", DefinitionFile="MCU_FaultDiag_Paras.c", DataType="uint16")  % Igbt温度采样故障触发计次阈值
C_Fault_TigbtOverFaultCoeff_f32 = myPackage.Parameter(0, DoubleProperty=0, Int32Property=int32(0), LogicalProperty=false, OnOffCharProperty="off", ColorCharProperty="red", StorageClass="YS_SelectRAMPara", HeaderFile="MCU_FaultDiag_Paras.h", DefinitionFile="MCU_FaultDiag_Paras.c", DataType="single")
C_Fault_TigbtOverFaultDiagEn_u8 = myPackage.Parameter(0, DoubleProperty=0, Int32Property=int32(0), LogicalProperty=false, OnOffCharProperty="off", ColorCharProperty="red", StorageClass="YS_SelectRAMPara", HeaderFile="MCU_FaultDiag_Paras.h", DefinitionFile="MCU_FaultDiag_Paras.c", DataType="uint8")
C_Fault_TigbtOverFaultErrCode_u16 = myPackage.Parameter(1, DoubleProperty=0, Int32Property=int32(0), LogicalProperty=false, OnOffCharProperty="off", ColorCharProperty="red", StorageClass="YS_SelectRAMPara", HeaderFile="MCU_FaultDiag_Paras.h", DefinitionFile="MCU_FaultDiag_Paras.c", DataType="uint16")
C_Fault_TigbtOverFaultLevel_u8 = myPackage.Parameter(0, DoubleProperty=0, Int32Property=int32(0), LogicalProperty=false, OnOffCharProperty="off", ColorCharProperty="red", StorageClass="YS_SelectRAMPara", HeaderFile="MCU_FaultDiag_Paras.h", DefinitionFile="MCU_FaultDiag_Paras.c", DataType="uint8")
C_Fault_TigbtWarnConfirmCnt_u16 = myPackage.Parameter(0, DoubleProperty=0, Int32Property=int32(0), LogicalProperty=false, OnOffCharProperty="off", ColorCharProperty="red", StorageClass="YS_SelectRAMPara", HeaderFile="MCU_FaultDiag_Paras.h", DefinitionFile="MCU_FaultDiag_Paras.c", DataType="uint16")  % Igbt温度采样故障触发计次阈值
C_Fault_TigbtWarnFaultCoeff_f32 = myPackage.Parameter(0, DoubleProperty=0, Int32Property=int32(0), LogicalProperty=false, OnOffCharProperty="off", ColorCharProperty="red", StorageClass="YS_SelectRAMPara", HeaderFile="MCU_FaultDiag_Paras.h", DefinitionFile="MCU_FaultDiag_Paras.c", DataType="single")
C_Fault_TigbtWarnFaultDiagEn_u8 = myPackage.Parameter(0, DoubleProperty=0, Int32Property=int32(0), LogicalProperty=false, OnOffCharProperty="off", ColorCharProperty="red", StorageClass="YS_SelectRAMPara", HeaderFile="MCU_FaultDiag_Paras.h", DefinitionFile="MCU_FaultDiag_Paras.c", DataType="uint8")
C_Fault_TigbtWarnFaultErrCode_u16 = myPackage.Parameter(1, DoubleProperty=0, Int32Property=int32(0), LogicalProperty=false, OnOffCharProperty="off", ColorCharProperty="red", StorageClass="YS_SelectRAMPara", HeaderFile="MCU_FaultDiag_Paras.h", DefinitionFile="MCU_FaultDiag_Paras.c", DataType="uint16")
C_Fault_TigbtWarnFaultLevel_u8 = myPackage.Parameter(0, DoubleProperty=0, Int32Property=int32(0), LogicalProperty=false, OnOffCharProperty="off", ColorCharProperty="red", StorageClass="YS_SelectRAMPara", HeaderFile="MCU_FaultDiag_Paras.h", DefinitionFile="MCU_FaultDiag_Paras.c", DataType="uint8")
C_Fault_TmotorOverFaultCoeff_f32 = myPackage.Parameter(0, DoubleProperty=0, Int32Property=int32(0), LogicalProperty=false, OnOffCharProperty="off", ColorCharProperty="red", StorageClass="YS_SelectRAMPara", HeaderFile="MCU_FaultDiag_Paras.h", DefinitionFile="MCU_FaultDiag_Paras.c", DataType="single")
C_Fault_TmotorOverFaultDiagEn_u8 = myPackage.Parameter(0, DoubleProperty=0, Int32Property=int32(0), LogicalProperty=false, OnOffCharProperty="off", ColorCharProperty="red", StorageClass="YS_SelectRAMPara", HeaderFile="MCU_FaultDiag_Paras.h", DefinitionFile="MCU_FaultDiag_Paras.c", DataType="uint8")
C_Fault_TmotorOverFaultErrCode_u16 = myPackage.Parameter(1, DoubleProperty=0, Int32Property=int32(0), LogicalProperty=false, OnOffCharProperty="off", ColorCharProperty="red", StorageClass="YS_SelectRAMPara", HeaderFile="MCU_FaultDiag_Paras.h", DefinitionFile="MCU_FaultDiag_Paras.c", DataType="uint16")
C_Fault_TmotorOverFaultLevel_u8 = myPackage.Parameter(0, DoubleProperty=0, Int32Property=int32(0), LogicalProperty=false, OnOffCharProperty="off", ColorCharProperty="red", StorageClass="YS_SelectRAMPara", HeaderFile="MCU_FaultDiag_Paras.h", DefinitionFile="MCU_FaultDiag_Paras.c", DataType="uint8")
C_Fault_TmotorWarnFaultCoeff_f32 = myPackage.Parameter(0, DoubleProperty=0, Int32Property=int32(0), LogicalProperty=false, OnOffCharProperty="off", ColorCharProperty="red", StorageClass="YS_SelectRAMPara", HeaderFile="MCU_FaultDiag_Paras.h", DefinitionFile="MCU_FaultDiag_Paras.c", DataType="single")
C_Fault_TmotorWarnFaultDiagEn_u8 = myPackage.Parameter(0, DoubleProperty=0, Int32Property=int32(0), LogicalProperty=false, OnOffCharProperty="off", ColorCharProperty="red", StorageClass="YS_SelectRAMPara", HeaderFile="MCU_FaultDiag_Paras.h", DefinitionFile="MCU_FaultDiag_Paras.c", DataType="uint8")
C_Fault_TmotorWarnFaultErrCode_u16 = myPackage.Parameter(1, DoubleProperty=0, Int32Property=int32(0), LogicalProperty=false, OnOffCharProperty="off", ColorCharProperty="red", StorageClass="YS_SelectRAMPara", HeaderFile="MCU_FaultDiag_Paras.h", DefinitionFile="MCU_FaultDiag_Paras.c", DataType="uint16")
C_Fault_TmotorWarnFaultLevel_u8 = myPackage.Parameter(0, DoubleProperty=0, Int32Property=int32(0), LogicalProperty=false, OnOffCharProperty="off", ColorCharProperty="red", StorageClass="YS_SelectRAMPara", HeaderFile="MCU_FaultDiag_Paras.h", DefinitionFile="MCU_FaultDiag_Paras.c", DataType="uint8")
C_Fault_UdcOverConfirmCnt_u16 = myPackage.Parameter(0, DoubleProperty=0, Int32Property=int32(0), LogicalProperty=false, OnOffCharProperty="off", ColorCharProperty="red", StorageClass="YS_SelectRAMPara", HeaderFile="MCU_FaultDiag_Paras.h", DefinitionFile="MCU_FaultDiag_Paras.c", DataType="uint16")  % Igbt温度采样故障触发计次阈值
C_Fault_UdcOverFaultCoeff_f32 = myPackage.Parameter(0, DoubleProperty=0, Int32Property=int32(0), LogicalProperty=false, OnOffCharProperty="off", ColorCharProperty="red", StorageClass="YS_SelectRAMPara", HeaderFile="MCU_FaultDiag_Paras.h", DefinitionFile="MCU_FaultDiag_Paras.c", DataType="single")
C_Fault_UdcOverFaultDiagEn_u8 = myPackage.Parameter(0, DoubleProperty=0, Int32Property=int32(0), LogicalProperty=false, OnOffCharProperty="off", ColorCharProperty="red", StorageClass="YS_SelectRAMPara", HeaderFile="MCU_FaultDiag_Paras.h", DefinitionFile="MCU_FaultDiag_Paras.c", DataType="uint8")
C_Fault_UdcOverFaultErrCode_u16 = myPackage.Parameter(1, DoubleProperty=0, Int32Property=int32(0), LogicalProperty=false, OnOffCharProperty="off", ColorCharProperty="red", StorageClass="YS_SelectRAMPara", HeaderFile="MCU_FaultDiag_Paras.h", DefinitionFile="MCU_FaultDiag_Paras.c", DataType="uint16")
C_Fault_UdcOverFaultLevel_u8 = myPackage.Parameter(0, DoubleProperty=0, Int32Property=int32(0), LogicalProperty=false, OnOffCharProperty="off", ColorCharProperty="red", StorageClass="YS_SelectRAMPara", HeaderFile="MCU_FaultDiag_Paras.h", DefinitionFile="MCU_FaultDiag_Paras.c", DataType="uint8")
C_Fault_UdcUnderConfirmCnt_u16 = myPackage.Parameter(0, DoubleProperty=0, Int32Property=int32(0), LogicalProperty=false, OnOffCharProperty="off", ColorCharProperty="red", StorageClass="YS_SelectRAMPara", HeaderFile="MCU_FaultDiag_Paras.h", DefinitionFile="MCU_FaultDiag_Paras.c", DataType="uint16")  % Igbt温度采样故障触发计次阈值
C_Fault_UdcUnderFaultCoeff_f32 = myPackage.Parameter(0, DoubleProperty=0, Int32Property=int32(0), LogicalProperty=false, OnOffCharProperty="off", ColorCharProperty="red", StorageClass="YS_SelectRAMPara", HeaderFile="MCU_FaultDiag_Paras.h", DefinitionFile="MCU_FaultDiag_Paras.c", DataType="single")
C_Fault_UdcUnderFaultDiagEn_u8 = myPackage.Parameter(0, DoubleProperty=0, Int32Property=int32(0), LogicalProperty=false, OnOffCharProperty="off", ColorCharProperty="red", StorageClass="YS_SelectRAMPara", HeaderFile="MCU_FaultDiag_Paras.h", DefinitionFile="MCU_FaultDiag_Paras.c", DataType="uint8")
C_Fault_UdcUnderFaultErrCode_u16 = myPackage.Parameter(1, DoubleProperty=0, Int32Property=int32(0), LogicalProperty=false, OnOffCharProperty="off", ColorCharProperty="red", StorageClass="YS_SelectRAMPara", HeaderFile="MCU_FaultDiag_Paras.h", DefinitionFile="MCU_FaultDiag_Paras.c", DataType="uint16")
C_Fault_UdcUnderFaultLevel_u8 = myPackage.Parameter(0, DoubleProperty=0, Int32Property=int32(0), LogicalProperty=false, OnOffCharProperty="off", ColorCharProperty="red", StorageClass="YS_SelectRAMPara", HeaderFile="MCU_FaultDiag_Paras.h", DefinitionFile="MCU_FaultDiag_Paras.c", DataType="uint8")
C_Fault_TigbtOverWarnConfirmCnt_u16 = myPackage.Parameter(0, DoubleProperty=0, Int32Property=int32(0), LogicalProperty=false, OnOffCharProperty="off", ColorCharProperty="red", StorageClass="YS_SelectRAMPara", HeaderFile="MCU_FaultDiag_Paras.h", DefinitionFile="MCU_FaultDiag_Paras.c", DataType="uint16")  % Igbt温度采样故障触发计次阈值
C_Fault_TigbtOverWarnFaultCoeff_f32 = myPackage.Parameter(0, DoubleProperty=0, Int32Property=int32(0), LogicalProperty=false, OnOffCharProperty="off", ColorCharProperty="red", StorageClass="YS_SelectRAMPara", HeaderFile="MCU_FaultDiag_Paras.h", DefinitionFile="MCU_FaultDiag_Paras.c", DataType="single")
C_Fault_TigbtOverWarnFaultDiagEn_u8 = myPackage.Parameter(0, DoubleProperty=0, Int32Property=int32(0), LogicalProperty=false, OnOffCharProperty="off", ColorCharProperty="red", StorageClass="YS_SelectRAMPara", HeaderFile="MCU_FaultDiag_Paras.h", DefinitionFile="MCU_FaultDiag_Paras.c", DataType="uint8")
C_Fault_TigbtOverWarnFaultErrCode_u16 = myPackage.Parameter(1, DoubleProperty=0, Int32Property=int32(0), LogicalProperty=false, OnOffCharProperty="off", ColorCharProperty="red", StorageClass="YS_SelectRAMPara", HeaderFile="MCU_FaultDiag_Paras.h", DefinitionFile="MCU_FaultDiag_Paras.c", DataType="uint16")
C_Fault_TigbtOverWarnFaultLevel_u8 = myPackage.Parameter(0, DoubleProperty=0, Int32Property=int32(0), LogicalProperty=false, OnOffCharProperty="off", ColorCharProperty="red", StorageClass="YS_SelectRAMPara", HeaderFile="MCU_FaultDiag_Paras.h", DefinitionFile="MCU_FaultDiag_Paras.c", DataType="uint8")
C_Fault_TmotorOverConfirmCnt_u16 = myPackage.Parameter(0, DoubleProperty=0, Int32Property=int32(0), LogicalProperty=false, OnOffCharProperty="off", ColorCharProperty="red", StorageClass="YS_SelectRAMPara", HeaderFile="MCU_FaultDiag_Paras.h", DefinitionFile="MCU_FaultDiag_Paras.c", DataType="uint16")  % Igbt温度采样故障触发计次阈值
C_Fault_TmotorOverWarnConfirmCnt_u16 = myPackage.Parameter(0, DoubleProperty=0, Int32Property=int32(0), LogicalProperty=false, OnOffCharProperty="off", ColorCharProperty="red", StorageClass="YS_SelectRAMPara", HeaderFile="MCU_FaultDiag_Paras.h", DefinitionFile="MCU_FaultDiag_Paras.c", DataType="uint16")  % Igbt温度采样故障触发计次阈值
C_Fault_TmotorOverWarnFaultCoeff_f32 = myPackage.Parameter(0, DoubleProperty=0, Int32Property=int32(0), LogicalProperty=false, OnOffCharProperty="off", ColorCharProperty="red", StorageClass="YS_SelectRAMPara", HeaderFile="MCU_FaultDiag_Paras.h", DefinitionFile="MCU_FaultDiag_Paras.c", DataType="single")
C_Fault_TmotorOverWarnFaultDiagEn_u8 = myPackage.Parameter(0, DoubleProperty=0, Int32Property=int32(0), LogicalProperty=false, OnOffCharProperty="off", ColorCharProperty="red", StorageClass="YS_SelectRAMPara", HeaderFile="MCU_FaultDiag_Paras.h", DefinitionFile="MCU_FaultDiag_Paras.c", DataType="uint8")
C_Fault_TmotorOverWarnFaultErrCode_u16 = myPackage.Parameter(1, DoubleProperty=0, Int32Property=int32(0), LogicalProperty=false, OnOffCharProperty="off", ColorCharProperty="red", StorageClass="YS_SelectRAMPara", HeaderFile="MCU_FaultDiag_Paras.h", DefinitionFile="MCU_FaultDiag_Paras.c", DataType="uint16")
C_Fault_TmotorOverWarnFaultLevel_u8 = myPackage.Parameter(0, DoubleProperty=0, Int32Property=int32(0), LogicalProperty=false, OnOffCharProperty="off", ColorCharProperty="red", StorageClass="YS_SelectRAMPara", HeaderFile="MCU_FaultDiag_Paras.h", DefinitionFile="MCU_FaultDiag_Paras.c", DataType="uint8")
C_Fault_UdcUnderWarnConfirmCnt_u16 = myPackage.Parameter(0, DoubleProperty=0, Int32Property=int32(0), LogicalProperty=false, OnOffCharProperty="off", ColorCharProperty="red", StorageClass="YS_SelectRAMPara", HeaderFile="MCU_FaultDiag_Paras.h", DefinitionFile="MCU_FaultDiag_Paras.c", DataType="uint16")  % Igbt温度采样故障触发计次阈值
C_Fault_UdcUnderWarnFaultCoeff_f32 = myPackage.Parameter(0, DoubleProperty=0, Int32Property=int32(0), LogicalProperty=false, OnOffCharProperty="off", ColorCharProperty="red", StorageClass="YS_SelectRAMPara", HeaderFile="MCU_FaultDiag_Paras.h", DefinitionFile="MCU_FaultDiag_Paras.c", DataType="single")
C_Fault_UdcUnderWarnFaultDiagEn_u8 = myPackage.Parameter(0, DoubleProperty=0, Int32Property=int32(0), LogicalProperty=false, OnOffCharProperty="off", ColorCharProperty="red", StorageClass="YS_SelectRAMPara", HeaderFile="MCU_FaultDiag_Paras.h", DefinitionFile="MCU_FaultDiag_Paras.c", DataType="uint8")
C_Fault_UdcUnderWarnFaultErrCode_u16 = myPackage.Parameter(1, DoubleProperty=0, Int32Property=int32(0), LogicalProperty=false, OnOffCharProperty="off", ColorCharProperty="red", StorageClass="YS_SelectRAMPara", HeaderFile="MCU_FaultDiag_Paras.h", DefinitionFile="MCU_FaultDiag_Paras.c", DataType="uint16")
C_Fault_UdcUnderWarnFaultLevel_u8 = myPackage.Parameter(0, DoubleProperty=0, Int32Property=int32(0), LogicalProperty=false, OnOffCharProperty="off", ColorCharProperty="red", StorageClass="YS_SelectRAMPara", HeaderFile="MCU_FaultDiag_Paras.h", DefinitionFile="MCU_FaultDiag_Paras.c", DataType="uint8")
C_Fault_UdcOverWarnConfirmCnt_u16 = myPackage.Parameter(0, DoubleProperty=0, Int32Property=int32(0), LogicalProperty=false, OnOffCharProperty="off", ColorCharProperty="red", StorageClass="YS_SelectRAMPara", HeaderFile="MCU_FaultDiag_Paras.h", DefinitionFile="MCU_FaultDiag_Paras.c", DataType="uint16")  % Igbt温度采样故障触发计次阈值
C_Fault_UdcOverWarnFaultCoeff_f32 = myPackage.Parameter(0, DoubleProperty=0, Int32Property=int32(0), LogicalProperty=false, OnOffCharProperty="off", ColorCharProperty="red", StorageClass="YS_SelectRAMPara", HeaderFile="MCU_FaultDiag_Paras.h", DefinitionFile="MCU_FaultDiag_Paras.c", DataType="single")
C_Fault_UdcOverWarnFaultDiagEn_u8 = myPackage.Parameter(0, DoubleProperty=0, Int32Property=int32(0), LogicalProperty=false, OnOffCharProperty="off", ColorCharProperty="red", StorageClass="YS_SelectRAMPara", HeaderFile="MCU_FaultDiag_Paras.h", DefinitionFile="MCU_FaultDiag_Paras.c", DataType="uint8")
C_Fault_UdcOverWarnFaultErrCode_u16 = myPackage.Parameter(1, DoubleProperty=0, Int32Property=int32(0), LogicalProperty=false, OnOffCharProperty="off", ColorCharProperty="red", StorageClass="YS_SelectRAMPara", HeaderFile="MCU_FaultDiag_Paras.h", DefinitionFile="MCU_FaultDiag_Paras.c", DataType="uint16")
C_Fault_UdcOverWarnFaultLevel_u8 = myPackage.Parameter(0, DoubleProperty=0, Int32Property=int32(0), LogicalProperty=false, OnOffCharProperty="off", ColorCharProperty="red", StorageClass="YS_SelectRAMPara", HeaderFile="MCU_FaultDiag_Paras.h", DefinitionFile="MCU_FaultDiag_Paras.c", DataType="uint8")
C_Fault_SpeedOverWarnConfirmCnt_u16 = myPackage.Parameter(0, DoubleProperty=0, Int32Property=int32(0), LogicalProperty=false, OnOffCharProperty="off", ColorCharProperty="red", StorageClass="YS_SelectRAMPara", HeaderFile="MCU_FaultDiag_Paras.h", DefinitionFile="MCU_FaultDiag_Paras.c", DataType="uint16")  % Igbt温度采样故障触发计次阈值
C_Fault_SpeedOverWarnFaultCoeff_f32 = myPackage.Parameter(0, DoubleProperty=0, Int32Property=int32(0), LogicalProperty=false, OnOffCharProperty="off", ColorCharProperty="red", StorageClass="YS_SelectRAMPara", HeaderFile="MCU_FaultDiag_Paras.h", DefinitionFile="MCU_FaultDiag_Paras.c", DataType="single")
C_Fault_SpeedOverWarnFaultDiagEn_u8 = myPackage.Parameter(0, DoubleProperty=0, Int32Property=int32(0), LogicalProperty=false, OnOffCharProperty="off", ColorCharProperty="red", StorageClass="YS_SelectRAMPara", HeaderFile="MCU_FaultDiag_Paras.h", DefinitionFile="MCU_FaultDiag_Paras.c", DataType="uint8")
C_Fault_SpeedOverWarnFaultErrCode_u16 = myPackage.Parameter(1, DoubleProperty=0, Int32Property=int32(0), LogicalProperty=false, OnOffCharProperty="off", ColorCharProperty="red", StorageClass="YS_SelectRAMPara", HeaderFile="MCU_FaultDiag_Paras.h", DefinitionFile="MCU_FaultDiag_Paras.c", DataType="uint16")
C_Fault_SpeedOverWarnFaultLevel_u8 = myPackage.Parameter(0, DoubleProperty=0, Int32Property=int32(0), LogicalProperty=false, OnOffCharProperty="off", ColorCharProperty="red", StorageClass="YS_SelectRAMPara", HeaderFile="MCU_FaultDiag_Paras.h", DefinitionFile="MCU_FaultDiag_Paras.c", DataType="uint8")
C_Fault_SpeedOverConfirmCnt_u16 = myPackage.Parameter(0, DoubleProperty=0, Int32Property=int32(0), LogicalProperty=false, OnOffCharProperty="off", ColorCharProperty="red", StorageClass="YS_SelectRAMPara", HeaderFile="MCU_FaultDiag_Paras.h", DefinitionFile="MCU_FaultDiag_Paras.c", DataType="uint16")  % Igbt温度采样故障触发计次阈值
C_Fault_SpeedOverFaultCoeff_f32 = myPackage.Parameter(0, DoubleProperty=0, Int32Property=int32(0), LogicalProperty=false, OnOffCharProperty="off", ColorCharProperty="red", StorageClass="YS_SelectRAMPara", HeaderFile="MCU_FaultDiag_Paras.h", DefinitionFile="MCU_FaultDiag_Paras.c", DataType="single")
C_Fault_SpeedOverFaultDiagEn_u8 = myPackage.Parameter(0, DoubleProperty=0, Int32Property=int32(0), LogicalProperty=false, OnOffCharProperty="off", ColorCharProperty="red", StorageClass="YS_SelectRAMPara", HeaderFile="MCU_FaultDiag_Paras.h", DefinitionFile="MCU_FaultDiag_Paras.c", DataType="uint8")
C_Fault_SpeedOverFaultErrCode_u16 = myPackage.Parameter(1, DoubleProperty=0, Int32Property=int32(0), LogicalProperty=false, OnOffCharProperty="off", ColorCharProperty="red", StorageClass="YS_SelectRAMPara", HeaderFile="MCU_FaultDiag_Paras.h", DefinitionFile="MCU_FaultDiag_Paras.c", DataType="uint16")
C_Fault_SpeedOverFaultLevel_u8 = myPackage.Parameter(0, DoubleProperty=0, Int32Property=int32(0), LogicalProperty=false, OnOffCharProperty="off", ColorCharProperty="red", StorageClass="YS_SelectRAMPara", HeaderFile="MCU_FaultDiag_Paras.h", DefinitionFile="MCU_FaultDiag_Paras.c", DataType="uint8")
C_Fault_IaOverLoadConfirmCnt_u16 = myPackage.Parameter(0, DoubleProperty=0, Int32Property=int32(0), LogicalProperty=false, OnOffCharProperty="off", ColorCharProperty="red", StorageClass="YS_SelectRAMPara", HeaderFile="MCU_FaultDiag_Paras.h", DefinitionFile="MCU_FaultDiag_Paras.c", DataType="uint16")  % Igbt温度采样故障触发计次阈值
C_Fault_IaOverLoadFaultCoeff_f32 = myPackage.Parameter(0, DoubleProperty=0, Int32Property=int32(0), LogicalProperty=false, OnOffCharProperty="off", ColorCharProperty="red", StorageClass="YS_SelectRAMPara", HeaderFile="MCU_FaultDiag_Paras.h", DefinitionFile="MCU_FaultDiag_Paras.c", DataType="single")
C_Fault_IaOverLoadFaultDiagEn_u8 = myPackage.Parameter(0, DoubleProperty=0, Int32Property=int32(0), LogicalProperty=false, OnOffCharProperty="off", ColorCharProperty="red", StorageClass="YS_SelectRAMPara", HeaderFile="MCU_FaultDiag_Paras.h", DefinitionFile="MCU_FaultDiag_Paras.c", DataType="uint8")
C_Fault_IaOverLoadFaultErrCode_u16 = myPackage.Parameter(1, DoubleProperty=0, Int32Property=int32(0), LogicalProperty=false, OnOffCharProperty="off", ColorCharProperty="red", StorageClass="YS_SelectRAMPara", HeaderFile="MCU_FaultDiag_Paras.h", DefinitionFile="MCU_FaultDiag_Paras.c", DataType="uint16")
C_Fault_IaOverLoadFaultLevel_u8 = myPackage.Parameter(0, DoubleProperty=0, Int32Property=int32(0), LogicalProperty=false, OnOffCharProperty="off", ColorCharProperty="red", StorageClass="YS_SelectRAMPara", HeaderFile="MCU_FaultDiag_Paras.h", DefinitionFile="MCU_FaultDiag_Paras.c", DataType="uint8")
C_Fault_IbOverLoadConfirmCnt_u16 = myPackage.Parameter(0, DoubleProperty=0, Int32Property=int32(0), LogicalProperty=false, OnOffCharProperty="off", ColorCharProperty="red", StorageClass="YS_SelectRAMPara", HeaderFile="MCU_FaultDiag_Paras.h", DefinitionFile="MCU_FaultDiag_Paras.c", DataType="uint16")  % Igbt温度采样故障触发计次阈值
C_Fault_IbOverLoadFaultCoeff_f32 = myPackage.Parameter(0, DoubleProperty=0, Int32Property=int32(0), LogicalProperty=false, OnOffCharProperty="off", ColorCharProperty="red", StorageClass="YS_SelectRAMPara", HeaderFile="MCU_FaultDiag_Paras.h", DefinitionFile="MCU_FaultDiag_Paras.c", DataType="single")
C_Fault_IbOverLoadFaultDiagEn_u8 = myPackage.Parameter(0, DoubleProperty=0, Int32Property=int32(0), LogicalProperty=false, OnOffCharProperty="off", ColorCharProperty="red", StorageClass="YS_SelectRAMPara", HeaderFile="MCU_FaultDiag_Paras.h", DefinitionFile="MCU_FaultDiag_Paras.c", DataType="uint8")
C_Fault_IbOverLoadFaultErrCode_u16 = myPackage.Parameter(1, DoubleProperty=0, Int32Property=int32(0), LogicalProperty=false, OnOffCharProperty="off", ColorCharProperty="red", StorageClass="YS_SelectRAMPara", HeaderFile="MCU_FaultDiag_Paras.h", DefinitionFile="MCU_FaultDiag_Paras.c", DataType="uint16")
C_Fault_IbOverLoadFaultLevel_u8 = myPackage.Parameter(0, DoubleProperty=0, Int32Property=int32(0), LogicalProperty=false, OnOffCharProperty="off", ColorCharProperty="red", StorageClass="YS_SelectRAMPara", HeaderFile="MCU_FaultDiag_Paras.h", DefinitionFile="MCU_FaultDiag_Paras.c", DataType="uint8")
C_Fault_IcOverLoadConfirmCnt_u16 = myPackage.Parameter(0, DoubleProperty=0, Int32Property=int32(0), LogicalProperty=false, OnOffCharProperty="off", ColorCharProperty="red", StorageClass="YS_SelectRAMPara", HeaderFile="MCU_FaultDiag_Paras.h", DefinitionFile="MCU_FaultDiag_Paras.c", DataType="uint16")  % Igbt温度采样故障触发计次阈值
C_Fault_IcOverLoadFaultCoeff_f32 = myPackage.Parameter(0, DoubleProperty=0, Int32Property=int32(0), LogicalProperty=false, OnOffCharProperty="off", ColorCharProperty="red", StorageClass="YS_SelectRAMPara", HeaderFile="MCU_FaultDiag_Paras.h", DefinitionFile="MCU_FaultDiag_Paras.c", DataType="single")
C_Fault_IcOverLoadFaultDiagEn_u8 = myPackage.Parameter(0, DoubleProperty=0, Int32Property=int32(0), LogicalProperty=false, OnOffCharProperty="off", ColorCharProperty="red", StorageClass="YS_SelectRAMPara", HeaderFile="MCU_FaultDiag_Paras.h", DefinitionFile="MCU_FaultDiag_Paras.c", DataType="uint8")
C_Fault_IcOverLoadFaultErrCode_u16 = myPackage.Parameter(1, DoubleProperty=0, Int32Property=int32(0), LogicalProperty=false, OnOffCharProperty="off", ColorCharProperty="red", StorageClass="YS_SelectRAMPara", HeaderFile="MCU_FaultDiag_Paras.h", DefinitionFile="MCU_FaultDiag_Paras.c", DataType="uint16")
C_Fault_IcOverLoadFaultLevel_u8 = myPackage.Parameter(0, DoubleProperty=0, Int32Property=int32(0), LogicalProperty=false, OnOffCharProperty="off", ColorCharProperty="red", StorageClass="YS_SelectRAMPara", HeaderFile="MCU_FaultDiag_Paras.h", DefinitionFile="MCU_FaultDiag_Paras.c", DataType="uint8")
C_Fault_TZFaultCoeff_f32 = myPackage.Parameter(0, DoubleProperty=0, Int32Property=int32(0), LogicalProperty=false, OnOffCharProperty="off", ColorCharProperty="red", StorageClass="YS_SelectRAMPara", HeaderFile="MCU_FaultDiag_Paras.h", DefinitionFile="MCU_FaultDiag_Paras.c", DataType="single")
C_Fault_TZFaultDiagEn_u8 = myPackage.Parameter(0, DoubleProperty=0, Int32Property=int32(0), LogicalProperty=false, OnOffCharProperty="off", ColorCharProperty="red", StorageClass="YS_SelectRAMPara", HeaderFile="MCU_FaultDiag_Paras.h", DefinitionFile="MCU_FaultDiag_Paras.c", DataType="uint8")
C_Fault_TZFaultErrCode_u16 = myPackage.Parameter(1, DoubleProperty=0, Int32Property=int32(0), LogicalProperty=false, OnOffCharProperty="off", ColorCharProperty="red", StorageClass="YS_SelectRAMPara", HeaderFile="MCU_FaultDiag_Paras.h", DefinitionFile="MCU_FaultDiag_Paras.c", DataType="uint16")
C_Fault_TZFaultLevel_u8 = myPackage.Parameter(0, DoubleProperty=0, Int32Property=int32(0), LogicalProperty=false, OnOffCharProperty="off", ColorCharProperty="red", StorageClass="YS_SelectRAMPara", HeaderFile="MCU_FaultDiag_Paras.h", DefinitionFile="MCU_FaultDiag_Paras.c", DataType="uint8")
C_Fault_SelfCheckFaultCoeff_f32 = myPackage.Parameter(0, DoubleProperty=0, Int32Property=int32(0), LogicalProperty=false, OnOffCharProperty="off", ColorCharProperty="red", StorageClass="YS_SelectRAMPara", HeaderFile="MCU_FaultDiag_Paras.h", DefinitionFile="MCU_FaultDiag_Paras.c", DataType="single")
C_Fault_SelfCheckFaultDiagEn_u8 = myPackage.Parameter(0, DoubleProperty=0, Int32Property=int32(0), LogicalProperty=false, OnOffCharProperty="off", ColorCharProperty="red", StorageClass="YS_SelectRAMPara", HeaderFile="MCU_FaultDiag_Paras.h", DefinitionFile="MCU_FaultDiag_Paras.c", DataType="uint8")
C_Fault_SelfCheckFaultErrCode_u16 = myPackage.Parameter(1, DoubleProperty=0, Int32Property=int32(0), LogicalProperty=false, OnOffCharProperty="off", ColorCharProperty="red", StorageClass="YS_SelectRAMPara", HeaderFile="MCU_FaultDiag_Paras.h", DefinitionFile="MCU_FaultDiag_Paras.c", DataType="uint16")
C_Fault_SelfCheckFaultLevel_u8 = myPackage.Parameter(0, DoubleProperty=0, Int32Property=int32(0), LogicalProperty=false, OnOffCharProperty="off", ColorCharProperty="red", StorageClass="YS_SelectRAMPara", HeaderFile="MCU_FaultDiag_Paras.h", DefinitionFile="MCU_FaultDiag_Paras.c", DataType="uint8")
C_Fault_CANFaultAnalogCount_u16 = myPackage.Parameter(0, DoubleProperty=0, Int32Property=int32(0), LogicalProperty=false, OnOffCharProperty="off", ColorCharProperty="red", StorageClass="YS_SelectRAMPara", HeaderFile="MCU_FaultDiag_Paras.h", DefinitionFile="MCU_FaultDiag_Paras.c", DataType="uint16")
C_Fault_CANFaultCoeff_f32 = myPackage.Parameter(0, DoubleProperty=0, Int32Property=int32(0), LogicalProperty=false, OnOffCharProperty="off", ColorCharProperty="red", StorageClass="YS_SelectRAMPara", HeaderFile="MCU_FaultDiag_Paras.h", DefinitionFile="MCU_FaultDiag_Paras.c", DataType="single")
C_Fault_CANFaultDiagEn_u8 = myPackage.Parameter(1, DoubleProperty=0, Int32Property=int32(0), LogicalProperty=false, OnOffCharProperty="off", ColorCharProperty="red", StorageClass="YS_SelectRAMPara", HeaderFile="MCU_FaultDiag_Paras.h", DefinitionFile="MCU_FaultDiag_Paras.c", DataType="uint8")
C_Fault_CANFaultErrCode_u16 = myPackage.Parameter(0, DoubleProperty=0, Int32Property=int32(0), LogicalProperty=false, OnOffCharProperty="off", ColorCharProperty="red", StorageClass="YS_SelectRAMPara", HeaderFile="MCU_FaultDiag_Paras.h", DefinitionFile="MCU_FaultDiag_Paras.c", DataType="uint16")
C_Fault_CANFaultLevel_u8 = myPackage.Parameter(0, DoubleProperty=0, Int32Property=int32(0), LogicalProperty=false, OnOffCharProperty="off", ColorCharProperty="red", StorageClass="YS_SelectRAMPara", HeaderFile="MCU_FaultDiag_Paras.h", DefinitionFile="MCU_FaultDiag_Paras.c", DataType="uint8")
C_Fault_CANFaultTestbedCount_u16 = myPackage.Parameter(210, DoubleProperty=0, Int32Property=int32(0), LogicalProperty=false, OnOffCharProperty="off", ColorCharProperty="red", StorageClass="YS_SelectRAMPara", HeaderFile="MCU_FaultDiag_Paras.h", DefinitionFile="MCU_FaultDiag_Paras.c", DataType="uint16")
C_Fault_CANFaultVehicleCount_u16 = myPackage.Parameter(300, DoubleProperty=0, Int32Property=int32(0), LogicalProperty=false, OnOffCharProperty="off", ColorCharProperty="red", StorageClass="YS_SelectRAMPara", HeaderFile="MCU_FaultDiag_Paras.h", DefinitionFile="MCU_FaultDiag_Paras.c", DataType="uint16")