% Simulink data dictionary MCU_Fault_Datadictionary_objects.sldd
% references PublicParameters.sldd
% references MCU_ParamCfg_Sldd_objects.sldd

C_Fault_CntDectiontime_u32 = myPackage.Parameter(60000, DoubleProperty=0, Int32Property=int32(0), LogicalProperty=false, OnOffCharProperty="off", ColorCharProperty="red", StorageClass="YS_SelectRAMPara", HeaderFile="MCU_Fault_Paras.h", DefinitionFile="MCU_Fault_Paras.c", DataType="uint32")
C_Fault_IaLimit_s32 = myPackage.Parameter(600, DoubleProperty=0, Int32Property=int32(0), LogicalProperty=false, OnOffCharProperty="off", ColorCharProperty="red", StorageClass="YS_SelectRAMPara", HeaderFile="MCU_Fault_Paras.h", DefinitionFile="MCU_Fault_Paras.c", DataType="single")  % a相电流故障限值设置
C_Fault_IaSensorFault_u32 = myPackage.Parameter(1, DoubleProperty=0, Int32Property=int32(0), LogicalProperty=false, OnOffCharProperty="off", ColorCharProperty="red", StorageClass="YS_SelectRAMPara", HeaderFile="MCU_Fault_Paras.h", DefinitionFile="MCU_Fault_Paras.c", DataType="uint32")  % a相电流瞬时故障检测使能开关
C_Fault_IbLimit_s32 = myPackage.Parameter(600, DoubleProperty=0, Int32Property=int32(0), LogicalProperty=false, OnOffCharProperty="off", ColorCharProperty="red", StorageClass="YS_SelectRAMPara", HeaderFile="MCU_Fault_Paras.h", DefinitionFile="MCU_Fault_Paras.c", DataType="single")  % b相电流故障限值设置
C_Fault_IbSensorFault_u32 = myPackage.Parameter(1, DoubleProperty=0, Int32Property=int32(0), LogicalProperty=false, OnOffCharProperty="off", ColorCharProperty="red", StorageClass="YS_SelectRAMPara", HeaderFile="MCU_Fault_Paras.h", DefinitionFile="MCU_Fault_Paras.c", DataType="uint32")  % b相电流瞬时故障检测使能开关
C_Fault_IcLimit_s32 = myPackage.Parameter(600, DoubleProperty=0, Int32Property=int32(0), LogicalProperty=false, OnOffCharProperty="off", ColorCharProperty="red", StorageClass="YS_SelectRAMPara", HeaderFile="MCU_Fault_Paras.h", DefinitionFile="MCU_Fault_Paras.c", DataType="single")  % c相电流故障限值设置
C_Fault_IcSensorFault_u32 = myPackage.Parameter(1, DoubleProperty=0, Int32Property=int32(0), LogicalProperty=false, OnOffCharProperty="off", ColorCharProperty="red", StorageClass="YS_SelectRAMPara", HeaderFile="MCU_Fault_Paras.h", DefinitionFile="MCU_Fault_Paras.c", DataType="uint32")  % c相电流瞬时故障检测使能开关
C_Fault_IphaseLimitStart_s32 = myPackage.Parameter(720, DoubleProperty=0, Int32Property=int32(0), LogicalProperty=false, OnOffCharProperty="off", ColorCharProperty="red", StorageClass="YS_SelectRAMPara", HeaderFile="MCU_Fault_Paras.h", DefinitionFile="MCU_Fault_Paras.c", DataType="single")
C_Fault_MotorTempSensor_i16 = myPackage.Parameter(0, DoubleProperty=0, Int32Property=int32(0), LogicalProperty=false, OnOffCharProperty="off", ColorCharProperty="red", StorageClass="YS_SelectRAMPara", HeaderFile="MCU_Fault_Paras.h", DefinitionFile="MCU_Fault_Paras.c", DataType="int16")  % 电机温度传感器选择0：传感器无效；1：PTC100/KTY82
C_Fault_TigbtCircutConfirmCnt_u16 = myPackage.Parameter(100, DoubleProperty=0, Int32Property=int32(0), LogicalProperty=false, OnOffCharProperty="off", ColorCharProperty="red", StorageClass="YS_SelectRAMPara", HeaderFile="MCU_Fault_Paras.h", DefinitionFile="MCU_Fault_Paras.c", DataType="uint16")  % Igbt温度采样故障触发计次阈值
C_Fault_TigbtCircutConfirmTh_u16 = myPackage.Parameter(3800, DoubleProperty=0, Int32Property=int32(0), LogicalProperty=false, OnOffCharProperty="off", ColorCharProperty="red", StorageClass="YS_SelectRAMPara", HeaderFile="MCU_Fault_Paras.h", DefinitionFile="MCU_Fault_Paras.c", DataType="uint16")  % Igbt温度采样故障ADC阈值
C_Fault_TigbtCircutFaultEn_u8 = myPackage.Parameter(0, DoubleProperty=0, Int32Property=int32(0), LogicalProperty=false, OnOffCharProperty="off", ColorCharProperty="red", StorageClass="YS_SelectRAMPara", HeaderFile="MCU_Fault_Paras.h", DefinitionFile="MCU_Fault_Paras.c", DataType="uint8")  % Igbt温度采样故障开关
C_Fault_TmotorCircutConfirmCnt_u16 = myPackage.Parameter(100, DoubleProperty=0, Int32Property=int32(0), LogicalProperty=false, OnOffCharProperty="off", ColorCharProperty="red", StorageClass="YS_SelectRAMPara", HeaderFile="MCU_Fault_Paras.h", DefinitionFile="MCU_Fault_Paras.c", DataType="uint16")  % 电机温度采样故障触发计次阈值
C_Fault_TmotorCircutConfirmTh_u16 = myPackage.Parameter(3800, DoubleProperty=0, Int32Property=int32(0), LogicalProperty=false, OnOffCharProperty="off", ColorCharProperty="red", StorageClass="YS_SelectRAMPara", HeaderFile="MCU_Fault_Paras.h", DefinitionFile="MCU_Fault_Paras.c", DataType="uint16")  % 电机温度采样故障ADC阈值
C_Fault_TmotorCircutFaultEn_u8 = myPackage.Parameter(0, DoubleProperty=0, Int32Property=int32(0), LogicalProperty=false, OnOffCharProperty="off", ColorCharProperty="red", StorageClass="YS_SelectRAMPara", HeaderFile="MCU_Fault_Paras.h", DefinitionFile="MCU_Fault_Paras.c", DataType="uint8")  % 电机温度采样故障开关
C_Fault_TmotorCircutLimitStart_i16 = myPackage.Parameter(140, DoubleProperty=0, Int32Property=int32(0), LogicalProperty=false, OnOffCharProperty="off", ColorCharProperty="red", StorageClass="YS_SelectRAMPara", HeaderFile="MCU_Fault_Paras.h", DefinitionFile="MCU_Fault_Paras.c", DataType="int16")  % 电机降功率起始温度
C_Fault_TmotorCircutLimitStop_i16 = myPackage.Parameter(160, DoubleProperty=0, Int32Property=int32(0), LogicalProperty=false, OnOffCharProperty="off", ColorCharProperty="red", StorageClass="YS_SelectRAMPara", HeaderFile="MCU_Fault_Paras.h", DefinitionFile="MCU_Fault_Paras.c", DataType="int16")  % 电机降功率终止温度
C_Fault_TmotorLimitStart_i16 = myPackage.Parameter(140, DoubleProperty=0, Int32Property=int32(0), LogicalProperty=false, OnOffCharProperty="off", ColorCharProperty="red", StorageClass="YS_SelectRAMPara", HeaderFile="MCU_Fault_Paras.h", DefinitionFile="MCU_Fault_Paras.c", DataType="int16")
C_Fault_TmotorLimitStop_i16 = myPackage.Parameter(160, DoubleProperty=0, Int32Property=int32(0), LogicalProperty=false, OnOffCharProperty="off", ColorCharProperty="red", StorageClass="YS_SelectRAMPara", HeaderFile="MCU_Fault_Paras.h", DefinitionFile="MCU_Fault_Paras.c", DataType="int16")
M_Fault_CommandSource_i16 = myPackage.Signal(DoubleProperty=0, Int32Property=int32(0), LogicalProperty=false, OnOffCharProperty="off", ColorCharProperty="red", StorageClass="YS_SelectRAMSignal", HeaderFile="MCU_Fault_Signals.h", DefinitionFile="MCU_Fault_Signals.c", DataType="int16")
M_Fault_IaSensorFault_u32 = myPackage.Signal(DoubleProperty=0, Int32Property=int32(0), LogicalProperty=false, OnOffCharProperty="off", ColorCharProperty="red", StorageClass="YS_SelectRAMSignal", HeaderFile="MCU_Fault_Signals.h", DefinitionFile="MCU_Fault_Signals.c", DataType="uint32")
M_Fault_IbSensorFault_u32 = myPackage.Signal(DoubleProperty=0, Int32Property=int32(0), LogicalProperty=false, OnOffCharProperty="off", ColorCharProperty="red", StorageClass="YS_SelectRAMSignal", HeaderFile="MCU_Fault_Signals.h", DefinitionFile="MCU_Fault_Signals.c", DataType="uint32")
M_Fault_IcSensorFault_u32 = myPackage.Signal(DoubleProperty=0, Int32Property=int32(0), LogicalProperty=false, OnOffCharProperty="off", ColorCharProperty="red", StorageClass="YS_SelectRAMSignal", HeaderFile="MCU_Fault_Signals.h", DefinitionFile="MCU_Fault_Signals.c", DataType="uint32")
M_Fault_IgbtEnCmd_u16 = myPackage.Signal(DoubleProperty=0, Int32Property=int32(0), LogicalProperty=false, OnOffCharProperty="off", ColorCharProperty="red", StorageClass="YS_SelectRAMSignal", HeaderFile="MCU_Fault_Signals.h", DefinitionFile="MCU_Fault_Signals.c", DataType="uint16")
M_Fault_PhaseOVIaWarn_u32 = myPackage.Signal(DoubleProperty=0, Int32Property=int32(0), LogicalProperty=false, OnOffCharProperty="off", ColorCharProperty="red", StorageClass="YS_SelectRAMSignal", HeaderFile="MCU_Fault_Signals.h", DefinitionFile="MCU_Fault_Signals.c", DataType="uint32")
M_Fault_PhaseOVIbWarn_u32 = myPackage.Signal(DoubleProperty=0, Int32Property=int32(0), LogicalProperty=false, OnOffCharProperty="off", ColorCharProperty="red", StorageClass="YS_SelectRAMSignal", HeaderFile="MCU_Fault_Signals.h", DefinitionFile="MCU_Fault_Signals.c", DataType="uint32")
M_Fault_PhaseOVIcWarn_u32 = myPackage.Signal(DoubleProperty=0, Int32Property=int32(0), LogicalProperty=false, OnOffCharProperty="off", ColorCharProperty="red", StorageClass="YS_SelectRAMSignal", HeaderFile="MCU_Fault_Signals.h", DefinitionFile="MCU_Fault_Signals.c", DataType="uint32")
M_Fault_PrechargeOverFlg_u16 = myPackage.Signal(DoubleProperty=0, Int32Property=int32(0), LogicalProperty=false, OnOffCharProperty="off", ColorCharProperty="red", StorageClass="YS_SelectRAMSignal", HeaderFile="MCU_Fault_Signals.h", DefinitionFile="MCU_Fault_Signals.c", DataType="uint16")
M_Fault_SpdUpFault_u32 = myPackage.Signal(DoubleProperty=0, Int32Property=int32(0), LogicalProperty=false, OnOffCharProperty="off", ColorCharProperty="red", StorageClass="YS_SelectRAMSignal", HeaderFile="MCU_Fault_Signals.h", DefinitionFile="MCU_Fault_Signals.c", DataType="uint32")
M_Fault_SpdUpWarn_u32 = myPackage.Signal(DoubleProperty=0, Int32Property=int32(0), LogicalProperty=false, OnOffCharProperty="off", ColorCharProperty="red", StorageClass="YS_SelectRAMSignal", HeaderFile="MCU_Fault_Signals.h", DefinitionFile="MCU_Fault_Signals.c", DataType="uint32")
M_Fault_TigbtCircuitFault_u32 = myPackage.Signal(DoubleProperty=0, Int32Property=int32(0), LogicalProperty=false, OnOffCharProperty="off", ColorCharProperty="red", StorageClass="YS_SelectRAMSignal", HeaderFile="MCU_Fault_Signals.h", DefinitionFile="MCU_Fault_Signals.c", DataType="uint32")  % IGBT温度采样电路故障标志
M_Fault_TigbtOverFault_u32 = myPackage.Signal(DoubleProperty=0, Int32Property=int32(0), LogicalProperty=false, OnOffCharProperty="off", ColorCharProperty="red", StorageClass="YS_SelectRAMSignal", HeaderFile="MCU_Fault_Signals.h", DefinitionFile="MCU_Fault_Signals.c", DataType="uint32")  % IGBT过温故障标志
M_Fault_TigbtWarnFault_u32 = myPackage.Signal(DoubleProperty=0, Int32Property=int32(0), LogicalProperty=false, OnOffCharProperty="off", ColorCharProperty="red", StorageClass="YS_SelectRAMSignal", HeaderFile="MCU_Fault_Signals.h", DefinitionFile="MCU_Fault_Signals.c", DataType="uint32")  % IGBT过温警告标志
M_Fault_TmotorCircuitFault_u32 = myPackage.Signal(DoubleProperty=0, Int32Property=int32(0), LogicalProperty=false, OnOffCharProperty="off", ColorCharProperty="red", StorageClass="YS_SelectRAMSignal", HeaderFile="MCU_Fault_Signals.h", DefinitionFile="MCU_Fault_Signals.c", DataType="uint32")  % 电机温度采样电路故障标志
M_Fault_TmotorOverFault_u32 = myPackage.Signal(DoubleProperty=0, Int32Property=int32(0), LogicalProperty=false, OnOffCharProperty="off", ColorCharProperty="red", StorageClass="YS_SelectRAMSignal", HeaderFile="MCU_Fault_Signals.h", DefinitionFile="MCU_Fault_Signals.c", DataType="uint32")  % 电机过温故障标志
M_Fault_TmotorWarnFault_u32 = myPackage.Signal(DoubleProperty=0, Int32Property=int32(0), LogicalProperty=false, OnOffCharProperty="off", ColorCharProperty="red", StorageClass="YS_SelectRAMSignal", HeaderFile="MCU_Fault_Signals.h", DefinitionFile="MCU_Fault_Signals.c", DataType="uint32")  % 电机过温警告标志
M_Fault_TrqCmdFilter_s32 = myPackage.Signal(DoubleProperty=0, Int32Property=int32(0), LogicalProperty=false, OnOffCharProperty="off", ColorCharProperty="red", StorageClass="YS_SelectRAMSignal", HeaderFile="MCU_Fault_Signals.h", DefinitionFile="MCU_Fault_Signals.c", DataType="single")
M_Fault_UdcLowerLimitStart_s32 = myPackage.Signal(DoubleProperty=0, Int32Property=int32(0), LogicalProperty=false, OnOffCharProperty="off", ColorCharProperty="red", StorageClass="YS_SelectRAMSignal", HeaderFile="MCU_Fault_Signals.h", DefinitionFile="MCU_Fault_Signals.c", DataType="single")
M_Fault_UdcLowerLimitStop_s32 = myPackage.Signal(DoubleProperty=0, Int32Property=int32(0), LogicalProperty=false, OnOffCharProperty="off", ColorCharProperty="red", StorageClass="YS_SelectRAMSignal", HeaderFile="MCU_Fault_Signals.h", DefinitionFile="MCU_Fault_Signals.c", DataType="single")
M_Fault_UdcReal_s32 = myPackage.Signal(DoubleProperty=0, Int32Property=int32(0), LogicalProperty=false, OnOffCharProperty="off", ColorCharProperty="red", StorageClass="YS_SelectRAMSignal", HeaderFile="MCU_Fault_Signals.h", DefinitionFile="MCU_Fault_Signals.c", DataType="single")
M_Fault_UdcUpFault_u32 = myPackage.Signal(DoubleProperty=0, Int32Property=int32(0), LogicalProperty=false, OnOffCharProperty="off", ColorCharProperty="red", StorageClass="YS_SelectRAMSignal", HeaderFile="MCU_Fault_Signals.h", DefinitionFile="MCU_Fault_Signals.c", DataType="uint32")
M_Fault_UdcUpLimitStart_s32 = myPackage.Signal(DoubleProperty=0, Int32Property=int32(0), LogicalProperty=false, OnOffCharProperty="off", ColorCharProperty="red", StorageClass="YS_SelectRAMSignal", HeaderFile="MCU_Fault_Signals.h", DefinitionFile="MCU_Fault_Signals.c", DataType="single")
M_Fault_UdcUpLimitStop_s32 = myPackage.Signal(DoubleProperty=0, Int32Property=int32(0), LogicalProperty=false, OnOffCharProperty="off", ColorCharProperty="red", StorageClass="YS_SelectRAMSignal", HeaderFile="MCU_Fault_Signals.h", DefinitionFile="MCU_Fault_Signals.c", DataType="single")
M_Fault_UdcUpWarn_u32 = myPackage.Signal(DoubleProperty=0, Int32Property=int32(0), LogicalProperty=false, OnOffCharProperty="off", ColorCharProperty="red", StorageClass="YS_SelectRAMSignal", HeaderFile="MCU_Fault_Signals.h", DefinitionFile="MCU_Fault_Signals.c", DataType="uint32")
M_Fault_VCUKeyState_u16 = myPackage.Signal(DoubleProperty=0, Int32Property=int32(0), LogicalProperty=false, OnOffCharProperty="off", ColorCharProperty="red", StorageClass="YS_SelectRAMSignal", HeaderFile="MCU_Fault_Signals.h", DefinitionFile="MCU_Fault_Signals.c", DataType="uint16")
M_Fault_VdcUnderFault_u32 = myPackage.Signal(DoubleProperty=0, Int32Property=int32(0), LogicalProperty=false, OnOffCharProperty="off", ColorCharProperty="red", StorageClass="YS_SelectRAMSignal", HeaderFile="MCU_Fault_Signals.h", DefinitionFile="MCU_Fault_Signals.c", DataType="uint32")
M_Fault_VdcUnderWarn_u32 = myPackage.Signal(DoubleProperty=0, Int32Property=int32(0), LogicalProperty=false, OnOffCharProperty="off", ColorCharProperty="red", StorageClass="YS_SelectRAMSignal", HeaderFile="MCU_Fault_Signals.h", DefinitionFile="MCU_Fault_Signals.c", DataType="uint32")
M_Fault_IaValue_s32 = myPackage.Signal(DoubleProperty=0, Int32Property=int32(0), LogicalProperty=false, OnOffCharProperty="off", ColorCharProperty="red", StorageClass="YS_SelectRAMSignal", HeaderFile="MCU_Fault_Signals.h", DefinitionFile="MCU_Fault_Signals.c", DataType="single")
M_Fault_IbValue_s32 = myPackage.Signal(DoubleProperty=0, Int32Property=int32(0), LogicalProperty=false, OnOffCharProperty="off", ColorCharProperty="red", StorageClass="YS_SelectRAMSignal", HeaderFile="MCU_Fault_Signals.h", DefinitionFile="MCU_Fault_Signals.c", DataType="single")
M_Fault_IcValue_s32 = myPackage.Signal(DoubleProperty=0, Int32Property=int32(0), LogicalProperty=false, OnOffCharProperty="off", ColorCharProperty="red", StorageClass="YS_SelectRAMSignal", HeaderFile="MCU_Fault_Signals.h", DefinitionFile="MCU_Fault_Signals.c", DataType="single")
M_Fault_IaInstantFaultNoDeb_u8 = myPackage.Signal(DoubleProperty=0, Int32Property=int32(0), LogicalProperty=false, OnOffCharProperty="off", ColorCharProperty="red", StorageClass="YS_SelectRAMSignal", HeaderFile="MCU_Fault_Signals.h", DefinitionFile="MCU_Fault_Signals.c", DataType="uint8")
M_Fault_IbInstantFaultNoDeb_u8 = myPackage.Signal(DoubleProperty=0, Int32Property=int32(0), LogicalProperty=false, OnOffCharProperty="off", ColorCharProperty="red", StorageClass="YS_SelectRAMSignal", HeaderFile="MCU_Fault_Signals.h", DefinitionFile="MCU_Fault_Signals.c", DataType="uint8")
M_Fault_IcInstantFaultNoDeb_u8 = myPackage.Signal(DoubleProperty=0, Int32Property=int32(0), LogicalProperty=false, OnOffCharProperty="off", ColorCharProperty="red", StorageClass="YS_SelectRAMSignal", HeaderFile="MCU_Fault_Signals.h", DefinitionFile="MCU_Fault_Signals.c", DataType="uint8")
C_Fault_IaConfirmCnt_u16 = myPackage.Parameter(0, DoubleProperty=0, Int32Property=int32(0), LogicalProperty=false, OnOffCharProperty="off", ColorCharProperty="red", StorageClass="YS_SelectRAMPara", HeaderFile="MCU_Fault_Paras.h", DefinitionFile="MCU_Fault_Paras.c", DataType="uint16")  % a相电流故障触发计次阈值
C_Fault_IbConfirmCnt_u16 = myPackage.Parameter(0, DoubleProperty=0, Int32Property=int32(0), LogicalProperty=false, OnOffCharProperty="off", ColorCharProperty="red", StorageClass="YS_SelectRAMPara", HeaderFile="MCU_Fault_Paras.h", DefinitionFile="MCU_Fault_Paras.c", DataType="uint16")  % b相电流故障触发计次阈值
C_Fault_IcConfirmCnt_u16 = myPackage.Parameter(0, DoubleProperty=0, Int32Property=int32(0), LogicalProperty=false, OnOffCharProperty="off", ColorCharProperty="red", StorageClass="YS_SelectRAMPara", HeaderFile="MCU_Fault_Paras.h", DefinitionFile="MCU_Fault_Paras.c", DataType="uint16")  % c相电流故障触发计次阈值
C_SelfCheck_MotorTempTable_i16 = myPackage.Parameter([200; 200; 200; 200; 200; 200; 200; 200; 200; 200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 -40], DoubleProperty=0, Int32Property=int32(0), LogicalProperty=false, OnOffCharProperty="off", ColorCharProperty="red", StorageClass="YS_SelectRAMPara", HeaderFile="MCU_SelfCheck_Paras.h", DefinitionFile="MCU_SelfCheck_Paras.c", DataType="int16")
M_Fault_IbInstantFault_u16 = myPackage.Signal(DoubleProperty=0, Int32Property=int32(0), LogicalProperty=false, OnOffCharProperty="off", ColorCharProperty="red", StorageClass="YS_SelectRAMSignal", HeaderFile="MCU_Fault_Signals.h", DefinitionFile="MCU_Fault_Signals.c", DataType="uint16", InitialValue="0")  % b相电流瞬时故障标志
M_Fault_IcInstantFault_u16 = myPackage.Signal(DoubleProperty=0, Int32Property=int32(0), LogicalProperty=false, OnOffCharProperty="off", ColorCharProperty="red", StorageClass="YS_SelectRAMSignal", HeaderFile="MCU_Fault_Signals.h", DefinitionFile="MCU_Fault_Signals.c", DataType="uint16", InitialValue="0")  % c相电流瞬时故障标志
M_Fault_IaInstantFault_u16 = myPackage.Signal(DoubleProperty=0, Int32Property=int32(0), LogicalProperty=false, OnOffCharProperty="off", ColorCharProperty="red", StorageClass="YS_SelectRAMSignal", HeaderFile="MCU_Fault_Signals.h", DefinitionFile="MCU_Fault_Signals.c", DataType="uint16", InitialValue="0")  % a相电流瞬时故障标志
C_Fault_TigbtLimitStart_i16 = myPackage.Parameter(85, DoubleProperty=0, Int32Property=int32(0), LogicalProperty=false, OnOffCharProperty="off", ColorCharProperty="red", StorageClass="YS_SelectRAMPara", HeaderFile="MCU_Fault_Paras.h", DefinitionFile="MCU_Fault_Paras.c", DataType="int16")  % IGBT降功率起始温度
C_Fault_TigbtLimitStop_i16 = myPackage.Parameter(95, DoubleProperty=0, Int32Property=int32(0), LogicalProperty=false, OnOffCharProperty="off", ColorCharProperty="red", StorageClass="YS_SelectRAMPara", HeaderFile="MCU_Fault_Paras.h", DefinitionFile="MCU_Fault_Paras.c", DataType="int16")  % IGBT降功率终止温度
C_Fault_TigbtOverConfirmCnt_u16 = myPackage.Parameter(0, DoubleProperty=0, Int32Property=int32(0), LogicalProperty=false, OnOffCharProperty="off", ColorCharProperty="red", StorageClass="YS_SelectRAMPara", HeaderFile="MCU_Fault_Paras.h", DefinitionFile="MCU_Fault_Paras.c", DataType="uint16")
C_Fault_TigbtWarnConfirmCnt_u16 = myPackage.Parameter(0, DoubleProperty=0, Int32Property=int32(0), LogicalProperty=false, OnOffCharProperty="off", ColorCharProperty="red", StorageClass="YS_SelectRAMPara", HeaderFile="MCU_Fault_Paras.h", DefinitionFile="MCU_Fault_Paras.c", DataType="uint16")
C_Fault_TmotorOverConfirmCnt_u16 = myPackage.Parameter(0, DoubleProperty=0, Int32Property=int32(0), LogicalProperty=false, OnOffCharProperty="off", ColorCharProperty="red", StorageClass="YS_SelectRAMPara", HeaderFile="MCU_Fault_Paras.h", DefinitionFile="MCU_Fault_Paras.c", DataType="uint16")
C_Fault_TmotorWarnConfirmCnt_u16 = myPackage.Parameter(0, DoubleProperty=0, Int32Property=int32(0), LogicalProperty=false, OnOffCharProperty="off", ColorCharProperty="red", StorageClass="YS_SelectRAMPara", HeaderFile="MCU_Fault_Paras.h", DefinitionFile="MCU_Fault_Paras.c", DataType="uint16")
C_Fault_UdcLoFaultConfirmCnt_u16 = myPackage.Parameter(0, DoubleProperty=0, Int32Property=int32(0), LogicalProperty=false, OnOffCharProperty="off", ColorCharProperty="red", StorageClass="YS_SelectRAMPara", HeaderFile="MCU_Fault_Paras.h", DefinitionFile="MCU_Fault_Paras.c", DataType="uint16")
C_Fault_UdcLoWarnConfirmCnt_u16 = myPackage.Parameter(0, DoubleProperty=0, Int32Property=int32(0), LogicalProperty=false, OnOffCharProperty="off", ColorCharProperty="red", StorageClass="YS_SelectRAMPara", HeaderFile="MCU_Fault_Paras.h", DefinitionFile="MCU_Fault_Paras.c", DataType="uint16")
C_Fault_UdcUpFaultConfirmCnt_u16 = myPackage.Parameter(0, DoubleProperty=0, Int32Property=int32(0), LogicalProperty=false, OnOffCharProperty="off", ColorCharProperty="red", StorageClass="YS_SelectRAMPara", HeaderFile="MCU_Fault_Paras.h", DefinitionFile="MCU_Fault_Paras.c", DataType="uint16")
C_Fault_UdcUpWarnConfirmCnt_u16 = myPackage.Parameter(0, DoubleProperty=0, Int32Property=int32(0), LogicalProperty=false, OnOffCharProperty="off", ColorCharProperty="red", StorageClass="YS_SelectRAMPara", HeaderFile="MCU_Fault_Paras.h", DefinitionFile="MCU_Fault_Paras.c", DataType="uint16")
C_Fault_SpdUpFaultConfirmCnt_u16 = myPackage.Parameter(0, DoubleProperty=0, Int32Property=int32(0), LogicalProperty=false, OnOffCharProperty="off", ColorCharProperty="red", StorageClass="YS_SelectRAMPara", HeaderFile="MCU_Fault_Paras.h", DefinitionFile="MCU_Fault_Paras.c", DataType="uint16")
C_Fault_SpdUpWarnConfirmCnt_u16 = myPackage.Parameter(0, DoubleProperty=0, Int32Property=int32(0), LogicalProperty=false, OnOffCharProperty="off", ColorCharProperty="red", StorageClass="YS_SelectRAMPara", HeaderFile="MCU_Fault_Paras.h", DefinitionFile="MCU_Fault_Paras.c", DataType="uint16")
M_Fault_SpeedCal20msAbs_f32 = myPackage.Signal(DoubleProperty=0, Int32Property=int32(0), LogicalProperty=false, OnOffCharProperty="off", ColorCharProperty="red", StorageClass="YS_SelectRAMSignal", HeaderFile="MCU_Fault_Signals.h", DefinitionFile="MCU_Fault_Signals.c", DataType="single")
C_Fault_SpdUpLimitStart_i16 = myPackage.Parameter(8600, DoubleProperty=0, Int32Property=int32(0), LogicalProperty=false, OnOffCharProperty="off", ColorCharProperty="red", StorageClass="YS_SelectRAMPara", HeaderFile="MCU_Fault_Paras.h", DefinitionFile="MCU_Fault_Paras.c", DataType="single")
C_Fault_SpdUpLimitStop_i16 = myPackage.Parameter(9000, DoubleProperty=0, Int32Property=int32(0), LogicalProperty=false, OnOffCharProperty="off", ColorCharProperty="red", StorageClass="YS_SelectRAMPara", HeaderFile="MCU_Fault_Paras.h", DefinitionFile="MCU_Fault_Paras.c", DataType="single")
M_Fault_SpdUpOverFault_u32 = myPackage.Signal(DoubleProperty=0, Int32Property=int32(0), LogicalProperty=false, OnOffCharProperty="off", ColorCharProperty="red", StorageClass="YS_SelectRAMSignal", HeaderFile="MCU_Fault_Signals.h", DefinitionFile="MCU_Fault_Signals.c", DataType="uint32")
M_Fault_SpdUpWarnFault_u32 = myPackage.Signal(DoubleProperty=0, Int32Property=int32(0), LogicalProperty=false, OnOffCharProperty="off", ColorCharProperty="red", StorageClass="YS_SelectRAMSignal", HeaderFile="MCU_Fault_Signals.h", DefinitionFile="MCU_Fault_Signals.c", DataType="uint32")
C_SelfCheck_ACC1Offset_i32 = myPackage.Parameter(655, DoubleProperty=0, Int32Property=int32(0), LogicalProperty=false, OnOffCharProperty="off", ColorCharProperty="red", StorageClass="YS_SelectRAMPara", HeaderFile="MCU_SelfCheck_Paras.h", DefinitionFile="MCU_SelfCheck_Paras.c", DataType="int32")
C_SelfCheck_Acc1Gain_i16 = myPackage.Parameter(1221, DoubleProperty=0, Int32Property=int32(0), LogicalProperty=false, OnOffCharProperty="off", ColorCharProperty="red", StorageClass="YS_SelectRAMPara", HeaderFile="MCU_SelfCheck_Paras.h", DefinitionFile="MCU_SelfCheck_Paras.c", DataType="int16")
C_SelfCheck_AvgCntSet_u16 = myPackage.Parameter(128, DoubleProperty=0, Int32Property=int32(0), LogicalProperty=false, OnOffCharProperty="off", ColorCharProperty="red", StorageClass="YS_SelectRAMPara", HeaderFile="MCU_SelfCheck_Paras.h", DefinitionFile="MCU_SelfCheck_Paras.c", DataType="uint16")  % 累加次数
C_SelfCheck_DelayTimeSet_u16 = myPackage.Parameter(172, DoubleProperty=0, Int32Property=int32(0), LogicalProperty=false, OnOffCharProperty="off", ColorCharProperty="red", StorageClass="YS_SelectRAMPara", HeaderFile="MCU_SelfCheck_Paras.h", DefinitionFile="MCU_SelfCheck_Paras.c", DataType="uint16")  % 延迟DelayTimeSet个tick再做累加
C_SelfCheck_IGBTTable_i16 = myPackage.Parameter([120; 120; 120; 120; 120; 120; 120; 120; 120; 120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 -40], DoubleProperty=0, Int32Property=int32(0), LogicalProperty=false, OnOffCharProperty="off", ColorCharProperty="red", StorageClass="YS_SelectRAMPara", HeaderFile="MCU_SelfCheck_Paras.h", DefinitionFile="MCU_SelfCheck_Paras.c", DataType="int16")
C_SelfCheck_IGBTTempGain_s32 = myPackage.Parameter(0.25, DoubleProperty=0, Int32Property=int32(0), LogicalProperty=false, OnOffCharProperty="off", ColorCharProperty="red", StorageClass="YS_SelectRAMPara", HeaderFile="MCU_SelfCheck_Paras.h", DefinitionFile="MCU_SelfCheck_Paras.c", DataType="single")
C_SelfCheck_IGBTTempOffset_i32 = myPackage.Parameter(80, DoubleProperty=0, Int32Property=int32(0), LogicalProperty=false, OnOffCharProperty="off", ColorCharProperty="red", StorageClass="YS_SelectRAMPara", HeaderFile="MCU_SelfCheck_Paras.h", DefinitionFile="MCU_SelfCheck_Paras.c", DataType="int32")
C_SelfCheck_IGBTTemp_i32 = myPackage.Parameter(0, DoubleProperty=0, Int32Property=int32(0), LogicalProperty=false, OnOffCharProperty="off", ColorCharProperty="red", StorageClass="YS_SelectRAMPara", HeaderFile="MCU_SelfCheck_Paras.h", DefinitionFile="MCU_SelfCheck_Paras.c", DataType="int32")
C_SelfCheck_IaGain_i16 = myPackage.Parameter(19094, DoubleProperty=0, Int32Property=int32(0), LogicalProperty=false, OnOffCharProperty="off", ColorCharProperty="red", StorageClass="YS_SelectRAMPara", HeaderFile="MCU_SelfCheck_Paras.h", DefinitionFile="MCU_SelfCheck_Paras.c", DataType="int16")
C_SelfCheck_IaoffsetDownLimt_u16 = myPackage.Parameter(1950, DoubleProperty=0, Int32Property=int32(0), LogicalProperty=false, OnOffCharProperty="off", ColorCharProperty="red", StorageClass="YS_SelectRAMPara", HeaderFile="MCU_SelfCheck_Paras.h", DefinitionFile="MCU_SelfCheck_Paras.c", DataType="uint16")  % A相传感器最小偏置
C_SelfCheck_IaoffsetUpLimt_u16 = myPackage.Parameter(2150, DoubleProperty=0, Int32Property=int32(0), LogicalProperty=false, OnOffCharProperty="off", ColorCharProperty="red", StorageClass="YS_SelectRAMPara", HeaderFile="MCU_SelfCheck_Paras.h", DefinitionFile="MCU_SelfCheck_Paras.c", DataType="uint16")  % A相传感器最大偏置，ADC
C_SelfCheck_IbGain_i16 = myPackage.Parameter(19094, DoubleProperty=0, Int32Property=int32(0), LogicalProperty=false, OnOffCharProperty="off", ColorCharProperty="red", StorageClass="YS_SelectRAMPara", HeaderFile="MCU_SelfCheck_Paras.h", DefinitionFile="MCU_SelfCheck_Paras.c", DataType="int16")
C_SelfCheck_IboffsetDownLimt_u16 = myPackage.Parameter(1950, DoubleProperty=0, Int32Property=int32(0), LogicalProperty=false, OnOffCharProperty="off", ColorCharProperty="red", StorageClass="YS_SelectRAMPara", HeaderFile="MCU_SelfCheck_Paras.h", DefinitionFile="MCU_SelfCheck_Paras.c", DataType="uint16")  % B相传感器最小偏置
C_SelfCheck_IboffsetUpLimt_u16 = myPackage.Parameter(2150, DoubleProperty=0, Int32Property=int32(0), LogicalProperty=false, OnOffCharProperty="off", ColorCharProperty="red", StorageClass="YS_SelectRAMPara", HeaderFile="MCU_SelfCheck_Paras.h", DefinitionFile="MCU_SelfCheck_Paras.c", DataType="uint16")  % B相传感器最大偏置，ADC
C_SelfCheck_IcGain_i16 = myPackage.Parameter(19094, DoubleProperty=0, Int32Property=int32(0), LogicalProperty=false, OnOffCharProperty="off", ColorCharProperty="red", StorageClass="YS_SelectRAMPara", HeaderFile="MCU_SelfCheck_Paras.h", DefinitionFile="MCU_SelfCheck_Paras.c", DataType="int16")
C_SelfCheck_IcoffsetDownLimt_u16 = myPackage.Parameter(1950, DoubleProperty=0, Int32Property=int32(0), LogicalProperty=false, OnOffCharProperty="off", ColorCharProperty="red", StorageClass="YS_SelectRAMPara", HeaderFile="MCU_SelfCheck_Paras.h", DefinitionFile="MCU_SelfCheck_Paras.c", DataType="uint16")  % C相传感器最小偏置
C_SelfCheck_IcoffsetUpLimt_u16 = myPackage.Parameter(2150, DoubleProperty=0, Int32Property=int32(0), LogicalProperty=false, OnOffCharProperty="off", ColorCharProperty="red", StorageClass="YS_SelectRAMPara", HeaderFile="MCU_SelfCheck_Paras.h", DefinitionFile="MCU_SelfCheck_Paras.c", DataType="uint16")  % C相传感器最大偏置，ADC
C_SelfCheck_MotorTemp1Gain_s32 = myPackage.Parameter(0.25, DoubleProperty=0, Int32Property=int32(0), LogicalProperty=false, OnOffCharProperty="off", ColorCharProperty="red", StorageClass="YS_SelectRAMPara", HeaderFile="MCU_SelfCheck_Paras.h", DefinitionFile="MCU_SelfCheck_Paras.c", DataType="single")
C_SelfCheck_MotorTemp1Offset_i32 = myPackage.Parameter(0, DoubleProperty=0, Int32Property=int32(0), LogicalProperty=false, OnOffCharProperty="off", ColorCharProperty="red", StorageClass="YS_SelectRAMPara", HeaderFile="MCU_SelfCheck_Paras.h", DefinitionFile="MCU_SelfCheck_Paras.c", DataType="int32")
C_SelfCheck_OffsetTotalCntSet_u16 = myPackage.Parameter(128, DoubleProperty=0, Int32Property=int32(0), LogicalProperty=false, OnOffCharProperty="off", ColorCharProperty="red", StorageClass="YS_SelectRAMPara", HeaderFile="MCU_SelfCheck_Paras.h", DefinitionFile="MCU_SelfCheck_Paras.c", DataType="uint16")
C_SelfCheck_OffsetUnCal_u8 = myPackage.Parameter(2, DoubleProperty=0, Int32Property=int32(0), LogicalProperty=false, OnOffCharProperty="off", ColorCharProperty="red", StorageClass="YS_SelectRAMPara", HeaderFile="MCU_SelfCheck_Paras.h", DefinitionFile="MCU_SelfCheck_Paras.c", DataType="uint8")  % Offset计算未开始
C_SelfCheck_P12VGain_i16 = myPackage.Parameter(4394, DoubleProperty=0, Int32Property=int32(0), LogicalProperty=false, OnOffCharProperty="off", ColorCharProperty="red", StorageClass="YS_SelectRAMPara", HeaderFile="MCU_SelfCheck_Paras.h", DefinitionFile="MCU_SelfCheck_Paras.c", DataType="int16")
C_SelfCheck_P12VGain_i32 = myPackage.Parameter(0, DoubleProperty=0, Int32Property=int32(0), LogicalProperty=false, OnOffCharProperty="off", ColorCharProperty="red", StorageClass="YS_SelectRAMPara", HeaderFile="MCU_SelfCheck_Paras.h", DefinitionFile="MCU_SelfCheck_Paras.c", DataType="int32")
C_SelfCheck_P15VGain_i16 = myPackage.Parameter(4394, DoubleProperty=0, Int32Property=int32(0), LogicalProperty=false, OnOffCharProperty="off", ColorCharProperty="red", StorageClass="YS_SelectRAMPara", HeaderFile="MCU_SelfCheck_Paras.h", DefinitionFile="MCU_SelfCheck_Paras.c", DataType="int16")
C_SelfCheck_P15VGain_i32 = myPackage.Parameter(0, DoubleProperty=0, Int32Property=int32(0), LogicalProperty=false, OnOffCharProperty="off", ColorCharProperty="red", StorageClass="YS_SelectRAMPara", HeaderFile="MCU_SelfCheck_Paras.h", DefinitionFile="MCU_SelfCheck_Paras.c", DataType="int32")
C_SelfCheck_P5VGain_i16 = myPackage.Parameter(1282, DoubleProperty=0, Int32Property=int32(0), LogicalProperty=false, OnOffCharProperty="off", ColorCharProperty="red", StorageClass="YS_SelectRAMPara", HeaderFile="MCU_SelfCheck_Paras.h", DefinitionFile="MCU_SelfCheck_Paras.c", DataType="int16")
C_SelfCheck_P5VGain_i32 = myPackage.Parameter(0, DoubleProperty=0, Int32Property=int32(0), LogicalProperty=false, OnOffCharProperty="off", ColorCharProperty="red", StorageClass="YS_SelectRAMPara", HeaderFile="MCU_SelfCheck_Paras.h", DefinitionFile="MCU_SelfCheck_Paras.c", DataType="int32")
C_SelfCheck_PWMFreq_i16 = myPackage.Parameter(8000, DoubleProperty=0, Int32Property=int32(0), LogicalProperty=false, OnOffCharProperty="off", ColorCharProperty="red", StorageClass="YS_SelectRAMPara", HeaderFile="MCU_SelfCheck_Paras.h", DefinitionFile="MCU_SelfCheck_Paras.c", DataType="int16")
C_SelfCheck_UdcGain_i16 = myPackage.Parameter(4606, DoubleProperty=0, Int32Property=int32(0), LogicalProperty=false, OnOffCharProperty="off", ColorCharProperty="red", StorageClass="YS_SelectRAMPara", HeaderFile="MCU_SelfCheck_Paras.h", DefinitionFile="MCU_SelfCheck_Paras.c", DataType="int16")
C_SelfCheck_UdcOffset_i32 = myPackage.Parameter(0, DoubleProperty=0, Int32Property=int32(0), LogicalProperty=false, OnOffCharProperty="off", ColorCharProperty="red", StorageClass="YS_SelectRAMPara", HeaderFile="MCU_SelfCheck_Paras.h", DefinitionFile="MCU_SelfCheck_Paras.c", DataType="int32")
M_Fault_IaSensorFault_u8 = myPackage.Signal(DoubleProperty=0, Int32Property=int32(0), LogicalProperty=false, OnOffCharProperty="off", ColorCharProperty="red", StorageClass="YS_SelectRAMSignal", HeaderFile="MCU_Fault_Signals.h", DefinitionFile="MCU_Fault_Signals.c", DataType="uint8")
M_Fault_IbSensorFault_u8 = myPackage.Signal(DoubleProperty=0, Int32Property=int32(0), LogicalProperty=false, OnOffCharProperty="off", ColorCharProperty="red", StorageClass="YS_SelectRAMSignal", HeaderFile="MCU_Fault_Signals.h", DefinitionFile="MCU_Fault_Signals.c", DataType="uint8")
M_Fault_IcSensorFault_u8 = myPackage.Signal(DoubleProperty=0, Int32Property=int32(0), LogicalProperty=false, OnOffCharProperty="off", ColorCharProperty="red", StorageClass="YS_SelectRAMSignal", HeaderFile="MCU_Fault_Signals.h", DefinitionFile="MCU_Fault_Signals.c", DataType="uint8")
M_SelfCheck_AvgCntSet_u16 = myPackage.Signal(DoubleProperty=0, Int32Property=int32(0), LogicalProperty=false, OnOffCharProperty="off", ColorCharProperty="red", StorageClass="YS_SelectRAMSignal", HeaderFile="MCU_SelfCheck_Signals.h", DefinitionFile="MCU_SelfCheck_Signals.c", DataType="uint16")  % offset平均值计算分母
M_SelfCheck_DelayTimeSet_u16 = myPackage.Signal(DoubleProperty=0, Int32Property=int32(0), LogicalProperty=false, OnOffCharProperty="off", ColorCharProperty="red", StorageClass="YS_SelectRAMSignal", HeaderFile="MCU_SelfCheck_Signals.h", DefinitionFile="MCU_SelfCheck_Signals.c", DataType="uint16")  % offset计算延迟的tick
M_SelfCheck_IaFlgOfEffectiveOffset_u8 = myPackage.Signal(DoubleProperty=0, Int32Property=int32(0), LogicalProperty=false, OnOffCharProperty="off", ColorCharProperty="red", StorageClass="YS_SelectRAMSignal", HeaderFile="MCU_SelfCheck_Signals.h", DefinitionFile="MCU_SelfCheck_Signals.c", DataType="uint8")  % offset值的有效性，1有效，0超限
M_SelfCheck_IaNoOff_u16 = myPackage.Signal(DoubleProperty=0, Int32Property=int32(0), LogicalProperty=false, OnOffCharProperty="off", ColorCharProperty="red", StorageClass="YS_SelectRAMSignal", HeaderFile="MCU_SelfCheck_Signals.h", DefinitionFile="MCU_SelfCheck_Signals.c", DataType="uint16")
M_SelfCheck_IaOffset_s32 = myPackage.Signal(DoubleProperty=0, Int32Property=int32(0), LogicalProperty=false, OnOffCharProperty="off", ColorCharProperty="red", StorageClass="YS_SelectRAMSignal", HeaderFile="MCU_SelfCheck_Signals.h", DefinitionFile="MCU_SelfCheck_Signals.c", DataType="single")  % Ia的offset值
M_SelfCheck_IaPhaseCurrOffsetFault_u8 = myPackage.Signal(DoubleProperty=0, Int32Property=int32(0), LogicalProperty=false, OnOffCharProperty="off", ColorCharProperty="red", StorageClass="YS_SelectRAMSignal", HeaderFile="MCU_SelfCheck_Signals.h", DefinitionFile="MCU_SelfCheck_Signals.c", DataType="uint8")  % Ia电流offset故障标志
M_SelfCheck_IaStateOfOffsetcal_u8 = myPackage.Signal(DoubleProperty=0, Int32Property=int32(0), LogicalProperty=false, OnOffCharProperty="off", ColorCharProperty="red", StorageClass="YS_SelectRAMSignal", HeaderFile="MCU_SelfCheck_Signals.h", DefinitionFile="MCU_SelfCheck_Signals.c", DataType="uint8")  % offset计算是否完成
M_SelfCheck_IbFlgOfEffectiveOffset_u8 = myPackage.Signal(DoubleProperty=0, Int32Property=int32(0), LogicalProperty=false, OnOffCharProperty="off", ColorCharProperty="red", StorageClass="YS_SelectRAMSignal", HeaderFile="MCU_SelfCheck_Signals.h", DefinitionFile="MCU_SelfCheck_Signals.c", DataType="uint8")  % offset值的有效性，1有效，0超限
M_SelfCheck_IbNoOff_u16 = myPackage.Signal(DoubleProperty=0, Int32Property=int32(0), LogicalProperty=false, OnOffCharProperty="off", ColorCharProperty="red", StorageClass="YS_SelectRAMSignal", HeaderFile="MCU_SelfCheck_Signals.h", DefinitionFile="MCU_SelfCheck_Signals.c", DataType="uint16")
M_SelfCheck_IbOffset_s32 = myPackage.Signal(DoubleProperty=0, Int32Property=int32(0), LogicalProperty=false, OnOffCharProperty="off", ColorCharProperty="red", StorageClass="YS_SelectRAMSignal", HeaderFile="MCU_SelfCheck_Signals.h", DefinitionFile="MCU_SelfCheck_Signals.c", DataType="single")  % Ib的offset值
M_SelfCheck_IbPhaseCurrOffsetFault_u8 = myPackage.Signal(DoubleProperty=0, Int32Property=int32(0), LogicalProperty=false, OnOffCharProperty="off", ColorCharProperty="red", StorageClass="YS_SelectRAMSignal", HeaderFile="MCU_SelfCheck_Signals.h", DefinitionFile="MCU_SelfCheck_Signals.c", DataType="uint8")  % Ib电流offset故障标志
M_SelfCheck_IbStateOfOffsetcal_u8 = myPackage.Signal(DoubleProperty=0, Int32Property=int32(0), LogicalProperty=false, OnOffCharProperty="off", ColorCharProperty="red", StorageClass="YS_SelectRAMSignal", HeaderFile="MCU_SelfCheck_Signals.h", DefinitionFile="MCU_SelfCheck_Signals.c", DataType="uint8")  % offset计算是否完成
M_SelfCheck_IcFlgOfEffectiveOffset_u8 = myPackage.Signal(DoubleProperty=0, Int32Property=int32(0), LogicalProperty=false, OnOffCharProperty="off", ColorCharProperty="red", StorageClass="YS_SelectRAMSignal", HeaderFile="MCU_SelfCheck_Signals.h", DefinitionFile="MCU_SelfCheck_Signals.c", DataType="uint8")  % offset值的有效性，1有效，0超限
M_SelfCheck_IcNoOff_u16 = myPackage.Signal(DoubleProperty=0, Int32Property=int32(0), LogicalProperty=false, OnOffCharProperty="off", ColorCharProperty="red", StorageClass="YS_SelectRAMSignal", HeaderFile="MCU_SelfCheck_Signals.h", DefinitionFile="MCU_SelfCheck_Signals.c", DataType="uint16")
M_SelfCheck_IcOffset_s32 = myPackage.Signal(DoubleProperty=0, Int32Property=int32(0), LogicalProperty=false, OnOffCharProperty="off", ColorCharProperty="red", StorageClass="YS_SelectRAMSignal", HeaderFile="MCU_SelfCheck_Signals.h", DefinitionFile="MCU_SelfCheck_Signals.c", DataType="single")  % Ic的offset值
M_SelfCheck_IcPhaseCurrOffsetFault_u8 = myPackage.Signal(DoubleProperty=0, Int32Property=int32(0), LogicalProperty=false, OnOffCharProperty="off", ColorCharProperty="red", StorageClass="YS_SelectRAMSignal", HeaderFile="MCU_SelfCheck_Signals.h", DefinitionFile="MCU_SelfCheck_Signals.c", DataType="uint8")  % Ic电流offset故障标志
M_SelfCheck_IcStateOfOffsetcal_u8 = myPackage.Signal(DoubleProperty=0, Int32Property=int32(0), LogicalProperty=false, OnOffCharProperty="off", ColorCharProperty="red", StorageClass="YS_SelectRAMSignal", HeaderFile="MCU_SelfCheck_Signals.h", DefinitionFile="MCU_SelfCheck_Signals.c", DataType="uint8")  % offset计算是否完成
M_SelfCheck_OffsetCalOverFlg_u16 = myPackage.Signal(DoubleProperty=0, Int32Property=int32(0), LogicalProperty=false, OnOffCharProperty="off", ColorCharProperty="red", StorageClass="YS_SelectRAMSignal", HeaderFile="MCU_SelfCheck_Signals.h", DefinitionFile="MCU_SelfCheck_Signals.c", DataType="uint16")  % 三相电流offset计算完成标志
M_SelfCheck_PhaseCurrOffsetFault_u8 = myPackage.Signal(DoubleProperty=0, Int32Property=int32(0), LogicalProperty=false, OnOffCharProperty="off", ColorCharProperty="red", StorageClass="YS_SelectRAMSignal", HeaderFile="MCU_SelfCheck_Signals.h", DefinitionFile="MCU_SelfCheck_Signals.c", DataType="uint8")  % 三相电流offset故障标志
M_SelfCheck_PowerOnState_u8 = myPackage.Signal(DoubleProperty=0, Int32Property=int32(0), LogicalProperty=false, OnOffCharProperty="off", ColorCharProperty="red", StorageClass="YS_SelectRAMSignal", HeaderFile="MCU_SelfCheck_Signals.h", DefinitionFile="MCU_SelfCheck_Signals.c", DataType="uint8")  % 是否处于Poweron状态
M_SelfCheck_StandbyState_u8 = myPackage.Signal(DoubleProperty=0, Int32Property=int32(0), LogicalProperty=false, OnOffCharProperty="off", ColorCharProperty="red", StorageClass="YS_SelectRAMSignal", HeaderFile="MCU_SelfCheck_Signals.h", DefinitionFile="MCU_SelfCheck_Signals.c", DataType="uint8")
M_SelfCheck_WorkState_u16 = myPackage.Signal(DoubleProperty=0, Int32Property=int32(0), LogicalProperty=false, OnOffCharProperty="off", ColorCharProperty="red", StorageClass="YS_SelectRAMSignal", HeaderFile="MCU_SelfCheck_Signals.h", DefinitionFile="MCU_SelfCheck_Signals.c", DataType="uint16")
M_SelfChek_IaSensorFault_u8 = myPackage.Signal(DoubleProperty=0, Int32Property=int32(0), LogicalProperty=false, OnOffCharProperty="off", ColorCharProperty="red", StorageClass="YS_SelectRAMSignal", HeaderFile="MCU_SelfCheck_Signals.h", DefinitionFile="MCU_SelfCheck_Signals.c", DataType="uint8")
M_SelfChek_IbSensorFault_u8 = myPackage.Signal(DoubleProperty=0, Int32Property=int32(0), LogicalProperty=false, OnOffCharProperty="off", ColorCharProperty="red", StorageClass="YS_SelectRAMSignal", HeaderFile="MCU_SelfCheck_Signals.h", DefinitionFile="MCU_SelfCheck_Signals.c", DataType="uint8")
M_SelfChek_IcSensorFault_u8 = myPackage.Signal(DoubleProperty=0, Int32Property=int32(0), LogicalProperty=false, OnOffCharProperty="off", ColorCharProperty="red", StorageClass="YS_SelectRAMSignal", HeaderFile="MCU_SelfCheck_Signals.h", DefinitionFile="MCU_SelfCheck_Signals.c", DataType="uint8")
M_Selfcheck_EnFlg_u8 = myPackage.Signal(DoubleProperty=0, Int32Property=int32(0), LogicalProperty=false, OnOffCharProperty="off", ColorCharProperty="red", StorageClass="YS_SelectRAMSignal", HeaderFile="MCU_SelfCheck_Signals.h", DefinitionFile="MCU_SelfCheck_Signals.c", DataType="uint8")
M_Selfcheck_IgbtWorkFlg_u8 = myPackage.Signal(DoubleProperty=0, Int32Property=int32(0), LogicalProperty=false, OnOffCharProperty="off", ColorCharProperty="red", StorageClass="YS_SelectRAMSignal", HeaderFile="MCU_SelfCheck_Signals.h", DefinitionFile="MCU_SelfCheck_Signals.c", DataType="uint8")
M_Selfcheck_SpeedFlg_u8 = myPackage.Signal(DoubleProperty=0, Int32Property=int32(0), LogicalProperty=false, OnOffCharProperty="off", ColorCharProperty="red", StorageClass="YS_SelectRAMSignal", HeaderFile="MCU_SelfCheck_Signals.h", DefinitionFile="MCU_SelfCheck_Signals.c", DataType="uint8")
POWER_ON_Delete = myPackage.Parameter(0, DoubleProperty=0, Int32Property=int32(0), LogicalProperty=false, OnOffCharProperty="off", ColorCharProperty="red", StorageClass="YS_SelectRAMPara", HeaderFile="MCU_SelfCheck_Paras.h", DefinitionFile="MCU_SelfCheck_Paras.c", DataType="uint16")
M_Fault_IaInstantFault_u8 = myPackage.Signal(DoubleProperty=0, Int32Property=int32(0), LogicalProperty=false, OnOffCharProperty="off", ColorCharProperty="red", StorageClass="YS_SelectRAMSignal", HeaderFile="MCU_Fault_Signals.h", DefinitionFile="MCU_Fault_Signals.c", DataType="uint8", InitialValue="0")  % a相电流瞬时故障标志
M_Fault_IbInstantFault_u8 = myPackage.Signal(DoubleProperty=0, Int32Property=int32(0), LogicalProperty=false, OnOffCharProperty="off", ColorCharProperty="red", StorageClass="YS_SelectRAMSignal", HeaderFile="MCU_Fault_Signals.h", DefinitionFile="MCU_Fault_Signals.c", DataType="uint8", InitialValue="0")  % b相电流瞬时故障标志
M_Fault_IcInstantFault_u8 = myPackage.Signal(DoubleProperty=0, Int32Property=int32(0), LogicalProperty=false, OnOffCharProperty="off", ColorCharProperty="red", StorageClass="YS_SelectRAMSignal", HeaderFile="MCU_Fault_Signals.h", DefinitionFile="MCU_Fault_Signals.c", DataType="uint8", InitialValue="0")  % c相电流瞬时故障标志