% Simulink data dictionary MCU_Input_Sldd.sldd
% references PublicParameters.sldd
% references MCU_ParamCfg_Sldd_objects.sldd

C_ADC_Acc1Offset_i32 = myPackage.Parameter(655, DoubleProperty=0, Int32Property=int32(0), LogicalProperty=false, OnOffCharProperty="off", ColorCharProperty="red", StorageClass="YS_SelectRAMPara", HeaderFile="MCU_Input_Paras.h", DefinitionFile="MCU_Input_Paras.c", DataType="int32")
C_ADC_AvgCntSet_u16 = myPackage.Parameter(128, DoubleProperty=0, Int32Property=int32(0), LogicalProperty=false, OnOffCharProperty="off", ColorCharProperty="red", StorageClass="YS_SelectRAMPara", HeaderFile="MCU_Input_Paras.h", DefinitionFile="MCU_Input_Paras.c", DataType="uint16")  % 累加次数
C_ADC_BrakeOffset_i32 = myPackage.Parameter(0, DoubleProperty=0, Int32Property=int32(0), LogicalProperty=false, OnOffCharProperty="off", ColorCharProperty="red", StorageClass="YS_SelectRAMPara", HeaderFile="MCU_Input_Paras.h", DefinitionFile="MCU_Input_Paras.c", DataType="int32")
C_ADC_DelayTimeSet_u16 = myPackage.Parameter(172, DoubleProperty=0, Int32Property=int32(0), LogicalProperty=false, OnOffCharProperty="off", ColorCharProperty="red", StorageClass="YS_SelectRAMPara", HeaderFile="MCU_Input_Paras.h", DefinitionFile="MCU_Input_Paras.c", DataType="uint16")  % 延迟DelayTimeSet个tick再做累加
C_ADC_HSTempGain_f32 = myPackage.Parameter(0.25, DoubleProperty=0, Int32Property=int32(0), LogicalProperty=false, OnOffCharProperty="off", ColorCharProperty="red", StorageClass="YS_SelectRAMPara", HeaderFile="MCU_Input_Paras.h", DefinitionFile="MCU_Input_Paras.c", DataType="single")
C_ADC_HSTempOffset_i32 = myPackage.Parameter(0, DoubleProperty=0, Int32Property=int32(0), LogicalProperty=false, OnOffCharProperty="off", ColorCharProperty="red", StorageClass="YS_SelectRAMPara", HeaderFile="MCU_Input_Paras.h", DefinitionFile="MCU_Input_Paras.c", DataType="int32")
C_ADC_HalfVdcOffset_i32 = myPackage.Parameter(0, DoubleProperty=0, Int32Property=int32(0), LogicalProperty=false, OnOffCharProperty="off", ColorCharProperty="red", StorageClass="YS_SelectRAMPara", HeaderFile="MCU_Input_Paras.h", DefinitionFile="MCU_Input_Paras.c", DataType="int32")
C_ADC_IGBTTable_i16 = myPackage.Parameter([120; 120; 120; 120; 120; 120; 120; 120; 120; 120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 -40], DoubleProperty=0, Int32Property=int32(0), LogicalProperty=false, OnOffCharProperty="off", ColorCharProperty="red", StorageClass="YS_SelectRAMPara", HeaderFile="MCU_Input_Paras.h", DefinitionFile="MCU_Input_Paras.c", DataType="int16")
C_ADC_IGBTTempGain_f32 = myPackage.Parameter(0.25, DoubleProperty=0, Int32Property=int32(0), LogicalProperty=false, OnOffCharProperty="off", ColorCharProperty="red", StorageClass="YS_SelectRAMPara", HeaderFile="MCU_Input_Paras.h", DefinitionFile="MCU_Input_Paras.c", DataType="single")
C_ADC_IGBTTempOffset_i32 = myPackage.Parameter(0, DoubleProperty=0, Int32Property=int32(0), LogicalProperty=false, OnOffCharProperty="off", ColorCharProperty="red", StorageClass="YS_SelectRAMPara", HeaderFile="MCU_Input_Paras.h", DefinitionFile="MCU_Input_Paras.c", DataType="int32")
C_ADC_IGBTTemp_i32 = myPackage.Parameter(0, DoubleProperty=0, Int32Property=int32(0), LogicalProperty=false, OnOffCharProperty="off", ColorCharProperty="red", StorageClass="YS_SelectRAMPara", HeaderFile="MCU_Input_Paras.h", DefinitionFile="MCU_Input_Paras.c", DataType="int32")
C_ADC_IaoffsetDownLimt_u16 = myPackage.Parameter(1950, DoubleProperty=0, Int32Property=int32(0), LogicalProperty=false, OnOffCharProperty="off", ColorCharProperty="red", StorageClass="YS_SelectRAMPara", HeaderFile="MCU_Input_Paras.h", DefinitionFile="MCU_Input_Paras.c", DataType="uint16")  % A相传感器最小偏置
C_ADC_IaoffsetUpLimt_u16 = myPackage.Parameter(2150, DoubleProperty=0, Int32Property=int32(0), LogicalProperty=false, OnOffCharProperty="off", ColorCharProperty="red", StorageClass="YS_SelectRAMPara", HeaderFile="MCU_Input_Paras.h", DefinitionFile="MCU_Input_Paras.c", DataType="uint16")  % A相传感器最大偏置，ADC
C_ADC_IboffsetDownLimt_u16 = myPackage.Parameter(1950, DoubleProperty=0, Int32Property=int32(0), LogicalProperty=false, OnOffCharProperty="off", ColorCharProperty="red", StorageClass="YS_SelectRAMPara", HeaderFile="MCU_Input_Paras.h", DefinitionFile="MCU_Input_Paras.c", DataType="uint16")  % B相传感器最小偏置
C_ADC_IboffsetUpLimt_u16 = myPackage.Parameter(2150, DoubleProperty=0, Int32Property=int32(0), LogicalProperty=false, OnOffCharProperty="off", ColorCharProperty="red", StorageClass="YS_SelectRAMPara", HeaderFile="MCU_Input_Paras.h", DefinitionFile="MCU_Input_Paras.c", DataType="uint16")  % B相传感器最大偏置，ADC
C_ADC_IcoffsetDownLimt_u16 = myPackage.Parameter(1950, DoubleProperty=0, Int32Property=int32(0), LogicalProperty=false, OnOffCharProperty="off", ColorCharProperty="red", StorageClass="YS_SelectRAMPara", HeaderFile="MCU_Input_Paras.h", DefinitionFile="MCU_Input_Paras.c", DataType="uint16")  % C相传感器最小偏置
C_ADC_IcoffsetUpLimt_u16 = myPackage.Parameter(2150, DoubleProperty=0, Int32Property=int32(0), LogicalProperty=false, OnOffCharProperty="off", ColorCharProperty="red", StorageClass="YS_SelectRAMPara", HeaderFile="MCU_Input_Paras.h", DefinitionFile="MCU_Input_Paras.c", DataType="uint16")  % C相传感器最大偏置，ADC
C_ADC_IdcOffset_i32 = myPackage.Parameter(0, DoubleProperty=0, Int32Property=int32(0), LogicalProperty=false, OnOffCharProperty="off", ColorCharProperty="red", StorageClass="YS_SelectRAMPara", HeaderFile="MCU_Input_Paras.h", DefinitionFile="MCU_Input_Paras.c", DataType="int32")
C_ADC_MotorTemp1Gain_f32 = myPackage.Parameter(0.25, DoubleProperty=0, Int32Property=int32(0), LogicalProperty=false, OnOffCharProperty="off", ColorCharProperty="red", StorageClass="YS_SelectRAMPara", HeaderFile="MCU_Input_Paras.h", DefinitionFile="MCU_Input_Paras.c", DataType="single")
C_ADC_MotorTemp1Offset_i32 = myPackage.Parameter(0, DoubleProperty=0, Int32Property=int32(0), LogicalProperty=false, OnOffCharProperty="off", ColorCharProperty="red", StorageClass="YS_SelectRAMPara", HeaderFile="MCU_Input_Paras.h", DefinitionFile="MCU_Input_Paras.c", DataType="int32")
C_ADC_MotorTempTable_i16 = myPackage.Parameter([200; 200; 200; 200; 200; 200; 200; 200; 200; 200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 -40], DoubleProperty=0, Int32Property=int32(0), LogicalProperty=false, OnOffCharProperty="off", ColorCharProperty="red", StorageClass="YS_SelectRAMPara", HeaderFile="MCU_Input_Paras.h", DefinitionFile="MCU_Input_Paras.c", DataType="int16")
C_ADC_OffsetTotalCntSet_u16 = myPackage.Parameter(128, DoubleProperty=0, Int32Property=int32(0), LogicalProperty=false, OnOffCharProperty="off", ColorCharProperty="red", StorageClass="YS_SelectRAMPara", HeaderFile="MCU_Input_Paras.h", DefinitionFile="MCU_Input_Paras.c", DataType="uint16")
C_ADC_OffsetUnCal_u8 = myPackage.Parameter(2, DoubleProperty=0, Int32Property=int32(0), LogicalProperty=false, OnOffCharProperty="off", ColorCharProperty="red", StorageClass="YS_SelectRAMPara", HeaderFile="MCU_Input_Paras.h", DefinitionFile="MCU_Input_Paras.c", DataType="uint8")  % Offset计算未开始
C_ADC_P12VOffset_i32 = myPackage.Parameter(0, DoubleProperty=0, Int32Property=int32(0), LogicalProperty=false, OnOffCharProperty="off", ColorCharProperty="red", StorageClass="YS_SelectRAMPara", HeaderFile="MCU_Input_Paras.h", DefinitionFile="MCU_Input_Paras.c", DataType="int32")
C_ADC_P15VOffset_i32 = myPackage.Parameter(0, DoubleProperty=0, Int32Property=int32(0), LogicalProperty=false, OnOffCharProperty="off", ColorCharProperty="red", StorageClass="YS_SelectRAMPara", HeaderFile="MCU_Input_Paras.h", DefinitionFile="MCU_Input_Paras.c", DataType="int32")
C_ADC_P5VOffset_i32 = myPackage.Parameter(0, DoubleProperty=0, Int32Property=int32(0), LogicalProperty=false, OnOffCharProperty="off", ColorCharProperty="red", StorageClass="YS_SelectRAMPara", HeaderFile="MCU_Input_Paras.h", DefinitionFile="MCU_Input_Paras.c", DataType="int32")
C_ADC_UdcOffset_i32 = myPackage.Parameter(0, DoubleProperty=0, Int32Property=int32(0), LogicalProperty=false, OnOffCharProperty="off", ColorCharProperty="red", StorageClass="YS_SelectRAMPara", HeaderFile="MCU_Input_Paras.h", DefinitionFile="MCU_Input_Paras.c", DataType="int32")
C_ADC_VKeyOffset_i32 = myPackage.Parameter(0, DoubleProperty=0, Int32Property=int32(0), LogicalProperty=false, OnOffCharProperty="off", ColorCharProperty="red", StorageClass="YS_SelectRAMPara", HeaderFile="MCU_Input_Paras.h", DefinitionFile="MCU_Input_Paras.c", DataType="int32")
C_DCCurrent_DrvCoeff_f32 = myPackage.Parameter(1, DoubleProperty=0, Int32Property=int32(0), LogicalProperty=false, OnOffCharProperty="off", ColorCharProperty="red", StorageClass="YS_SelectRAMPara", HeaderFile="MCU_Input_Paras.h", DefinitionFile="MCU_Input_Paras.c", DataType="single")
C_DCCurrent_GenCoeff_f32 = myPackage.Parameter(1, DoubleProperty=0, Int32Property=int32(0), LogicalProperty=false, OnOffCharProperty="off", ColorCharProperty="red", StorageClass="YS_SelectRAMPara", HeaderFile="MCU_Input_Paras.h", DefinitionFile="MCU_Input_Paras.c", DataType="single")
C_Encoder_CurrentAdder_f32 = myPackage.Parameter(0.16, DoubleProperty=0, Int32Property=int32(0), LogicalProperty=false, OnOffCharProperty="off", ColorCharProperty="red", StorageClass="YS_SelectRAMPara", HeaderFile="MCU_Input_Paras.h", DefinitionFile="MCU_Input_Paras.c", DataType="single")
C_Encoder_WaitTime_f32 = myPackage.Parameter(5, DoubleProperty=0, Int32Property=int32(0), LogicalProperty=false, OnOffCharProperty="off", ColorCharProperty="red", StorageClass="YS_SelectRAMPara", HeaderFile="MCU_Input_Paras.h", DefinitionFile="MCU_Input_Paras.c", DataType="single")
C_Input_EncErr_u8 = myPackage.Parameter(0, DoubleProperty=0, Int32Property=int32(0), LogicalProperty=false, OnOffCharProperty="off", ColorCharProperty="red", StorageClass="YS_SelectRAMPara", HeaderFile="MCU_Input_Paras.h", DefinitionFile="MCU_Input_Paras.c", DataType="uint8")
C_Rotate_SetAngleFlg_u8 = myPackage.Parameter(0, DoubleProperty=0, Int32Property=int32(0), LogicalProperty=false, OnOffCharProperty="off", ColorCharProperty="red", StorageClass="YS_SelectRAMPara", HeaderFile="MCU_Input_Paras.h", DefinitionFile="MCU_Input_Paras.c", DataType="uint8")
C_Rotate_SetAngle_u16 = myPackage.Parameter(0, DoubleProperty=0, Int32Property=int32(0), LogicalProperty=false, OnOffCharProperty="off", ColorCharProperty="red", StorageClass="YS_SelectRAMPara", HeaderFile="MCU_Input_Paras.h", DefinitionFile="MCU_Input_Paras.c", DataType="uint16")
C_SelfCheck_AvgCntSet_u16 = myPackage.Parameter(128, DoubleProperty=0, Int32Property=int32(0), LogicalProperty=false, OnOffCharProperty="off", ColorCharProperty="red", StorageClass="YS_SelectRAMPara", HeaderFile="MCU_Input_Paras.h", DefinitionFile="MCU_Input_Paras.c", DataType="uint16")  % 累加次数
C_SelfCheck_DelayTimeSet_u16 = myPackage.Parameter(172, DoubleProperty=0, Int32Property=int32(0), LogicalProperty=false, OnOffCharProperty="off", ColorCharProperty="red", StorageClass="YS_SelectRAMPara", HeaderFile="MCU_Input_Paras.h", DefinitionFile="MCU_Input_Paras.c", DataType="uint16")  % 延迟DelayTimeSet个tick再做累加
C_SelfCheck_IaoffsetDownLimt_u16 = myPackage.Parameter(1950, DoubleProperty=0, Int32Property=int32(0), LogicalProperty=false, OnOffCharProperty="off", ColorCharProperty="red", StorageClass="YS_SelectRAMPara", HeaderFile="MCU_Input_Paras.h", DefinitionFile="MCU_Input_Paras.c", DataType="uint16")  % A相传感器最小偏置
C_SelfCheck_IaoffsetUpLimt_u16 = myPackage.Parameter(2150, DoubleProperty=0, Int32Property=int32(0), LogicalProperty=false, OnOffCharProperty="off", ColorCharProperty="red", StorageClass="YS_SelectRAMPara", HeaderFile="MCU_Input_Paras.h", DefinitionFile="MCU_Input_Paras.c", DataType="uint16")  % A相传感器最大偏置，ADC
C_SelfCheck_IboffsetDownLimt_u16 = myPackage.Parameter(1950, DoubleProperty=0, Int32Property=int32(0), LogicalProperty=false, OnOffCharProperty="off", ColorCharProperty="red", StorageClass="YS_SelectRAMPara", HeaderFile="MCU_Input_Paras.h", DefinitionFile="MCU_Input_Paras.c", DataType="uint16")  % B相传感器最小偏置
C_SelfCheck_IboffsetUpLimt_u16 = myPackage.Parameter(2150, DoubleProperty=0, Int32Property=int32(0), LogicalProperty=false, OnOffCharProperty="off", ColorCharProperty="red", StorageClass="YS_SelectRAMPara", HeaderFile="MCU_Input_Paras.h", DefinitionFile="MCU_Input_Paras.c", DataType="uint16")  % B相传感器最大偏置，ADC
C_SelfCheck_IcoffsetDownLimt_u16 = myPackage.Parameter(1950, DoubleProperty=0, Int32Property=int32(0), LogicalProperty=false, OnOffCharProperty="off", ColorCharProperty="red", StorageClass="YS_SelectRAMPara", HeaderFile="MCU_Input_Paras.h", DefinitionFile="MCU_Input_Paras.c", DataType="uint16")  % C相传感器最小偏置
C_SelfCheck_IcoffsetUpLimt_u16 = myPackage.Parameter(2150, DoubleProperty=0, Int32Property=int32(0), LogicalProperty=false, OnOffCharProperty="off", ColorCharProperty="red", StorageClass="YS_SelectRAMPara", HeaderFile="MCU_Input_Paras.h", DefinitionFile="MCU_Input_Paras.c", DataType="uint16")  % C相传感器最大偏置，ADC
C_SelfCheck_OffsetUnCal_u8 = myPackage.Parameter(2, DoubleProperty=0, Int32Property=int32(0), LogicalProperty=false, OnOffCharProperty="off", ColorCharProperty="red", StorageClass="YS_SelectRAMPara", HeaderFile="MCU_Input_Paras.h", DefinitionFile="MCU_Input_Paras.c", DataType="uint8")  % Offset计算未开始
CosAmp = myPackage.Signal(DoubleProperty=0, Int32Property=int32(0), LogicalProperty=false, OnOffCharProperty="off", ColorCharProperty="red", StorageClass="YS_SelectRAMSignal", HeaderFile="MCU_Input_Signals.h", DefinitionFile="MCU_Input_Signals.c", DataType="uint16")
CosAvg = myPackage.Signal(DoubleProperty=0, Int32Property=int32(0), LogicalProperty=false, OnOffCharProperty="off", ColorCharProperty="red", StorageClass="YS_SelectRAMSignal", HeaderFile="MCU_Input_Signals.h", DefinitionFile="MCU_Input_Signals.c", DataType="uint16")
M_ADC_Acc1DigitalValue_s32 = myPackage.Signal(DoubleProperty=0, Int32Property=int32(0), LogicalProperty=false, OnOffCharProperty="off", ColorCharProperty="red", StorageClass="YS_SelectRAMSignal", HeaderFile="MCU_Input_Signals.h", DefinitionFile="MCU_Input_Signals.c", DataType="single", InitialValue="0")
M_ADC_Acc1Value_s32 = myPackage.Signal(DoubleProperty=0, Int32Property=int32(0), LogicalProperty=false, OnOffCharProperty="off", ColorCharProperty="red", StorageClass="YS_SelectRAMSignal", HeaderFile="MCU_Input_Signals.h", DefinitionFile="MCU_Input_Signals.c", DataType="single", InitialValue="0")  % Acc1的真实值
M_ADC_AvgCntSet_u16 = myPackage.Signal(DoubleProperty=0, Int32Property=int32(0), LogicalProperty=false, OnOffCharProperty="off", ColorCharProperty="red", StorageClass="YS_SelectRAMSignal", HeaderFile="MCU_Input_Signals.h", DefinitionFile="MCU_Input_Signals.c", DataType="uint16")  % offset平均值计算分母
M_ADC_DecoupleUdc_s32 = myPackage.Signal(DoubleProperty=0, Int32Property=int32(0), LogicalProperty=false, OnOffCharProperty="off", ColorCharProperty="red", StorageClass="YS_SelectRAMSignal", HeaderFile="MCU_Input_Signals.h", DefinitionFile="MCU_Input_Signals.c", DataType="single", InitialValue="0")  % Udc/1.732
M_ADC_DelayTimeSet_u16 = myPackage.Signal(DoubleProperty=0, Int32Property=int32(0), LogicalProperty=false, OnOffCharProperty="off", ColorCharProperty="red", StorageClass="YS_SelectRAMSignal", HeaderFile="MCU_Input_Signals.h", DefinitionFile="MCU_Input_Signals.c", DataType="uint16")  % offset计算延迟的tick
M_ADC_EnFlg_u8 = myPackage.Signal(DoubleProperty=0, Int32Property=int32(0), LogicalProperty=false, OnOffCharProperty="off", ColorCharProperty="red", StorageClass="YS_SelectRAMSignal", HeaderFile="MCU_Input_Signals.h", DefinitionFile="MCU_Input_Signals.c", DataType="uint8")
M_ADC_IGBTTempDigitalValue_s32 = myPackage.Signal(DoubleProperty=0, Int32Property=int32(0), LogicalProperty=false, OnOffCharProperty="off", ColorCharProperty="red", StorageClass="YS_SelectRAMSignal", HeaderFile="MCU_Input_Signals.h", DefinitionFile="MCU_Input_Signals.c", DataType="single")
M_ADC_IGBTTempValue_i16 = myPackage.Signal(DoubleProperty=0, Int32Property=int32(0), LogicalProperty=false, OnOffCharProperty="off", ColorCharProperty="red", StorageClass="YS_SelectRAMSignal", HeaderFile="MCU_Input_Signals.h", DefinitionFile="MCU_Input_Signals.c", DataType="int16", InitialValue="0")  % IGBT温度真实值
M_ADC_IaFlgOfEffectiveOffset_u8 = myPackage.Signal(DoubleProperty=0, Int32Property=int32(0), LogicalProperty=false, OnOffCharProperty="off", ColorCharProperty="red", StorageClass="YS_SelectRAMSignal", HeaderFile="MCU_Input_Signals.h", DefinitionFile="MCU_Input_Signals.c", DataType="uint8")  % offset值的有效性，1有效，0超限
M_ADC_IaNoOff_u16 = myPackage.Signal(DoubleProperty=0, Int32Property=int32(0), LogicalProperty=false, OnOffCharProperty="off", ColorCharProperty="red", StorageClass="YS_SelectRAMSignal", HeaderFile="MCU_Input_Signals.h", DefinitionFile="MCU_Input_Signals.c", DataType="uint16")
M_ADC_IaOffset_s32 = myPackage.Signal(DoubleProperty=0, Int32Property=int32(0), LogicalProperty=false, OnOffCharProperty="off", ColorCharProperty="red", StorageClass="YS_SelectRAMSignal", HeaderFile="MCU_Input_Signals.h", DefinitionFile="MCU_Input_Signals.c", DataType="single")  % Ia的offset值
M_ADC_IaPhaseCurrOffsetFault_u8 = myPackage.Signal(DoubleProperty=0, Int32Property=int32(0), LogicalProperty=false, OnOffCharProperty="off", ColorCharProperty="red", StorageClass="YS_SelectRAMSignal", HeaderFile="MCU_Input_Signals.h", DefinitionFile="MCU_Input_Signals.c", DataType="uint8")  % Ia电流offset故障标志
M_ADC_IaStateOfOffsetcal_u8 = myPackage.Signal(DoubleProperty=0, Int32Property=int32(0), LogicalProperty=false, OnOffCharProperty="off", ColorCharProperty="red", StorageClass="YS_SelectRAMSignal", HeaderFile="MCU_Input_Signals.h", DefinitionFile="MCU_Input_Signals.c", DataType="uint8")  % offset计算是否完成
M_ADC_IbFlgOfEffectiveOffset_u8 = myPackage.Signal(DoubleProperty=0, Int32Property=int32(0), LogicalProperty=false, OnOffCharProperty="off", ColorCharProperty="red", StorageClass="YS_SelectRAMSignal", HeaderFile="MCU_Input_Signals.h", DefinitionFile="MCU_Input_Signals.c", DataType="uint8")  % offset值的有效性，1有效，0超限
M_ADC_IbNoOff_u16 = myPackage.Signal(DoubleProperty=0, Int32Property=int32(0), LogicalProperty=false, OnOffCharProperty="off", ColorCharProperty="red", StorageClass="YS_SelectRAMSignal", HeaderFile="MCU_Input_Signals.h", DefinitionFile="MCU_Input_Signals.c", DataType="uint16")
M_ADC_IbOffset_s32 = myPackage.Signal(DoubleProperty=0, Int32Property=int32(0), LogicalProperty=false, OnOffCharProperty="off", ColorCharProperty="red", StorageClass="YS_SelectRAMSignal", HeaderFile="MCU_Input_Signals.h", DefinitionFile="MCU_Input_Signals.c", DataType="single")  % Ib的offset值
M_ADC_IbPhaseCurrOffsetFault_u8 = myPackage.Signal(DoubleProperty=0, Int32Property=int32(0), LogicalProperty=false, OnOffCharProperty="off", ColorCharProperty="red", StorageClass="YS_SelectRAMSignal", HeaderFile="MCU_Input_Signals.h", DefinitionFile="MCU_Input_Signals.c", DataType="uint8")  % Ib电流offset故障标志
M_ADC_IbStateOfOffsetcal_u8 = myPackage.Signal(DoubleProperty=0, Int32Property=int32(0), LogicalProperty=false, OnOffCharProperty="off", ColorCharProperty="red", StorageClass="YS_SelectRAMSignal", HeaderFile="MCU_Input_Signals.h", DefinitionFile="MCU_Input_Signals.c", DataType="uint8")  % offset计算是否完成
M_ADC_IcFlgOfEffectiveOffset_u8 = myPackage.Signal(DoubleProperty=0, Int32Property=int32(0), LogicalProperty=false, OnOffCharProperty="off", ColorCharProperty="red", StorageClass="YS_SelectRAMSignal", HeaderFile="MCU_Input_Signals.h", DefinitionFile="MCU_Input_Signals.c", DataType="uint8")  % offset值的有效性，1有效，0超限
M_ADC_IcNoOff_u16 = myPackage.Signal(DoubleProperty=0, Int32Property=int32(0), LogicalProperty=false, OnOffCharProperty="off", ColorCharProperty="red", StorageClass="YS_SelectRAMSignal", HeaderFile="MCU_Input_Signals.h", DefinitionFile="MCU_Input_Signals.c", DataType="uint16")
M_ADC_IcOffset_s32 = myPackage.Signal(DoubleProperty=0, Int32Property=int32(0), LogicalProperty=false, OnOffCharProperty="off", ColorCharProperty="red", StorageClass="YS_SelectRAMSignal", HeaderFile="MCU_Input_Signals.h", DefinitionFile="MCU_Input_Signals.c", DataType="single")  % Ic的offset值
M_ADC_IcPhaseCurrOffsetFault_u8 = myPackage.Signal(DoubleProperty=0, Int32Property=int32(0), LogicalProperty=false, OnOffCharProperty="off", ColorCharProperty="red", StorageClass="YS_SelectRAMSignal", HeaderFile="MCU_Input_Signals.h", DefinitionFile="MCU_Input_Signals.c", DataType="uint8")  % Ic电流offset故障标志
M_ADC_IcStateOfOffsetcal_u8 = myPackage.Signal(DoubleProperty=0, Int32Property=int32(0), LogicalProperty=false, OnOffCharProperty="off", ColorCharProperty="red", StorageClass="YS_SelectRAMSignal", HeaderFile="MCU_Input_Signals.h", DefinitionFile="MCU_Input_Signals.c", DataType="uint8")  % offset计算是否完成
M_ADC_MotorTemp1DigitalValue_s32 = myPackage.Signal(DoubleProperty=0, Int32Property=int32(0), LogicalProperty=false, OnOffCharProperty="off", ColorCharProperty="red", StorageClass="YS_SelectRAMSignal", HeaderFile="MCU_Input_Signals.h", DefinitionFile="MCU_Input_Signals.c", DataType="single")
M_ADC_MotorTemp1Value_i16 = myPackage.Signal(DoubleProperty=0, Int32Property=int32(0), LogicalProperty=false, OnOffCharProperty="off", ColorCharProperty="red", StorageClass="YS_SelectRAMSignal", HeaderFile="MCU_Input_Signals.h", DefinitionFile="MCU_Input_Signals.c", DataType="int16", InitialValue="0")  % 电机温度1的真实值
M_ADC_OffsetCalOverFlg_u16 = myPackage.Signal(DoubleProperty=0, Int32Property=int32(0), LogicalProperty=false, OnOffCharProperty="off", ColorCharProperty="red", StorageClass="YS_SelectRAMSignal", HeaderFile="MCU_Input_Signals.h", DefinitionFile="MCU_Input_Signals.c", DataType="uint16")  % 三相电流offset计算完成标志
M_ADC_PhaseCurrOffsetFault_u8 = myPackage.Signal(DoubleProperty=0, Int32Property=int32(0), LogicalProperty=false, OnOffCharProperty="off", ColorCharProperty="red", StorageClass="YS_SelectRAMSignal", HeaderFile="MCU_Input_Signals.h", DefinitionFile="MCU_Input_Signals.c", DataType="uint8")  % 三相电流offset故障标志
M_ADC_PowerOnState_u8 = myPackage.Signal(DoubleProperty=0, Int32Property=int32(0), LogicalProperty=false, OnOffCharProperty="off", ColorCharProperty="red", StorageClass="YS_SelectRAMSignal", HeaderFile="MCU_Input_Signals.h", DefinitionFile="MCU_Input_Signals.c", DataType="uint8")  % 是否处于Poweron状态
M_ADC_SMOUdcPuBase_s32 = myPackage.Signal(DoubleProperty=0, Int32Property=int32(0), LogicalProperty=false, OnOffCharProperty="off", ColorCharProperty="red", StorageClass="YS_SelectRAMSignal", HeaderFile="MCU_Input_Signals.h", DefinitionFile="MCU_Input_Signals.c", DataType="single", InitialValue="0")  % Udc*1.732/3
M_ADC_StandbyState_u8 = myPackage.Signal(DoubleProperty=0, Int32Property=int32(0), LogicalProperty=false, OnOffCharProperty="off", ColorCharProperty="red", StorageClass="YS_SelectRAMSignal", HeaderFile="MCU_Input_Signals.h", DefinitionFile="MCU_Input_Signals.c", DataType="uint8")
M_ADC_UdcADCDigitalValue_s32 = myPackage.Signal(DoubleProperty=0, Int32Property=int32(0), LogicalProperty=false, OnOffCharProperty="off", ColorCharProperty="red", StorageClass="YS_SelectRAMSignal", HeaderFile="MCU_Input_Signals.h", DefinitionFile="MCU_Input_Signals.c", DataType="single")
M_ADC_UdcValue_s32 = myPackage.Signal(DoubleProperty=0, Int32Property=int32(0), LogicalProperty=false, OnOffCharProperty="off", ColorCharProperty="red", StorageClass="YS_SelectRAMSignal", HeaderFile="MCU_Input_Signals.h", DefinitionFile="MCU_Input_Signals.c", DataType="single", InitialValue="0")  % Udc的真实值
M_ADC_WorkState_u16 = myPackage.Signal(DoubleProperty=0, Int32Property=int32(0), LogicalProperty=false, OnOffCharProperty="off", ColorCharProperty="red", StorageClass="YS_SelectRAMSignal", HeaderFile="MCU_Input_Signals.h", DefinitionFile="MCU_Input_Signals.c", DataType="uint16")
M_DCCUrrent_CurOut_f32 = myPackage.Signal(DoubleProperty=0, Int32Property=int32(0), LogicalProperty=false, OnOffCharProperty="off", ColorCharProperty="red", StorageClass="YS_SelectRAMSignal", HeaderFile="MCU_Input_Signals.h", DefinitionFile="MCU_Input_Signals.c", DataType="single", InitialValue="0")
M_DCCurent_BMSCur_f32 = myPackage.Signal(DoubleProperty=0, Int32Property=int32(0), LogicalProperty=false, OnOffCharProperty="off", ColorCharProperty="red", StorageClass="YS_SelectRAMSignal", HeaderFile="MCU_Input_Signals.h", DefinitionFile="MCU_Input_Signals.c", DataType="single")
M_DCCurrent_Ialpha_f32 = myPackage.Signal(DoubleProperty=0, Int32Property=int32(0), LogicalProperty=false, OnOffCharProperty="off", ColorCharProperty="red", StorageClass="YS_SelectRAMSignal", HeaderFile="MCU_Input_Signals.h", DefinitionFile="MCU_Input_Signals.c", DataType="single", InitialValue="0")
M_DCCurrent_Ibeta_f32 = myPackage.Signal(DoubleProperty=0, Int32Property=int32(0), LogicalProperty=false, OnOffCharProperty="off", ColorCharProperty="red", StorageClass="YS_SelectRAMSignal", HeaderFile="MCU_Input_Signals.h", DefinitionFile="MCU_Input_Signals.c", DataType="single", InitialValue="0")
M_DCCurrent_Ualpha_f32 = myPackage.Signal(DoubleProperty=0, Int32Property=int32(0), LogicalProperty=false, OnOffCharProperty="off", ColorCharProperty="red", StorageClass="YS_SelectRAMSignal", HeaderFile="MCU_Input_Signals.h", DefinitionFile="MCU_Input_Signals.c", DataType="single", InitialValue="0")
M_DCCurrent_Ubeta_f32 = myPackage.Signal(DoubleProperty=0, Int32Property=int32(0), LogicalProperty=false, OnOffCharProperty="off", ColorCharProperty="red", StorageClass="YS_SelectRAMSignal", HeaderFile="MCU_Input_Signals.h", DefinitionFile="MCU_Input_Signals.c", DataType="single", InitialValue="0")
M_GPIO_ABSOriginalSignal_u16 = myPackage.Signal(DoubleProperty=0, Int32Property=int32(0), LogicalProperty=false, OnOffCharProperty="off", ColorCharProperty="red", StorageClass="YS_SelectRAMSignal", HeaderFile="MCU_Input_Signals.h", DefinitionFile="MCU_Input_Signals.c", DataType="uint16", InitialValue="0")
M_GPIO_ABSSignal_u16 = myPackage.Signal(DoubleProperty=0, Int32Property=int32(0), LogicalProperty=false, OnOffCharProperty="off", ColorCharProperty="red", StorageClass="YS_SelectRAMSignal", HeaderFile="MCU_Input_Signals.h", DefinitionFile="MCU_Input_Signals.c", DataType="uint16", InitialValue="0")
M_GPIO_AntiTheftOriginalSignal_u16 = myPackage.Signal(DoubleProperty=0, Int32Property=int32(0), LogicalProperty=false, OnOffCharProperty="off", ColorCharProperty="red", StorageClass="YS_SelectRAMSignal", HeaderFile="MCU_Input_Signals.h", DefinitionFile="MCU_Input_Signals.c", DataType="uint16", InitialValue="0")
M_GPIO_AntiTheftSignal_u16 = myPackage.Signal(DoubleProperty=0, Int32Property=int32(0), LogicalProperty=false, OnOffCharProperty="off", ColorCharProperty="red", StorageClass="YS_SelectRAMSignal", HeaderFile="MCU_Input_Signals.h", DefinitionFile="MCU_Input_Signals.c", DataType="uint16", InitialValue="0")
M_GPIO_BackOriginalSignal_u16 = myPackage.Signal(DoubleProperty=0, Int32Property=int32(0), LogicalProperty=false, OnOffCharProperty="off", ColorCharProperty="red", StorageClass="YS_SelectRAMSignal", HeaderFile="MCU_Input_Signals.h", DefinitionFile="MCU_Input_Signals.c", DataType="uint16", InitialValue="0")
M_GPIO_BackSignal_u16 = myPackage.Signal(DoubleProperty=0, Int32Property=int32(0), LogicalProperty=false, OnOffCharProperty="off", ColorCharProperty="red", StorageClass="YS_SelectRAMSignal", HeaderFile="MCU_Input_Signals.h", DefinitionFile="MCU_Input_Signals.c", DataType="uint16", InitialValue="0")
M_GPIO_BrakeOriginalSignal_u16 = myPackage.Signal(DoubleProperty=0, Int32Property=int32(0), LogicalProperty=false, OnOffCharProperty="off", ColorCharProperty="red", StorageClass="YS_SelectRAMSignal", HeaderFile="MCU_Input_Signals.h", DefinitionFile="MCU_Input_Signals.c", DataType="uint16", InitialValue="0")
M_GPIO_BrakeSignal_u16 = myPackage.Signal(DoubleProperty=0, Int32Property=int32(0), LogicalProperty=false, OnOffCharProperty="off", ColorCharProperty="red", StorageClass="YS_SelectRAMSignal", HeaderFile="MCU_Input_Signals.h", DefinitionFile="MCU_Input_Signals.c", DataType="uint16", InitialValue="0")
M_GPIO_CCSOriginalSignal_u16 = myPackage.Signal(DoubleProperty=0, Int32Property=int32(0), LogicalProperty=false, OnOffCharProperty="off", ColorCharProperty="red", StorageClass="YS_SelectRAMSignal", HeaderFile="MCU_Input_Signals.h", DefinitionFile="MCU_Input_Signals.c", DataType="uint16", InitialValue="0")
M_GPIO_CCSSignal_u16 = myPackage.Signal(DoubleProperty=0, Int32Property=int32(0), LogicalProperty=false, OnOffCharProperty="off", ColorCharProperty="red", StorageClass="YS_SelectRAMSignal", HeaderFile="MCU_Input_Signals.h", DefinitionFile="MCU_Input_Signals.c", DataType="uint16", InitialValue="0")
M_GPIO_HDCOriginalSignal_u16 = myPackage.Signal(DoubleProperty=0, Int32Property=int32(0), LogicalProperty=false, OnOffCharProperty="off", ColorCharProperty="red", StorageClass="YS_SelectRAMSignal", HeaderFile="MCU_Input_Signals.h", DefinitionFile="MCU_Input_Signals.c", DataType="uint16", InitialValue="0")
M_GPIO_HDCSignal_u16 = myPackage.Signal(DoubleProperty=0, Int32Property=int32(0), LogicalProperty=false, OnOffCharProperty="off", ColorCharProperty="red", StorageClass="YS_SelectRAMSignal", HeaderFile="MCU_Input_Signals.h", DefinitionFile="MCU_Input_Signals.c", DataType="uint16", InitialValue="0")
M_GPIO_KGearOriginalSignal_u16 = myPackage.Signal(DoubleProperty=0, Int32Property=int32(0), LogicalProperty=false, OnOffCharProperty="off", ColorCharProperty="red", StorageClass="YS_SelectRAMSignal", HeaderFile="MCU_Input_Signals.h", DefinitionFile="MCU_Input_Signals.c", DataType="uint16", InitialValue="0")
M_GPIO_KGearSignal_u16 = myPackage.Signal(DoubleProperty=0, Int32Property=int32(0), LogicalProperty=false, OnOffCharProperty="off", ColorCharProperty="red", StorageClass="YS_SelectRAMSignal", HeaderFile="MCU_Input_Signals.h", DefinitionFile="MCU_Input_Signals.c", DataType="uint16", InitialValue="0")
M_GPIO_RepairOriginalSignal_u16 = myPackage.Signal(DoubleProperty=0, Int32Property=int32(0), LogicalProperty=false, OnOffCharProperty="off", ColorCharProperty="red", StorageClass="YS_SelectRAMSignal", HeaderFile="MCU_Input_Signals.h", DefinitionFile="MCU_Input_Signals.c", DataType="uint16", InitialValue="0")
M_GPIO_RepairSignal_u16 = myPackage.Signal(DoubleProperty=0, Int32Property=int32(0), LogicalProperty=false, OnOffCharProperty="off", ColorCharProperty="red", StorageClass="YS_SelectRAMSignal", HeaderFile="MCU_Input_Signals.h", DefinitionFile="MCU_Input_Signals.c", DataType="uint16", InitialValue="0")
M_GPIO_SportOriginalSignal_u16 = myPackage.Signal(DoubleProperty=0, Int32Property=int32(0), LogicalProperty=false, OnOffCharProperty="off", ColorCharProperty="red", StorageClass="YS_SelectRAMSignal", HeaderFile="MCU_Input_Signals.h", DefinitionFile="MCU_Input_Signals.c", DataType="uint16", InitialValue="0")
M_GPIO_SportSignal_u16 = myPackage.Signal(DoubleProperty=0, Int32Property=int32(0), LogicalProperty=false, OnOffCharProperty="off", ColorCharProperty="red", StorageClass="YS_SelectRAMSignal", HeaderFile="MCU_Input_Signals.h", DefinitionFile="MCU_Input_Signals.c", DataType="uint16", InitialValue="0")
M_SelfCheck_IaFlgOfEffectiveOffset_u8 = myPackage.Signal(DoubleProperty=0, Int32Property=int32(0), LogicalProperty=false, OnOffCharProperty="off", ColorCharProperty="red", StorageClass="YS_SelectRAMSignal", HeaderFile="MCU_Input_Signals.h", DefinitionFile="MCU_Input_Signals.c", DataType="uint8", InitialValue="2")  % offset值的有效性，1有效，0超限
M_SelfCheck_IaNoOff_u16 = myPackage.Signal(DoubleProperty=0, Int32Property=int32(0), LogicalProperty=false, OnOffCharProperty="off", ColorCharProperty="red", StorageClass="YS_SelectRAMSignal", HeaderFile="MCU_Input_Signals.h", DefinitionFile="MCU_Input_Signals.c", DataType="uint16", InitialValue="2048")
M_SelfCheck_IaOffset_f32 = myPackage.Signal(DoubleProperty=0, Int32Property=int32(0), LogicalProperty=false, OnOffCharProperty="off", ColorCharProperty="red", StorageClass="YS_SelectRAMSignal", HeaderFile="MCU_Input_Signals.h", DefinitionFile="MCU_Input_Signals.c", DataType="single", InitialValue="0")  % Ia的offset值
M_SelfCheck_IaPhaseCurrOffsetFault_u8 = myPackage.Signal(DoubleProperty=0, Int32Property=int32(0), LogicalProperty=false, OnOffCharProperty="off", ColorCharProperty="red", StorageClass="YS_SelectRAMSignal", HeaderFile="MCU_Input_Signals.h", DefinitionFile="MCU_Input_Signals.c", DataType="uint8", InitialValue="0")  % Ia电流offset故障标志
M_SelfCheck_IaStateOfOffsetcal_u8 = myPackage.Signal(DoubleProperty=0, Int32Property=int32(0), LogicalProperty=false, OnOffCharProperty="off", ColorCharProperty="red", StorageClass="YS_SelectRAMSignal", HeaderFile="MCU_Input_Signals.h", DefinitionFile="MCU_Input_Signals.c", DataType="uint8", InitialValue="0")  % offset计算是否完成
M_SelfCheck_IbFlgOfEffectiveOffset_u8 = myPackage.Signal(DoubleProperty=0, Int32Property=int32(0), LogicalProperty=false, OnOffCharProperty="off", ColorCharProperty="red", StorageClass="YS_SelectRAMSignal", HeaderFile="MCU_Input_Signals.h", DefinitionFile="MCU_Input_Signals.c", DataType="uint8", InitialValue="2")  % offset值的有效性，1有效，0超限
M_SelfCheck_IbNoOff_u16 = myPackage.Signal(DoubleProperty=0, Int32Property=int32(0), LogicalProperty=false, OnOffCharProperty="off", ColorCharProperty="red", StorageClass="YS_SelectRAMSignal", HeaderFile="MCU_Input_Signals.h", DefinitionFile="MCU_Input_Signals.c", DataType="uint16", InitialValue="2048")
M_SelfCheck_IbOffset_f32 = myPackage.Signal(DoubleProperty=0, Int32Property=int32(0), LogicalProperty=false, OnOffCharProperty="off", ColorCharProperty="red", StorageClass="YS_SelectRAMSignal", HeaderFile="MCU_Input_Signals.h", DefinitionFile="MCU_Input_Signals.c", DataType="single", InitialValue="0")  % Ib的offset值
M_SelfCheck_IbPhaseCurrOffsetFault_u8 = myPackage.Signal(DoubleProperty=0, Int32Property=int32(0), LogicalProperty=false, OnOffCharProperty="off", ColorCharProperty="red", StorageClass="YS_SelectRAMSignal", HeaderFile="MCU_Input_Signals.h", DefinitionFile="MCU_Input_Signals.c", DataType="uint8", InitialValue="0")  % Ib电流offset故障标志
M_SelfCheck_IbStateOfOffsetcal_u8 = myPackage.Signal(DoubleProperty=0, Int32Property=int32(0), LogicalProperty=false, OnOffCharProperty="off", ColorCharProperty="red", StorageClass="YS_SelectRAMSignal", HeaderFile="MCU_Input_Signals.h", DefinitionFile="MCU_Input_Signals.c", DataType="uint8", InitialValue="0")  % offset计算是否完成
M_SelfCheck_IcFlgOfEffectiveOffset_u8 = myPackage.Signal(DoubleProperty=0, Int32Property=int32(0), LogicalProperty=false, OnOffCharProperty="off", ColorCharProperty="red", StorageClass="YS_SelectRAMSignal", HeaderFile="MCU_Input_Signals.h", DefinitionFile="MCU_Input_Signals.c", DataType="uint8", InitialValue="2")  % offset值的有效性，1有效，0超限
M_SelfCheck_IcNoOff_u16 = myPackage.Signal(DoubleProperty=0, Int32Property=int32(0), LogicalProperty=false, OnOffCharProperty="off", ColorCharProperty="red", StorageClass="YS_SelectRAMSignal", HeaderFile="MCU_Input_Signals.h", DefinitionFile="MCU_Input_Signals.c", DataType="uint16", InitialValue="2048")
M_SelfCheck_IcOffset_f32 = myPackage.Signal(DoubleProperty=0, Int32Property=int32(0), LogicalProperty=false, OnOffCharProperty="off", ColorCharProperty="red", StorageClass="YS_SelectRAMSignal", HeaderFile="MCU_Input_Signals.h", DefinitionFile="MCU_Input_Signals.c", DataType="single", InitialValue="0")  % Ic的offset值
M_SelfCheck_IcPhaseCurrOffsetFault_u8 = myPackage.Signal(DoubleProperty=0, Int32Property=int32(0), LogicalProperty=false, OnOffCharProperty="off", ColorCharProperty="red", StorageClass="YS_SelectRAMSignal", HeaderFile="MCU_Input_Signals.h", DefinitionFile="MCU_Input_Signals.c", DataType="uint8", InitialValue="0")  % Ic电流offset故障标志
M_SelfCheck_IcStateOfOffsetcal_u8 = myPackage.Signal(DoubleProperty=0, Int32Property=int32(0), LogicalProperty=false, OnOffCharProperty="off", ColorCharProperty="red", StorageClass="YS_SelectRAMSignal", HeaderFile="MCU_Input_Signals.h", DefinitionFile="MCU_Input_Signals.c", DataType="uint8", InitialValue="0")  % offset计算是否完成
M_SelfCheck_OffsetCalOverFlg_u8 = myPackage.Signal(DoubleProperty=0, Int32Property=int32(0), LogicalProperty=false, OnOffCharProperty="off", ColorCharProperty="red", StorageClass="YS_SelectRAMSignal", HeaderFile="MCU_Input_Signals.h", DefinitionFile="MCU_Input_Signals.c", DataType="uint8", InitialValue="0")  % 三相电流offset计算完成标志
M_SelfCheck_PhaseCurrOffsetFault_u8 = myPackage.Signal(DoubleProperty=0, Int32Property=int32(0), LogicalProperty=false, OnOffCharProperty="off", ColorCharProperty="red", StorageClass="YS_SelectRAMSignal", HeaderFile="MCU_Input_Signals.h", DefinitionFile="MCU_Input_Signals.c", DataType="uint8", InitialValue="0")  % 三相电流offset故障标志
M_SelfCheck_PowerOnEnFlg_u8 = myPackage.Signal(DoubleProperty=0, Int32Property=int32(0), LogicalProperty=false, OnOffCharProperty="off", ColorCharProperty="red", StorageClass="YS_SelectRAMSignal", HeaderFile="MCU_Input_Signals.h", DefinitionFile="MCU_Input_Signals.c", DataType="uint8", InitialValue="0")
M_SelfCheck_StandbyEnFlg_u8 = myPackage.Signal(DoubleProperty=0, Int32Property=int32(0), LogicalProperty=false, OnOffCharProperty="off", ColorCharProperty="red", StorageClass="YS_SelectRAMSignal", HeaderFile="MCU_Input_Signals.h", DefinitionFile="MCU_Input_Signals.c", DataType="uint8", InitialValue="0")
M_SelfChek_IaSensorFault_u8 = myPackage.Signal(DoubleProperty=0, Int32Property=int32(0), LogicalProperty=false, OnOffCharProperty="off", ColorCharProperty="red", StorageClass="YS_SelectRAMSignal", HeaderFile="MCU_Input_Signals.h", DefinitionFile="MCU_Input_Signals.c", DataType="uint8", InitialValue="0")
M_SelfChek_IbSensorFault_u8 = myPackage.Signal(DoubleProperty=0, Int32Property=int32(0), LogicalProperty=false, OnOffCharProperty="off", ColorCharProperty="red", StorageClass="YS_SelectRAMSignal", HeaderFile="MCU_Input_Signals.h", DefinitionFile="MCU_Input_Signals.c", DataType="uint8", InitialValue="0")
M_SelfChek_IcSensorFault_u8 = myPackage.Signal(DoubleProperty=0, Int32Property=int32(0), LogicalProperty=false, OnOffCharProperty="off", ColorCharProperty="red", StorageClass="YS_SelectRAMSignal", HeaderFile="MCU_Input_Signals.h", DefinitionFile="MCU_Input_Signals.c", DataType="uint8", InitialValue="0")
M_Selfcheck_EnFlg_u8 = myPackage.Signal(DoubleProperty=0, Int32Property=int32(0), LogicalProperty=false, OnOffCharProperty="off", ColorCharProperty="red", StorageClass="YS_SelectRAMSignal", HeaderFile="MCU_Input_Signals.h", DefinitionFile="MCU_Input_Signals.c", DataType="uint8", InitialValue="0")
M_Selfcheck_IgbtWorkEnFlg_u8 = myPackage.Signal(DoubleProperty=0, Int32Property=int32(0), LogicalProperty=false, OnOffCharProperty="off", ColorCharProperty="red", StorageClass="YS_SelectRAMSignal", HeaderFile="MCU_Input_Signals.h", DefinitionFile="MCU_Input_Signals.c", DataType="uint8", InitialValue="0")
M_Selfcheck_SpeedEnFlg_u8 = myPackage.Signal(DoubleProperty=0, Int32Property=int32(0), LogicalProperty=false, OnOffCharProperty="off", ColorCharProperty="red", StorageClass="YS_SelectRAMSignal", HeaderFile="MCU_Input_Signals.h", DefinitionFile="MCU_Input_Signals.c", DataType="uint8", InitialValue="0")
M_SystemFault_TZFault_u16 = myPackage.Signal(DoubleProperty=0, Int32Property=int32(0), LogicalProperty=false, OnOffCharProperty="off", ColorCharProperty="red", StorageClass="YS_SelectRAMSignal", HeaderFile="MCU_Input_Signals.h", DefinitionFile="MCU_Input_Signals.c", DataType="uint16", InitialValue="0")
SinAmp = myPackage.Signal(DoubleProperty=0, Int32Property=int32(0), LogicalProperty=false, OnOffCharProperty="off", ColorCharProperty="red", StorageClass="YS_SelectRAMSignal", HeaderFile="MCU_Input_Signals.h", DefinitionFile="MCU_Input_Signals.c", DataType="uint16")
SinAverage = myPackage.Signal(DoubleProperty=0, Int32Property=int32(0), LogicalProperty=false, OnOffCharProperty="off", ColorCharProperty="red", StorageClass="YS_SelectRAMSignal", HeaderFile="MCU_Input_Signals.h", DefinitionFile="MCU_Input_Signals.c", DataType="single")
SinAvg = myPackage.Signal(DoubleProperty=0, Int32Property=int32(0), LogicalProperty=false, OnOffCharProperty="off", ColorCharProperty="red", StorageClass="YS_SelectRAMSignal", HeaderFile="MCU_Input_Signals.h", DefinitionFile="MCU_Input_Signals.c", DataType="uint16")
C_Rotate_RotateBits_u8 = myPackage.Parameter(12, DoubleProperty=0, Int32Property=int32(0), LogicalProperty=false, OnOffCharProperty="off", ColorCharProperty="red", StorageClass="YS_SelectRAMPara", HeaderFile="MCU_Input_Paras.h", DefinitionFile="MCU_Input_Paras.c", DataType="uint8")