% Simulink data dictionary MCU_PWMPrdChg_Sldd.sldd
% references PublicParameters.sldd
% references MCU_ParamCfg_Sldd_objects.sldd

C_PWMPrdChg_PwmDefLimit_u16 = myPackage.Parameter(6000, DoubleProperty=0, Int32Property=int32(0), LogicalProperty=false, OnOffCharProperty="off", ColorCharProperty="red", StorageClass="YS_SelectRAMPara", HeaderFile="MCU_PWMPrdChg_Params.h", DefinitionFile="MCU_PWMPrdChg_Params.c", DataType="uint16")
C_PWMPrdChg_PwmHighLimit_u16 = myPackage.Parameter(14000, DoubleProperty=0, Int32Property=int32(0), LogicalProperty=false, OnOffCharProperty="off", ColorCharProperty="red", StorageClass="YS_SelectRAMPara", HeaderFile="MCU_PWMPrdChg_Params.h", DefinitionFile="MCU_PWMPrdChg_Params.c", DataType="uint16")
C_PWMPrdChg_PwmLowLimit_u16 = myPackage.Parameter(1000, DoubleProperty=0, Int32Property=int32(0), LogicalProperty=false, OnOffCharProperty="off", ColorCharProperty="red", StorageClass="YS_SelectRAMPara", HeaderFile="MCU_PWMPrdChg_Params.h", DefinitionFile="MCU_PWMPrdChg_Params.c", DataType="uint16")
M_PwmPrdChg_Flg_u8 = myPackage.Signal(DoubleProperty=0, Int32Property=int32(0), LogicalProperty=false, OnOffCharProperty="off", ColorCharProperty="red", StorageClass="YS_SelectRAMSignal", HeaderFile="MCU_PWMPrdChg_Signals.h", DefinitionFile="MCU_PWMPrdChg_Signals.c", DataType="uint8", InitialValue="0")
M_PwmPrdChg_CurrPwmHz_u16 = myPackage.Signal(DoubleProperty=0, Int32Property=int32(0), LogicalProperty=false, OnOffCharProperty="off", ColorCharProperty="red", StorageClass="YS_SelectRAMSignal", HeaderFile="MCU_PWMPrdChg_Signals.h", DefinitionFile="MCU_PWMPrdChg_Signals.c", DataType="uint16")
M_PwmPrdChg_OldPwmHz_u16 = myPackage.Signal(DoubleProperty=0, Int32Property=int32(0), LogicalProperty=false, OnOffCharProperty="off", ColorCharProperty="red", StorageClass="YS_SelectRAMSignal", HeaderFile="MCU_PWMPrdChg_Signals.h", DefinitionFile="MCU_PWMPrdChg_Signals.c", DataType="uint16")

PwmPrdChgBus = Simulink.Bus(HeaderFile="MCU_PWMPrdChg_Signals.h")
  PWMHighHz: uint16
  PWMMidHz: uint16
  PWMLowHz: uint16
  PWMLockRotor: uint16
  SpeedLow: single
  SpeedHigh: single
  Cont2msLow: single
  Cont4msLow: single
  Cont2msMid: single
  Cont4msMid: single
  Cont2msHigh: single
  Cont4msHigh: single
  Cont2msLockRotor: single
  Cont4msLockRotor: single
  Cont2ms: single
  Cont4ms: single
  U16Cont2ms: uint16
  U16Cont4ms: single
  ContRate2ms: uint16
  ContRate4ms: single
  SpeedCoffe2ms: single
  SpeedCoffe4ms: single
  PWMPrdChgEn: uint16

M_PwmPrdChg_En_u8 = myPackage.Signal(DoubleProperty=0, Int32Property=int32(0), LogicalProperty=false, OnOffCharProperty="off", ColorCharProperty="red", StorageClass="YS_SelectRAMSignal", HeaderFile="MCU_PWMPrdChg_Signals.h", DefinitionFile="MCU_PWMPrdChg_Signals.c", DataType="uint8")
M_PwmPrdChg_Cont2ms_f32 = myPackage.Signal(DoubleProperty=0, Int32Property=int32(0), LogicalProperty=false, OnOffCharProperty="off", ColorCharProperty="red", StorageClass="YS_SelectRAMSignal", HeaderFile="MCU_PWMPrdChg_Signals.h", DefinitionFile="MCU_PWMPrdChg_Signals.c", DataType="single")
M_PwmPrdChg_Cont4ms_f32 = myPackage.Signal(DoubleProperty=0, Int32Property=int32(0), LogicalProperty=false, OnOffCharProperty="off", ColorCharProperty="red", StorageClass="YS_SelectRAMSignal", HeaderFile="MCU_PWMPrdChg_Signals.h", DefinitionFile="MCU_PWMPrdChg_Signals.c", DataType="single")
M_PwmPedChg_PwmStateInit_u8 = myPackage.Signal(DoubleProperty=0, Int32Property=int32(0), LogicalProperty=false, OnOffCharProperty="off", ColorCharProperty="red", StorageClass="YS_SelectRAMSignal", HeaderFile="MCU_PWMPrdChg_Signals.h", DefinitionFile="MCU_PWMPrdChg_Signals.c", DataType="uint8")
M_PwmPedChg_ContRate2ms_f32 = myPackage.Signal(DoubleProperty=0, Int32Property=int32(0), LogicalProperty=false, OnOffCharProperty="off", ColorCharProperty="red", StorageClass="YS_SelectRAMSignal", HeaderFile="MCU_PWMPrdChg_Signals.h", DefinitionFile="MCU_PWMPrdChg_Signals.c", DataType="single")
M_PwmPedChg_ContRate4ms_f32 = myPackage.Signal(DoubleProperty=0, Int32Property=int32(0), LogicalProperty=false, OnOffCharProperty="off", ColorCharProperty="red", StorageClass="YS_SelectRAMSignal", HeaderFile="MCU_PWMPrdChg_Signals.h", DefinitionFile="MCU_PWMPrdChg_Signals.c", DataType="single")
M_PwmPedChg_u16Cont2ms_u16 = myPackage.Signal(DoubleProperty=0, Int32Property=int32(0), LogicalProperty=false, OnOffCharProperty="off", ColorCharProperty="red", StorageClass="YS_SelectRAMSignal", HeaderFile="MCU_PWMPrdChg_Signals.h", DefinitionFile="MCU_PWMPrdChg_Signals.c", DataType="uint16")
M_PwmPedChg_u16Cont4ms_u16 = myPackage.Signal(DoubleProperty=0, Int32Property=int32(0), LogicalProperty=false, OnOffCharProperty="off", ColorCharProperty="red", StorageClass="YS_SelectRAMSignal", HeaderFile="MCU_PWMPrdChg_Signals.h", DefinitionFile="MCU_PWMPrdChg_Signals.c", DataType="uint16")
M_PwmPedChg_PwmPrdCoffe_f32 = myPackage.Signal(DoubleProperty=0, Int32Property=int32(0), LogicalProperty=false, OnOffCharProperty="off", ColorCharProperty="red", StorageClass="YS_SelectRAMSignal", HeaderFile="MCU_PWMPrdChg_Signals.h", DefinitionFile="MCU_PWMPrdChg_Signals.c", DataType="single")
M_PwmPedChg_PwmPrdRegH_u16 = myPackage.Signal(DoubleProperty=0, Int32Property=int32(0), LogicalProperty=false, OnOffCharProperty="off", ColorCharProperty="red", StorageClass="YS_SelectRAMSignal", HeaderFile="MCU_PWMPrdChg_Signals.h", DefinitionFile="MCU_PWMPrdChg_Signals.c", DataType="uint16")
M_PwmPedChg_PwmPrdReg_u16 = myPackage.Signal(DoubleProperty=0, Int32Property=int32(0), LogicalProperty=false, OnOffCharProperty="off", ColorCharProperty="red", StorageClass="YS_SelectRAMSignal", HeaderFile="MCU_PWMPrdChg_Signals.h", DefinitionFile="MCU_PWMPrdChg_Signals.c", DataType="uint16")
M_PwmPedChg_PwmPrd_f32 = myPackage.Signal(DoubleProperty=0, Int32Property=int32(0), LogicalProperty=false, OnOffCharProperty="off", ColorCharProperty="red", StorageClass="YS_SelectRAMSignal", HeaderFile="MCU_PWMPrdChg_Signals.h", DefinitionFile="MCU_PWMPrdChg_Signals.c", DataType="single")
M_PwmPedChg_PwmPrdchgCoffe_f32 = myPackage.Signal(DoubleProperty=0, Int32Property=int32(0), LogicalProperty=false, OnOffCharProperty="off", ColorCharProperty="red", StorageClass="YS_SelectRAMSignal", HeaderFile="MCU_PWMPrdChg_Signals.h", DefinitionFile="MCU_PWMPrdChg_Signals.c", DataType="single")