% Simulink data dictionary Copy_of_MCU_ParamCfg_Sldd_objects.sldd

ParamCfg_AccDefault_u16 = myPackage.Parameter(0, DoubleProperty=0, Int32Property=int32(0), LogicalProperty=false, OnOffCharProperty="off", ColorCharProperty="red", StorageClass="YS_SelectRAMPara", HeaderFile="MCU_ParamCfg_Params.h", DefinitionFile="MCU_ParamCfg_Params.c", DataType="uint16")  % 油门初始值
ParamCfg_AccelerType_u16 = myPackage.Parameter(0, DoubleProperty=0, Int32Property=int32(0), LogicalProperty=false, OnOffCharProperty="off", ColorCharProperty="red", StorageClass="YS_SelectRAMPara", HeaderFile="MCU_ParamCfg_Params.h", DefinitionFile="MCU_ParamCfg_Params.c", DataType="uint16")  % 油门类型 0单电压 1单电压+数字 2双电压 3开关量
ParamCfg_AcePosFault_u16 = myPackage.Parameter(160, DoubleProperty=0, Int32Property=int32(0), LogicalProperty=false, OnOffCharProperty="off", ColorCharProperty="red", StorageClass="YS_SelectRAMPara", HeaderFile="MCU_ParamCfg_Params.h", DefinitionFile="MCU_ParamCfg_Params.c", DataType="uint16")  % 旋变或者光编两次采样最大偏差
ParamCfg_AceValueDefault_u16 = myPackage.Parameter(50, DoubleProperty=0, Int32Property=int32(0), LogicalProperty=false, OnOffCharProperty="off", ColorCharProperty="red", StorageClass="YS_SelectRAMPara", HeaderFile="MCU_ParamCfg_Params.h", DefinitionFile="MCU_ParamCfg_Params.c", DataType="uint16")  % 加速度过大瞬时值故障点
ParamCfg_ActdischargeCur_u16 = myPackage.Parameter(150, DoubleProperty=0, Int32Property=int32(0), LogicalProperty=false, OnOffCharProperty="off", ColorCharProperty="red", StorageClass="YS_SelectRAMPara", HeaderFile="MCU_ParamCfg_Params.h", DefinitionFile="MCU_ParamCfg_Params.c", DataType="uint16")  % 主动放电电流 0.01
ParamCfg_AdAcc1K_u16 = myPackage.Parameter(1221, DoubleProperty=0, Int32Property=int32(0), LogicalProperty=false, OnOffCharProperty="off", ColorCharProperty="red", StorageClass="YS_SelectRAMPara", HeaderFile="MCU_ParamCfg_Params.h", DefinitionFile="MCU_ParamCfg_Params.c", DataType="uint16")  % 油门1计算系数 0.000001
ParamCfg_AdAcc2K_u16 = myPackage.Parameter(1221, DoubleProperty=0, Int32Property=int32(0), LogicalProperty=false, OnOffCharProperty="off", ColorCharProperty="red", StorageClass="YS_SelectRAMPara", HeaderFile="MCU_ParamCfg_Params.h", DefinitionFile="MCU_ParamCfg_Params.c", DataType="uint16")  % 油门2计算系数 0.000001
ParamCfg_AdBrakeK_u16 = myPackage.Parameter(1221, DoubleProperty=0, Int32Property=int32(0), LogicalProperty=false, OnOffCharProperty="off", ColorCharProperty="red", StorageClass="YS_SelectRAMPara", HeaderFile="MCU_ParamCfg_Params.h", DefinitionFile="MCU_ParamCfg_Params.c", DataType="uint16")  % 刹车计算比例系数 0.000001
ParamCfg_AdIaK_u16 = myPackage.Parameter(19094, DoubleProperty=0, Int32Property=int32(0), LogicalProperty=false, OnOffCharProperty="off", ColorCharProperty="red", StorageClass="YS_SelectRAMPara", HeaderFile="MCU_ParamCfg_Params.h", DefinitionFile="MCU_ParamCfg_Params.c", DataType="uint16")  % 29000 // A相电流计算系数 0.00001
ParamCfg_AdIbK_u16 = myPackage.Parameter(19094, DoubleProperty=0, Int32Property=int32(0), LogicalProperty=false, OnOffCharProperty="off", ColorCharProperty="red", StorageClass="YS_SelectRAMPara", HeaderFile="MCU_ParamCfg_Params.h", DefinitionFile="MCU_ParamCfg_Params.c", DataType="uint16")  % 29000 // B相电流计算系数 0.00001
ParamCfg_AdIcK_u16 = myPackage.Parameter(19094, DoubleProperty=0, Int32Property=int32(0), LogicalProperty=false, OnOffCharProperty="off", ColorCharProperty="red", StorageClass="YS_SelectRAMPara", HeaderFile="MCU_ParamCfg_Params.h", DefinitionFile="MCU_ParamCfg_Params.c", DataType="uint16")  % 29000 // C相电流计算系数 0.00001
ParamCfg_AdKeyK_u16 = myPackage.Parameter(4606, DoubleProperty=0, Int32Property=int32(0), LogicalProperty=false, OnOffCharProperty="off", ColorCharProperty="red", StorageClass="YS_SelectRAMPara", HeaderFile="MCU_ParamCfg_Params.h", DefinitionFile="MCU_ParamCfg_Params.c", DataType="uint16")  % 电门锁计算比例系数0.000001
ParamCfg_AdP12vK_u16 = myPackage.Parameter(4394, DoubleProperty=0, Int32Property=int32(0), LogicalProperty=false, OnOffCharProperty="off", ColorCharProperty="red", StorageClass="YS_SelectRAMPara", HeaderFile="MCU_ParamCfg_Params.h", DefinitionFile="MCU_ParamCfg_Params.c", DataType="uint16")  % 12V电压计算比例系数 0.000001
ParamCfg_AdP15vK_u16 = myPackage.Parameter(4394, DoubleProperty=0, Int32Property=int32(0), LogicalProperty=false, OnOffCharProperty="off", ColorCharProperty="red", StorageClass="YS_SelectRAMPara", HeaderFile="MCU_ParamCfg_Params.h", DefinitionFile="MCU_ParamCfg_Params.c", DataType="uint16")  % 15V电压计算比例系数 0.000001
ParamCfg_AdP5vK_u16 = myPackage.Parameter(1282, DoubleProperty=0, Int32Property=int32(0), LogicalProperty=false, OnOffCharProperty="off", ColorCharProperty="red", StorageClass="YS_SelectRAMPara", HeaderFile="MCU_ParamCfg_Params.h", DefinitionFile="MCU_ParamCfg_Params.c", DataType="uint16")  % 5V电压计算比例系数 0.000001
ParamCfg_AdUdcK_u16 = myPackage.Parameter(4606, DoubleProperty=0, Int32Property=int32(0), LogicalProperty=false, OnOffCharProperty="off", ColorCharProperty="red", StorageClass="YS_SelectRAMPara", HeaderFile="MCU_ParamCfg_Params.h", DefinitionFile="MCU_ParamCfg_Params.c", DataType="uint16")  % 母线电压计算系数 0.00001
ParamCfg_AdVonK_u16 = myPackage.Parameter(1445, DoubleProperty=0, Int32Property=int32(0), LogicalProperty=false, OnOffCharProperty="off", ColorCharProperty="red", StorageClass="YS_SelectRAMPara", HeaderFile="MCU_ParamCfg_Params.h", DefinitionFile="MCU_ParamCfg_Params.c", DataType="uint16")  % 中性点电压参数系数0.000001
ParamCfg_Anpcmode_u16 = myPackage.Parameter(2, DoubleProperty=0, Int32Property=int32(0), LogicalProperty=false, OnOffCharProperty="off", ColorCharProperty="red", StorageClass="YS_SelectRAMPara", HeaderFile="MCU_ParamCfg_Params.h", DefinitionFile="MCU_ParamCfg_Params.c", DataType="uint16")  % 三电平模式选择
ParamCfg_AntijerkEnable_u16 = myPackage.Parameter(0, DoubleProperty=0, Int32Property=int32(0), LogicalProperty=false, OnOffCharProperty="off", ColorCharProperty="red", StorageClass="YS_SelectRAMPara", HeaderFile="MCU_ParamCfg_Params.h", DefinitionFile="MCU_ParamCfg_Params.c", DataType="uint16")  % antijerk使能
ParamCfg_Avgcnt_u16 = myPackage.Parameter(8000, DoubleProperty=0, Int32Property=int32(0), LogicalProperty=false, OnOffCharProperty="off", ColorCharProperty="red", StorageClass="YS_SelectRAMPara", HeaderFile="MCU_ParamCfg_Params.h", DefinitionFile="MCU_ParamCfg_Params.c", DataType="uint16")  % 校验次数
ParamCfg_BackGearRpml_u16 = myPackage.Parameter(0, DoubleProperty=0, Int32Property=int32(0), LogicalProperty=false, OnOffCharProperty="off", ColorCharProperty="red", StorageClass="YS_SelectRAMPara", HeaderFile="MCU_ParamCfg_Params.h", DefinitionFile="MCU_ParamCfg_Params.c", DataType="uint16")  % 后退档换挡速度点
ParamCfg_BackSpeedDef_u16 = myPackage.Parameter(0, DoubleProperty=0, Int32Property=int32(0), LogicalProperty=false, OnOffCharProperty="off", ColorCharProperty="red", StorageClass="YS_SelectRAMPara", HeaderFile="MCU_ParamCfg_Params.h", DefinitionFile="MCU_ParamCfg_Params.c", DataType="uint16")  % 后退挡速度环默认值
ParamCfg_BaseCur_u16 = myPackage.Parameter(50, DoubleProperty=0, Int32Property=int32(0), LogicalProperty=false, OnOffCharProperty="off", ColorCharProperty="red", StorageClass="YS_SelectRAMPara", HeaderFile="MCU_ParamCfg_Params.h", DefinitionFile="MCU_ParamCfg_Params.c", DataType="uint16")  % 额定输出电流
ParamCfg_BaseFreq_u16 = myPackage.Parameter(150, DoubleProperty=0, Int32Property=int32(0), LogicalProperty=false, OnOffCharProperty="off", ColorCharProperty="red", StorageClass="YS_SelectRAMPara", HeaderFile="MCU_ParamCfg_Params.h", DefinitionFile="MCU_ParamCfg_Params.c", DataType="uint16")  % 电机基频50hz或100hz
ParamCfg_BaseSpeed_u16 = myPackage.Parameter(3000, DoubleProperty=0, Int32Property=int32(0), LogicalProperty=false, OnOffCharProperty="off", ColorCharProperty="red", StorageClass="YS_SelectRAMPara", HeaderFile="MCU_ParamCfg_Params.h", DefinitionFile="MCU_ParamCfg_Params.c", DataType="uint16")  % 基准速度
ParamCfg_BaseTorque_u16 = myPackage.Parameter(13, DoubleProperty=0, Int32Property=int32(0), LogicalProperty=false, OnOffCharProperty="off", ColorCharProperty="red", StorageClass="YS_SelectRAMPara", HeaderFile="MCU_ParamCfg_Params.h", DefinitionFile="MCU_ParamCfg_Params.c", DataType="uint16")  % 额定扭矩 0.01
ParamCfg_BaseUdc_u16 = myPackage.Parameter(55, DoubleProperty=0, Int32Property=int32(0), LogicalProperty=false, OnOffCharProperty="off", ColorCharProperty="red", StorageClass="YS_SelectRAMPara", HeaderFile="MCU_ParamCfg_Params.h", DefinitionFile="MCU_ParamCfg_Params.c", DataType="uint16")  % 基准电压
ParamCfg_BrakeGearEnble_u16 = myPackage.Parameter(0, DoubleProperty=0, Int32Property=int32(0), LogicalProperty=false, OnOffCharProperty="off", ColorCharProperty="red", StorageClass="YS_SelectRAMPara", HeaderFile="MCU_ParamCfg_Params.h", DefinitionFile="MCU_ParamCfg_Params.c", DataType="uint16")  % 刹车换挡使能 (0430为统一传统车)
ParamCfg_BrakeType_u16 = myPackage.Parameter(0, DoubleProperty=0, Int32Property=int32(0), LogicalProperty=false, OnOffCharProperty="off", ColorCharProperty="red", StorageClass="YS_SelectRAMPara", HeaderFile="MCU_ParamCfg_Params.h", DefinitionFile="MCU_ParamCfg_Params.c", DataType="uint16")  % 刹车类型 0单电压 1单电压+数字 2双电压 3开关量
ParamCfg_BrkDepth_u16 = myPackage.Parameter(0, DoubleProperty=0, Int32Property=int32(0), LogicalProperty=false, OnOffCharProperty="off", ColorCharProperty="red", StorageClass="YS_SelectRAMPara", HeaderFile="MCU_ParamCfg_Params.h", DefinitionFile="MCU_ParamCfg_Params.c", DataType="uint16")  % 刹车深度
ParamCfg_ChangeRpm_u16 = myPackage.Parameter(100, DoubleProperty=0, Int32Property=int32(0), LogicalProperty=false, OnOffCharProperty="off", ColorCharProperty="red", StorageClass="YS_SelectRAMPara", HeaderFile="MCU_ParamCfg_Params.h", DefinitionFile="MCU_ParamCfg_Params.c", DataType="uint16")  % pos_delt切换速度点
ParamCfg_ChargeEnable_u16 = myPackage.Parameter(1, DoubleProperty=0, Int32Property=int32(0), LogicalProperty=false, OnOffCharProperty="off", ColorCharProperty="red", StorageClass="YS_SelectRAMPara", HeaderFile="MCU_ParamCfg_Params.h", DefinitionFile="MCU_ParamCfg_Params.c", DataType="uint16")  % 预充是否使能
ParamCfg_CmdStatusRsv5_u16 = myPackage.Parameter(0, DoubleProperty=0, Int32Property=int32(0), LogicalProperty=false, OnOffCharProperty="off", ColorCharProperty="red", StorageClass="YS_SelectRAMPara", HeaderFile="MCU_ParamCfg_Params.h", DefinitionFile="MCU_ParamCfg_Params.c", DataType="uint16")  % 保留
ParamCfg_CommandSource_u16 = myPackage.Parameter(2, DoubleProperty=0, Int32Property=int32(0), LogicalProperty=false, OnOffCharProperty="off", ColorCharProperty="red", StorageClass="YS_SelectRAMPara", HeaderFile="MCU_ParamCfg_Params.h", DefinitionFile="MCU_ParamCfg_Params.c", DataType="uint16")  % 指令源 0：整车 1：台架 2：模拟量
ParamCfg_CompanyCode_u16 = myPackage.Parameter(0, DoubleProperty=0, Int32Property=int32(0), LogicalProperty=false, OnOffCharProperty="off", ColorCharProperty="red", StorageClass="YS_SelectRAMPara", HeaderFile="MCU_ParamCfg_Params.h", DefinitionFile="MCU_ParamCfg_Params.c", DataType="uint16")  % 公司代码
ParamCfg_ConfigueData_u16 = myPackage.Parameter(0, DoubleProperty=0, Int32Property=int32(0), LogicalProperty=false, OnOffCharProperty="off", ColorCharProperty="red", StorageClass="YS_SelectRAMPara", HeaderFile="MCU_ParamCfg_Params.h", DefinitionFile="MCU_ParamCfg_Params.c", DataType="uint16")  % 配置时间
ParamCfg_ConfigueStart_u16 = myPackage.Parameter(360, DoubleProperty=0, Int32Property=int32(0), LogicalProperty=false, OnOffCharProperty="off", ColorCharProperty="red", StorageClass="YS_SelectRAMPara", HeaderFile="MCU_ParamCfg_Params.h", DefinitionFile="MCU_ParamCfg_Signals.c", DataType="uint16")  % 配置帧头
ParamCfg_ConfigueValid_u16 = myPackage.Parameter(0, DoubleProperty=0, Int32Property=int32(0), LogicalProperty=false, OnOffCharProperty="off", ColorCharProperty="red", StorageClass="YS_SelectRAMPara", HeaderFile="MCU_ParamCfg_Params.h", DefinitionFile="MCU_ParamCfg_Signals.c", DataType="uint16")  % 配置有效性
ParamCfg_CoolWindWaterChange_u16 = myPackage.Parameter(1, DoubleProperty=0, Int32Property=int32(0), LogicalProperty=false, OnOffCharProperty="off", ColorCharProperty="red", StorageClass="YS_SelectRAMPara", HeaderFile="MCU_ParamCfg_Params.h", DefinitionFile="MCU_ParamCfg_Params.c", DataType="uint16")  % 风冷、水冷选择 0：水冷；1：风冷
ParamCfg_Cosamp_u16 = myPackage.Parameter(12935, DoubleProperty=0, Int32Property=int32(0), LogicalProperty=false, OnOffCharProperty="off", ColorCharProperty="red", StorageClass="YS_SelectRAMPara", HeaderFile="MCU_ParamCfg_Params.h", DefinitionFile="MCU_ParamCfg_Params.c", DataType="uint16")  % cos幅值偏置0.1f
ParamCfg_Cosavg_u16 = myPackage.Parameter(20630, DoubleProperty=0, Int32Property=int32(0), LogicalProperty=false, OnOffCharProperty="off", ColorCharProperty="red", StorageClass="YS_SelectRAMPara", HeaderFile="MCU_ParamCfg_Params.h", DefinitionFile="MCU_ParamCfg_Params.c", DataType="uint16")  % cos平均值偏置0.1f
ParamCfg_Ctlautocaren_u16 = myPackage.Parameter(0, DoubleProperty=0, Int32Property=int32(0), LogicalProperty=false, OnOffCharProperty="off", ColorCharProperty="red", StorageClass="YS_SelectRAMPara", HeaderFile="MCU_ParamCfg_Params.h", DefinitionFile="MCU_ParamCfg_Params.c", DataType="uint16")  % 行车控制使能
ParamCfg_CurrentPolarCoordinates_u16 = myPackage.Parameter(0, DoubleProperty=0, Int32Property=int32(0), LogicalProperty=false, OnOffCharProperty="off", ColorCharProperty="red", StorageClass="YS_SelectRAMPara", HeaderFile="MCU_ParamCfg_Params.h", DefinitionFile="MCU_ParamCfg_Params.c", DataType="uint16")  % 电流极坐标使能
ParamCfg_DboxEnable_u16 = myPackage.Parameter(0, DoubleProperty=0, Int32Property=int32(0), LogicalProperty=false, OnOffCharProperty="off", ColorCharProperty="red", StorageClass="YS_SelectRAMPara", HeaderFile="MCU_ParamCfg_Params.h", DefinitionFile="MCU_ParamCfg_Params.c", DataType="uint16")  % DBOX信号有效
ParamCfg_Drivpowctrlen_u16 = myPackage.Parameter(0, DoubleProperty=0, Int32Property=int32(0), LogicalProperty=false, OnOffCharProperty="off", ColorCharProperty="red", StorageClass="YS_SelectRAMPara", HeaderFile="MCU_ParamCfg_Params.h", DefinitionFile="MCU_ParamCfg_Params.c", DataType="uint16")  % 驱动电源控制是否使能 0：不使能 1 使能
ParamCfg_EepromRecover_u16 = myPackage.Parameter(0, DoubleProperty=0, Int32Property=int32(0), LogicalProperty=false, OnOffCharProperty="off", ColorCharProperty="red", StorageClass="YS_SelectRAMPara", HeaderFile="MCU_ParamCfg_Params.h", DefinitionFile="MCU_ParamCfg_Params.c", DataType="uint16")  % FRAM参数恢复
ParamCfg_EepromStatus_u16 = myPackage.Parameter(0, DoubleProperty=0, Int32Property=int32(0), LogicalProperty=false, OnOffCharProperty="off", ColorCharProperty="red", StorageClass="YS_SelectRAMPara", HeaderFile="MCU_ParamCfg_Params.h", DefinitionFile="MCU_ParamCfg_Params.c", DataType="uint16")  % FRAM读写状态
ParamCfg_EepromWrEn_u16 = myPackage.Parameter(0, DoubleProperty=0, Int32Property=int32(0), LogicalProperty=false, OnOffCharProperty="off", ColorCharProperty="red", StorageClass="YS_SelectRAMPara", HeaderFile="MCU_ParamCfg_Params.h", DefinitionFile="MCU_ParamCfg_Params.c", DataType="uint16")  % FRAM数据写使能
ParamCfg_ElTorqueCutfreq_u16 = myPackage.Parameter(50, DoubleProperty=0, Int32Property=int32(0), LogicalProperty=false, OnOffCharProperty="off", ColorCharProperty="red", StorageClass="YS_SelectRAMPara", HeaderFile="MCU_ParamCfg_Params.h", DefinitionFile="MCU_ParamCfg_Params.c", DataType="uint16")  % 电动滤波截止频率 0.01
ParamCfg_FaultSetRsv0_u16 = myPackage.Parameter(0, DoubleProperty=0, Int32Property=int32(0), LogicalProperty=false, OnOffCharProperty="off", ColorCharProperty="red", StorageClass="YS_SelectRAMPara", HeaderFile="MCU_ParamCfg_Params.h", DefinitionFile="MCU_ParamCfg_Params.c", DataType="uint16")  % 保留
ParamCfg_FaultSetRsv1_u16 = myPackage.Parameter(0, DoubleProperty=0, Int32Property=int32(0), LogicalProperty=false, OnOffCharProperty="off", ColorCharProperty="red", StorageClass="YS_SelectRAMPara", HeaderFile="MCU_ParamCfg_Params.h", DefinitionFile="MCU_ParamCfg_Params.c", DataType="uint16")  % 保留
ParamCfg_FaultSetRsv2_u16 = myPackage.Parameter(0, DoubleProperty=0, Int32Property=int32(0), LogicalProperty=false, OnOffCharProperty="off", ColorCharProperty="red", StorageClass="YS_SelectRAMPara", HeaderFile="MCU_ParamCfg_Params.h", DefinitionFile="MCU_ParamCfg_Params.c", DataType="uint16")  % 保留
ParamCfg_FaultSetRsv3_u16 = myPackage.Parameter(0, DoubleProperty=0, Int32Property=int32(0), LogicalProperty=false, OnOffCharProperty="off", ColorCharProperty="red", StorageClass="YS_SelectRAMPara", HeaderFile="MCU_ParamCfg_Params.h", DefinitionFile="MCU_ParamCfg_Params.c", DataType="uint16")  % 保留
ParamCfg_FaultSetRsv4_u16 = myPackage.Parameter(0, DoubleProperty=0, Int32Property=int32(0), LogicalProperty=false, OnOffCharProperty="off", ColorCharProperty="red", StorageClass="YS_SelectRAMPara", HeaderFile="MCU_ParamCfg_Params.h", DefinitionFile="MCU_ParamCfg_Params.c", DataType="uint16")  % 保留
ParamCfg_FaultSetRsv5_u16 = myPackage.Parameter(0, DoubleProperty=0, Int32Property=int32(0), LogicalProperty=false, OnOffCharProperty="off", ColorCharProperty="red", StorageClass="YS_SelectRAMPara", HeaderFile="MCU_ParamCfg_Params.h", DefinitionFile="MCU_ParamCfg_Params.c", DataType="uint16")  % 保留
ParamCfg_FaultSetRsv6_u16 = myPackage.Parameter(0, DoubleProperty=0, Int32Property=int32(0), LogicalProperty=false, OnOffCharProperty="off", ColorCharProperty="red", StorageClass="YS_SelectRAMPara", HeaderFile="MCU_ParamCfg_Params.h", DefinitionFile="MCU_ParamCfg_Params.c", DataType="uint16")  % 保留
ParamCfg_FaultSetRsv9_u16 = myPackage.Parameter(0, DoubleProperty=0, Int32Property=int32(0), LogicalProperty=false, OnOffCharProperty="off", ColorCharProperty="red", StorageClass="YS_SelectRAMPara", HeaderFile="MCU_ParamCfg_Params.h", DefinitionFile="MCU_ParamCfg_Params.c", DataType="uint16")  % 保留
ParamCfg_ForwGearRpmh_u16 = myPackage.Parameter(0, DoubleProperty=0, Int32Property=int32(0), LogicalProperty=false, OnOffCharProperty="off", ColorCharProperty="red", StorageClass="YS_SelectRAMPara", HeaderFile="MCU_ParamCfg_Params.h", DefinitionFile="MCU_ParamCfg_Params.c", DataType="uint16")  % 前进档换挡速度点
ParamCfg_ForwSpeedDef_u16 = myPackage.Parameter(0, DoubleProperty=0, Int32Property=int32(0), LogicalProperty=false, OnOffCharProperty="off", ColorCharProperty="red", StorageClass="YS_SelectRAMPara", HeaderFile="MCU_ParamCfg_Params.h", DefinitionFile="MCU_ParamCfg_Params.c", DataType="uint16")  % 前进挡速度环默认值
ParamCfg_ForwardNor_u16 = myPackage.Parameter(0, DoubleProperty=0, Int32Property=int32(0), LogicalProperty=false, OnOffCharProperty="off", ColorCharProperty="red", StorageClass="YS_SelectRAMPara", HeaderFile="MCU_ParamCfg_Params.h", DefinitionFile="MCU_ParamCfg_Params.c", DataType="uint16")  % 前进转速为负 0 认为前进转速为负 1 认为前进转速为正39
ParamCfg_GeTorqueCutfreq_u16 = myPackage.Parameter(32, DoubleProperty=0, Int32Property=int32(0), LogicalProperty=false, OnOffCharProperty="off", ColorCharProperty="red", StorageClass="YS_SelectRAMPara", HeaderFile="MCU_ParamCfg_Params.h", DefinitionFile="MCU_ParamCfg_Params.c", DataType="uint16")  % 发电滤波截止频率 0.01
ParamCfg_GearEnable_u16 = myPackage.Parameter(0, DoubleProperty=0, Int32Property=int32(0), LogicalProperty=false, OnOffCharProperty="off", ColorCharProperty="red", StorageClass="YS_SelectRAMPara", HeaderFile="MCU_ParamCfg_Params.h", DefinitionFile="MCU_ParamCfg_Params.c", DataType="uint16")  % 档位是否有效(0:无效、 1:内部采样、2:CAN下发)
ParamCfg_HallRsv5_u16 = myPackage.Parameter(0, DoubleProperty=0, Int32Property=int32(0), LogicalProperty=false, OnOffCharProperty="off", ColorCharProperty="red", StorageClass="YS_SelectRAMPara", HeaderFile="MCU_ParamCfg_Params.h", DefinitionFile="MCU_ParamCfg_Params.c", DataType="uint16")  % 保留
ParamCfg_HallRsv6_u16 = myPackage.Parameter(0, DoubleProperty=0, Int32Property=int32(0), LogicalProperty=false, OnOffCharProperty="off", ColorCharProperty="red", StorageClass="YS_SelectRAMPara", HeaderFile="MCU_ParamCfg_Params.h", DefinitionFile="MCU_ParamCfg_Params.c", DataType="uint16")  % 保留
ParamCfg_HardwareVersion_u16 = myPackage.Parameter(1, DoubleProperty=0, Int32Property=int32(0), LogicalProperty=false, OnOffCharProperty="off", ColorCharProperty="red", StorageClass="YS_SelectRAMPara", HeaderFile="MCU_ParamCfg_Params.h", DefinitionFile="MCU_ParamCfg_Signals.c", DataType="uint16")  % 硬件版本号
ParamCfg_HeatsinkLimitStart_u16 = myPackage.Parameter(85, DoubleProperty=0, Int32Property=int32(0), LogicalProperty=false, OnOffCharProperty="off", ColorCharProperty="red", StorageClass="YS_SelectRAMPara", HeaderFile="MCU_ParamCfg_Params.h", DefinitionFile="MCU_ParamCfg_Params.c", DataType="uint16")  % 散热器降功率起始温度
ParamCfg_HeatsinkLimitStop_u16 = myPackage.Parameter(95, DoubleProperty=0, Int32Property=int32(0), LogicalProperty=false, OnOffCharProperty="off", ColorCharProperty="red", StorageClass="YS_SelectRAMPara", HeaderFile="MCU_ParamCfg_Params.h", DefinitionFile="MCU_ParamCfg_Params.c", DataType="uint16")  % 散热器降功率终止温度
ParamCfg_HfiIdKi_u16 = myPackage.Parameter(20, DoubleProperty=0, Int32Property=int32(0), LogicalProperty=false, OnOffCharProperty="off", ColorCharProperty="red", StorageClass="YS_SelectRAMPara", HeaderFile="MCU_ParamCfg_Params.h", DefinitionFile="MCU_ParamCfg_Params.c", DataType="uint16")  % 高频注入电流Ki
ParamCfg_HfiIdKp_u16 = myPackage.Parameter(100, DoubleProperty=0, Int32Property=int32(0), LogicalProperty=false, OnOffCharProperty="off", ColorCharProperty="red", StorageClass="YS_SelectRAMPara", HeaderFile="MCU_ParamCfg_Params.h", DefinitionFile="MCU_ParamCfg_Params.c", DataType="uint16")  % 高频注入电流Kp
ParamCfg_HighspdPowerhighNeg_u16 = myPackage.Parameter(10, DoubleProperty=0, Int32Property=int32(0), LogicalProperty=false, OnOffCharProperty="off", ColorCharProperty="red", StorageClass="YS_SelectRAMPara", HeaderFile="MCU_ParamCfg_Params.h", DefinitionFile="MCU_ParamCfg_Params.c", DataType="uint16")  % 发电限功率 高power
ParamCfg_HighspdPowerlowNeg_u16 = myPackage.Parameter(10, DoubleProperty=0, Int32Property=int32(0), LogicalProperty=false, OnOffCharProperty="off", ColorCharProperty="red", StorageClass="YS_SelectRAMPara", HeaderFile="MCU_ParamCfg_Params.h", DefinitionFile="MCU_ParamCfg_Params.c", DataType="uint16")  % 发电限功率 低power
ParamCfg_HillHoldTime_u16 = myPackage.Parameter(2500, DoubleProperty=0, Int32Property=int32(0), LogicalProperty=false, OnOffCharProperty="off", ColorCharProperty="red", StorageClass="YS_SelectRAMPara", HeaderFile="MCU_ParamCfg_Params.h", DefinitionFile="MCU_ParamCfg_Params.c", DataType="uint16")  % 大扭矩驻坡时间 2ms *2500 = 5s
ParamCfg_HillholdEnable_u16 = myPackage.Parameter(1, DoubleProperty=0, Int32Property=int32(0), LogicalProperty=false, OnOffCharProperty="off", ColorCharProperty="red", StorageClass="YS_SelectRAMPara", HeaderFile="MCU_ParamCfg_Params.h", DefinitionFile="MCU_ParamCfg_Params.c", DataType="uint16")  % 驻坡功能是否使能
ParamCfg_IaDefValue_u16 = myPackage.Parameter(2048, DoubleProperty=0, Int32Property=int32(0), LogicalProperty=false, OnOffCharProperty="off", ColorCharProperty="red", StorageClass="YS_SelectRAMPara", HeaderFile="MCU_ParamCfg_Params.h", DefinitionFile="MCU_ParamCfg_Params.c", DataType="uint16")  % A相传感器偏置默认值
ParamCfg_IaDownLimt_u16 = myPackage.Parameter(1950, DoubleProperty=0, Int32Property=int32(0), LogicalProperty=false, OnOffCharProperty="off", ColorCharProperty="red", StorageClass="YS_SelectRAMPara", HeaderFile="MCU_ParamCfg_Params.h", DefinitionFile="MCU_ParamCfg_Params.c", DataType="uint16")  % A相传感器最小偏置
ParamCfg_IaUpLimt_u16 = myPackage.Parameter(2150, DoubleProperty=0, Int32Property=int32(0), LogicalProperty=false, OnOffCharProperty="off", ColorCharProperty="red", StorageClass="YS_SelectRAMPara", HeaderFile="MCU_ParamCfg_Params.h", DefinitionFile="MCU_ParamCfg_Params.c", DataType="uint16")  % A相传感器最大偏置
ParamCfg_IbDefValue_u16 = myPackage.Parameter(2048, DoubleProperty=0, Int32Property=int32(0), LogicalProperty=false, OnOffCharProperty="off", ColorCharProperty="red", StorageClass="YS_SelectRAMPara", HeaderFile="MCU_ParamCfg_Params.h", DefinitionFile="MCU_ParamCfg_Params.c", DataType="uint16")  % B相传感器偏置默认值
ParamCfg_IbDownLimt_u16 = myPackage.Parameter(1950, DoubleProperty=0, Int32Property=int32(0), LogicalProperty=false, OnOffCharProperty="off", ColorCharProperty="red", StorageClass="YS_SelectRAMPara", HeaderFile="MCU_ParamCfg_Params.h", DefinitionFile="MCU_ParamCfg_Params.c", DataType="uint16")  % B相感器最小偏置
ParamCfg_IbUpLimt_u16 = myPackage.Parameter(2150, DoubleProperty=0, Int32Property=int32(0), LogicalProperty=false, OnOffCharProperty="off", ColorCharProperty="red", StorageClass="YS_SelectRAMPara", HeaderFile="MCU_ParamCfg_Params.h", DefinitionFile="MCU_ParamCfg_Params.c", DataType="uint16")  % B相传感器最大偏置
ParamCfg_IcDefValue_u16 = myPackage.Parameter(2048, DoubleProperty=0, Int32Property=int32(0), LogicalProperty=false, OnOffCharProperty="off", ColorCharProperty="red", StorageClass="YS_SelectRAMPara", HeaderFile="MCU_ParamCfg_Params.h", DefinitionFile="MCU_ParamCfg_Params.c", DataType="uint16")  % C相传感器偏置默认值
ParamCfg_IcDownLimt_u16 = myPackage.Parameter(1950, DoubleProperty=0, Int32Property=int32(0), LogicalProperty=false, OnOffCharProperty="off", ColorCharProperty="red", StorageClass="YS_SelectRAMPara", HeaderFile="MCU_ParamCfg_Params.h", DefinitionFile="MCU_ParamCfg_Params.c", DataType="uint16")  % C相传感器最小偏置
ParamCfg_IcUpLimt_u16 = myPackage.Parameter(2150, DoubleProperty=0, Int32Property=int32(0), LogicalProperty=false, OnOffCharProperty="off", ColorCharProperty="red", StorageClass="YS_SelectRAMPara", HeaderFile="MCU_ParamCfg_Params.h", DefinitionFile="MCU_ParamCfg_Params.c", DataType="uint16")  % C相传感器最大偏置
ParamCfg_IdKc_u16 = myPackage.Parameter(20, DoubleProperty=0, Int32Property=int32(0), LogicalProperty=false, OnOffCharProperty="off", ColorCharProperty="red", StorageClass="YS_SelectRAMPara", HeaderFile="MCU_ParamCfg_Params.h", DefinitionFile="MCU_ParamCfg_Params.c", DataType="uint16")  % ID的KC值
ParamCfg_IdKd_u16 = myPackage.Parameter(0, DoubleProperty=0, Int32Property=int32(0), LogicalProperty=false, OnOffCharProperty="off", ColorCharProperty="red", StorageClass="YS_SelectRAMPara", HeaderFile="MCU_ParamCfg_Params.h", DefinitionFile="MCU_ParamCfg_Params.c", DataType="uint16")  % ID的KD值
ParamCfg_IdKi_u16 = myPackage.Parameter(100, DoubleProperty=0, Int32Property=int32(0), LogicalProperty=false, OnOffCharProperty="off", ColorCharProperty="red", StorageClass="YS_SelectRAMPara", HeaderFile="MCU_ParamCfg_Params.h", DefinitionFile="MCU_ParamCfg_Params.c", DataType="uint16")  % ID的KI值
ParamCfg_IdKp_u16 = myPackage.Parameter(1000, DoubleProperty=0, Int32Property=int32(0), LogicalProperty=false, OnOffCharProperty="off", ColorCharProperty="red", StorageClass="YS_SelectRAMPara", HeaderFile="MCU_ParamCfg_Params.h", DefinitionFile="MCU_ParamCfg_Params.c", DataType="uint16")  % ID的KP值 系数从0.001
ParamCfg_IdNZc_u16 = myPackage.Parameter(4000, DoubleProperty=0, Int32Property=int32(0), LogicalProperty=false, OnOffCharProperty="off", ColorCharProperty="red", StorageClass="YS_SelectRAMPara", HeaderFile="MCU_ParamCfg_Params.h", DefinitionFile="MCU_ParamCfg_Params.c", DataType="uint16")  % 整车励磁电流 0.01
ParamCfg_IdN_u16 = myPackage.Parameter(4000, DoubleProperty=0, Int32Property=int32(0), LogicalProperty=false, OnOffCharProperty="off", ColorCharProperty="red", StorageClass="YS_SelectRAMPara", HeaderFile="MCU_ParamCfg_Params.h", DefinitionFile="MCU_ParamCfg_Params.c", DataType="uint16")  % 额定励磁电流 0.01
ParamCfg_IdStep1_u16 = myPackage.Parameter(100, DoubleProperty=0, Int32Property=int32(0), LogicalProperty=false, OnOffCharProperty="off", ColorCharProperty="red", StorageClass="YS_SelectRAMPara", HeaderFile="MCU_ParamCfg_Params.h", DefinitionFile="MCU_ParamCfg_Params.c", DataType="uint16")  % 转矩环ID步长1 id递增步进值
ParamCfg_IdStep2_u16 = myPackage.Parameter(3000, DoubleProperty=0, Int32Property=int32(0), LogicalProperty=false, OnOffCharProperty="off", ColorCharProperty="red", StorageClass="YS_SelectRAMPara", HeaderFile="MCU_ParamCfg_Params.h", DefinitionFile="MCU_ParamCfg_Params.c", DataType="uint16")  % 转矩环ID步长2 id递减步进值
ParamCfg_InducRotor_u16 = myPackage.Parameter(644, DoubleProperty=0, Int32Property=int32(0), LogicalProperty=false, OnOffCharProperty="off", ColorCharProperty="red", StorageClass="YS_SelectRAMPara", HeaderFile="MCU_ParamCfg_Params.h", DefinitionFile="MCU_ParamCfg_Params.c", DataType="uint16")  % 转子电感
ParamCfg_InducStator_u16 = myPackage.Parameter(644, DoubleProperty=0, Int32Property=int32(0), LogicalProperty=false, OnOffCharProperty="off", ColorCharProperty="red", StorageClass="YS_SelectRAMPara", HeaderFile="MCU_ParamCfg_Params.h", DefinitionFile="MCU_ParamCfg_Params.c", DataType="uint16")  % 定子电感(未用)
ParamCfg_IphaseLimitStart_u16 = myPackage.Parameter(720, DoubleProperty=0, Int32Property=int32(0), LogicalProperty=false, OnOffCharProperty="off", ColorCharProperty="red", StorageClass="YS_SelectRAMPara", HeaderFile="MCU_ParamCfg_Params.h", DefinitionFile="MCU_ParamCfg_Params.c", DataType="uint16")  % 相电流降功率起始点
ParamCfg_IqKc_u16 = myPackage.Parameter(20, DoubleProperty=0, Int32Property=int32(0), LogicalProperty=false, OnOffCharProperty="off", ColorCharProperty="red", StorageClass="YS_SelectRAMPara", HeaderFile="MCU_ParamCfg_Params.h", DefinitionFile="MCU_ParamCfg_Params.c", DataType="uint16")  % IQ的KC值
ParamCfg_IqKd_u16 = myPackage.Parameter(0, DoubleProperty=0, Int32Property=int32(0), LogicalProperty=false, OnOffCharProperty="off", ColorCharProperty="red", StorageClass="YS_SelectRAMPara", HeaderFile="MCU_ParamCfg_Params.h", DefinitionFile="MCU_ParamCfg_Params.c", DataType="uint16")  % IQ的KD值
ParamCfg_IqKi_u16 = myPackage.Parameter(100, DoubleProperty=0, Int32Property=int32(0), LogicalProperty=false, OnOffCharProperty="off", ColorCharProperty="red", StorageClass="YS_SelectRAMPara", HeaderFile="MCU_ParamCfg_Params.h", DefinitionFile="MCU_ParamCfg_Params.c", DataType="uint16")  % IQ的KI值 系数从0.001
ParamCfg_IqKp_u16 = myPackage.Parameter(1500, DoubleProperty=0, Int32Property=int32(0), LogicalProperty=false, OnOffCharProperty="off", ColorCharProperty="red", StorageClass="YS_SelectRAMPara", HeaderFile="MCU_ParamCfg_Params.h", DefinitionFile="MCU_ParamCfg_Params.c", DataType="uint16")  % IQ的KP值 系数从0.001
ParamCfg_IqMax_u16 = myPackage.Parameter(450, DoubleProperty=0, Int32Property=int32(0), LogicalProperty=false, OnOffCharProperty="off", ColorCharProperty="red", StorageClass="YS_SelectRAMPara", HeaderFile="MCU_ParamCfg_Params.h", DefinitionFile="MCU_ParamCfg_Params.c", DataType="uint16")  % IQ最大电流
ParamCfg_IqMin_u16 = myPackage.Parameter(450, DoubleProperty=0, Int32Property=int32(0), LogicalProperty=false, OnOffCharProperty="off", ColorCharProperty="red", StorageClass="YS_SelectRAMPara", HeaderFile="MCU_ParamCfg_Params.h", DefinitionFile="MCU_ParamCfg_Params.c", DataType="uint16")  % IQ最小电流
ParamCfg_IqStep_u16 = myPackage.Parameter(1000, DoubleProperty=0, Int32Property=int32(0), LogicalProperty=false, OnOffCharProperty="off", ColorCharProperty="red", StorageClass="YS_SelectRAMPara", HeaderFile="MCU_ParamCfg_Params.h", DefinitionFile="MCU_ParamCfg_Params.c", DataType="uint16")  % 转矩环IQ步长
ParamCfg_IsMax_u16 = myPackage.Parameter(500, DoubleProperty=0, Int32Property=int32(0), LogicalProperty=false, OnOffCharProperty="off", ColorCharProperty="red", StorageClass="YS_SelectRAMPara", HeaderFile="MCU_ParamCfg_Params.h", DefinitionFile="MCU_ParamCfg_Params.c", DataType="uint16")  % 峰值电流值
ParamCfg_LowSpeedCoeff_u16 = myPackage.Parameter(400, DoubleProperty=0, Int32Property=int32(0), LogicalProperty=false, OnOffCharProperty="off", ColorCharProperty="red", StorageClass="YS_SelectRAMPara", HeaderFile="MCU_ParamCfg_Params.h", DefinitionFile="MCU_ParamCfg_Params.c", DataType="uint16")  % 堵转转矩进入系数
ParamCfg_LowSpeedDelay_u16 = myPackage.Parameter(150, DoubleProperty=0, Int32Property=int32(0), LogicalProperty=false, OnOffCharProperty="off", ColorCharProperty="red", StorageClass="YS_SelectRAMPara", HeaderFile="MCU_ParamCfg_Params.h", DefinitionFile="MCU_ParamCfg_Params.c", DataType="uint16")  % 堵转最大延迟
ParamCfg_LowSpeedGain_u16 = myPackage.Parameter(500, DoubleProperty=0, Int32Property=int32(0), LogicalProperty=false, OnOffCharProperty="off", ColorCharProperty="red", StorageClass="YS_SelectRAMPara", HeaderFile="MCU_ParamCfg_Params.h", DefinitionFile="MCU_ParamCfg_Params.c", DataType="uint16")  % 堵转降功率系数斜率
ParamCfg_MaxSpeed_u16 = myPackage.Parameter(8800, DoubleProperty=0, Int32Property=int32(0), LogicalProperty=false, OnOffCharProperty="off", ColorCharProperty="red", StorageClass="YS_SelectRAMPara", HeaderFile="MCU_ParamCfg_Params.h", DefinitionFile="MCU_ParamCfg_Params.c", DataType="uint16")  % 峰值转速 实际转速 闭环 查表 角度补偿
ParamCfg_MaxTorque_u16 = myPackage.Parameter(137, DoubleProperty=0, Int32Property=int32(0), LogicalProperty=false, OnOffCharProperty="off", ColorCharProperty="red", StorageClass="YS_SelectRAMPara", HeaderFile="MCU_ParamCfg_Params.h", DefinitionFile="MCU_ParamCfg_Params.c", DataType="uint16")  % 峰值力矩
ParamCfg_MotorLimitStart_u16 = myPackage.Parameter(140, DoubleProperty=0, Int32Property=int32(0), LogicalProperty=false, OnOffCharProperty="off", ColorCharProperty="red", StorageClass="YS_SelectRAMPara", HeaderFile="MCU_ParamCfg_Params.h", DefinitionFile="MCU_ParamCfg_Params.c", DataType="uint16")  % 电机降功率起始温度
ParamCfg_MotorLimitStop_u16 = myPackage.Parameter(160, DoubleProperty=0, Int32Property=int32(0), LogicalProperty=false, OnOffCharProperty="off", ColorCharProperty="red", StorageClass="YS_SelectRAMPara", HeaderFile="MCU_ParamCfg_Params.h", DefinitionFile="MCU_ParamCfg_Params.c", DataType="uint16")  % 电机降功率终止温度
ParamCfg_MotorLsd_u16 = myPackage.Parameter(80, DoubleProperty=0, Int32Property=int32(0), LogicalProperty=false, OnOffCharProperty="off", ColorCharProperty="red", StorageClass="YS_SelectRAMPara", HeaderFile="MCU_ParamCfg_Params.h", DefinitionFile="MCU_ParamCfg_Params.c", DataType="uint16")  % q轴Lsd(异步)或Ld(同步) 0.00001
ParamCfg_MotorNp_u16 = myPackage.Parameter(4, DoubleProperty=0, Int32Property=int32(0), LogicalProperty=false, OnOffCharProperty="off", ColorCharProperty="red", StorageClass="YS_SelectRAMPara", HeaderFile="MCU_ParamCfg_Params.h", DefinitionFile="MCU_ParamCfg_Params.c", DataType="uint16")  % 电机极对数
ParamCfg_MotorStatus_u16 = myPackage.Parameter(0, DoubleProperty=0, Int32Property=int32(0), LogicalProperty=false, OnOffCharProperty="off", ColorCharProperty="red", StorageClass="YS_SelectRAMPara", HeaderFile="MCU_ParamCfg_Params.h", DefinitionFile="MCU_ParamCfg_Params.c", DataType="uint16")  % 电机运行状态
ParamCfg_MotorTyle_u16 = myPackage.Parameter(1, DoubleProperty=0, Int32Property=int32(0), LogicalProperty=false, OnOffCharProperty="off", ColorCharProperty="red", StorageClass="YS_SelectRAMPara", HeaderFile="MCU_ParamCfg_Params.h", DefinitionFile="MCU_ParamCfg_Params.c", DataType="uint16")  % 电机类型(0异步、1同步)
ParamCfg_MotorUl_u16 = myPackage.Parameter(34, DoubleProperty=0, Int32Property=int32(0), LogicalProperty=false, OnOffCharProperty="off", ColorCharProperty="red", StorageClass="YS_SelectRAMPara", HeaderFile="MCU_ParamCfg_Params.h", DefinitionFile="MCU_ParamCfg_Params.c", DataType="uint16")  % 电机额定线电压
ParamCfg_MotorUlsq_u16 = myPackage.Parameter(120, DoubleProperty=0, Int32Property=int32(0), LogicalProperty=false, OnOffCharProperty="off", ColorCharProperty="red", StorageClass="YS_SelectRAMPara", HeaderFile="MCU_ParamCfg_Params.h", DefinitionFile="MCU_ParamCfg_Params.c", DataType="uint16")  % d轴ulsq(异步)或Lq(同步) 0.00001
ParamCfg_Narrowcompen_u16 = myPackage.Parameter(0, DoubleProperty=0, Int32Property=int32(0), LogicalProperty=false, OnOffCharProperty="off", ColorCharProperty="red", StorageClass="YS_SelectRAMPara", HeaderFile="MCU_ParamCfg_Params.h", DefinitionFile="MCU_ParamCfg_Params.c", DataType="uint16")  % 窄脉冲补偿是否使能
ParamCfg_NorIsample_u16 = myPackage.Parameter(1, DoubleProperty=0, Int32Property=int32(0), LogicalProperty=false, OnOffCharProperty="off", ColorCharProperty="red", StorageClass="YS_SelectRAMPara", HeaderFile="MCU_ParamCfg_Params.h", DefinitionFile="MCU_ParamCfg_Params.c", DataType="uint16")  % 电流采样是否取反 0为取反 1为不取反
ParamCfg_PiResv1_u16 = myPackage.Parameter(0, DoubleProperty=0, Int32Property=int32(0), LogicalProperty=false, OnOffCharProperty="off", ColorCharProperty="red", StorageClass="YS_SelectRAMPara", HeaderFile="MCU_ParamCfg_Params.h", DefinitionFile="MCU_ParamCfg_Params.c", DataType="uint16")  % 保留0
ParamCfg_PosInit_u16 = myPackage.Parameter(1480, DoubleProperty=0, Int32Property=int32(0), LogicalProperty=false, OnOffCharProperty="off", ColorCharProperty="red", StorageClass="YS_SelectRAMPara", HeaderFile="MCU_ParamCfg_Params.h", DefinitionFile="MCU_ParamCfg_Params.c", DataType="uint16")  % 转子初始位置
ParamCfg_PowerMaxNeg_u16 = myPackage.Parameter(30, DoubleProperty=0, Int32Property=int32(0), LogicalProperty=false, OnOffCharProperty="off", ColorCharProperty="red", StorageClass="YS_SelectRAMPara", HeaderFile="MCU_ParamCfg_Params.h", DefinitionFile="MCU_ParamCfg_Params.c", DataType="uint16")  % 发电峰值功率
ParamCfg_PowerMax_u16 = myPackage.Parameter(30, DoubleProperty=0, Int32Property=int32(0), LogicalProperty=false, OnOffCharProperty="off", ColorCharProperty="red", StorageClass="YS_SelectRAMPara", HeaderFile="MCU_ParamCfg_Params.h", DefinitionFile="MCU_ParamCfg_Params.c", DataType="uint16")  % 电动峰值功率
ParamCfg_PrechargeUdc_u16 = myPackage.Parameter(25, DoubleProperty=0, Int32Property=int32(0), LogicalProperty=false, OnOffCharProperty="off", ColorCharProperty="red", StorageClass="YS_SelectRAMPara", HeaderFile="MCU_ParamCfg_Params.h", DefinitionFile="MCU_ParamCfg_Params.c", DataType="uint16")  % 预充电判断阈值
ParamCfg_ProductData_u16 = myPackage.Parameter(0, DoubleProperty=0, Int32Property=int32(0), LogicalProperty=false, OnOffCharProperty="off", ColorCharProperty="red", StorageClass="YS_SelectRAMPara", HeaderFile="MCU_ParamCfg_Params.h", DefinitionFile="MCU_ParamCfg_Params.c", DataType="uint16")  % 生产日期
ParamCfg_ProductVersion_u16 = myPackage.Parameter(12, DoubleProperty=0, Int32Property=int32(0), LogicalProperty=false, OnOffCharProperty="off", ColorCharProperty="red", StorageClass="YS_SelectRAMPara", HeaderFile="MCU_ParamCfg_Params.h", DefinitionFile="MCU_ParamCfg_Signals.c", DataType="uint16")  % 参数版本
ParamCfg_PwmFreqHigh_u16 = myPackage.Parameter(8000, DoubleProperty=0, Int32Property=int32(0), LogicalProperty=false, OnOffCharProperty="off", ColorCharProperty="red", StorageClass="YS_SelectRAMPara", HeaderFile="MCU_ParamCfg_Params.h", DefinitionFile="MCU_ParamCfg_Params.c", DataType="uint16")  % PWM开关频率高
ParamCfg_PwmFreqLow_u16 = myPackage.Parameter(8000, DoubleProperty=0, Int32Property=int32(0), LogicalProperty=false, OnOffCharProperty="off", ColorCharProperty="red", StorageClass="YS_SelectRAMPara", HeaderFile="MCU_ParamCfg_Params.h", DefinitionFile="MCU_ParamCfg_Params.c", DataType="uint16")  % PWM开关频率低
ParamCfg_PwmLowSpeed_u16 = myPackage.Parameter(8000, DoubleProperty=0, Int32Property=int32(0), LogicalProperty=false, OnOffCharProperty="off", ColorCharProperty="red", StorageClass="YS_SelectRAMPara", HeaderFile="MCU_ParamCfg_Params.h", DefinitionFile="MCU_ParamCfg_Params.c", DataType="uint16")  % PWM开关频率堵转
ParamCfg_Pwmprdchgen_u16 = myPackage.Parameter(1, DoubleProperty=0, Int32Property=int32(0), LogicalProperty=false, OnOffCharProperty="off", ColorCharProperty="red", StorageClass="YS_SelectRAMPara", HeaderFile="MCU_ParamCfg_Params.h", DefinitionFile="MCU_ParamCfg_Params.c", DataType="uint16")  % 变开关频率使能
ParamCfg_Qepen_u16 = myPackage.Parameter(0, DoubleProperty=0, Int32Property=int32(0), LogicalProperty=false, OnOffCharProperty="off", ColorCharProperty="red", StorageClass="YS_SelectRAMPara", HeaderFile="MCU_ParamCfg_Params.h", DefinitionFile="MCU_ParamCfg_Params.c", DataType="uint16")  % QEP是否使能
ParamCfg_RamStatus_u16 = myPackage.Parameter(0, DoubleProperty=0, Int32Property=int32(0), LogicalProperty=false, OnOffCharProperty="off", ColorCharProperty="red", StorageClass="YS_SelectRAMPara", HeaderFile="MCU_ParamCfg_Params.h", DefinitionFile="MCU_ParamCfg_Params.c", DataType="uint16")  % RAM数据状态
ParamCfg_ResRotor_u16 = myPackage.Parameter(3500, DoubleProperty=0, Int32Property=int32(0), LogicalProperty=false, OnOffCharProperty="off", ColorCharProperty="red", StorageClass="YS_SelectRAMPara", HeaderFile="MCU_ParamCfg_Params.h", DefinitionFile="MCU_ParamCfg_Params.c", DataType="uint16")  % 转子电阻0.00001
ParamCfg_ResStator_u16 = myPackage.Parameter(9400, DoubleProperty=0, Int32Property=int32(0), LogicalProperty=false, OnOffCharProperty="off", ColorCharProperty="red", StorageClass="YS_SelectRAMPara", HeaderFile="MCU_ParamCfg_Params.h", DefinitionFile="MCU_ParamCfg_Params.c", DataType="uint16")  % 定子电阻0.00001
ParamCfg_RmsFaultSetRsv10_u16 = myPackage.Parameter(0, DoubleProperty=0, Int32Property=int32(0), LogicalProperty=false, OnOffCharProperty="off", ColorCharProperty="red", StorageClass="YS_SelectRAMPara", HeaderFile="MCU_ParamCfg_Params.h", DefinitionFile="MCU_ParamCfg_Params.c", DataType="uint16")  % 保留
ParamCfg_RmsFaultSetRsv11_u16 = myPackage.Parameter(0, DoubleProperty=0, Int32Property=int32(0), LogicalProperty=false, OnOffCharProperty="off", ColorCharProperty="red", StorageClass="YS_SelectRAMPara", HeaderFile="MCU_ParamCfg_Params.h", DefinitionFile="MCU_ParamCfg_Params.c", DataType="uint16")  % 保留
ParamCfg_RmsFaultSetRsv12_u16 = myPackage.Parameter(0, DoubleProperty=0, Int32Property=int32(0), LogicalProperty=false, OnOffCharProperty="off", ColorCharProperty="red", StorageClass="YS_SelectRAMPara", HeaderFile="MCU_ParamCfg_Params.h", DefinitionFile="MCU_ParamCfg_Params.c", DataType="uint16")  % 保留
ParamCfg_RmsFaultSetRsv13_u16 = myPackage.Parameter(0, DoubleProperty=0, Int32Property=int32(0), LogicalProperty=false, OnOffCharProperty="off", ColorCharProperty="red", StorageClass="YS_SelectRAMPara", HeaderFile="MCU_ParamCfg_Params.h", DefinitionFile="MCU_ParamCfg_Params.c", DataType="uint16")  % 保留
ParamCfg_RmsFaultSetRsv14_u16 = myPackage.Parameter(0, DoubleProperty=0, Int32Property=int32(0), LogicalProperty=false, OnOffCharProperty="off", ColorCharProperty="red", StorageClass="YS_SelectRAMPara", HeaderFile="MCU_ParamCfg_Params.h", DefinitionFile="MCU_ParamCfg_Params.c", DataType="uint16")  % 保留
ParamCfg_RmsFaultSetRsv15_u16 = myPackage.Parameter(0, DoubleProperty=0, Int32Property=int32(0), LogicalProperty=false, OnOffCharProperty="off", ColorCharProperty="red", StorageClass="YS_SelectRAMPara", HeaderFile="MCU_ParamCfg_Params.h", DefinitionFile="MCU_ParamCfg_Params.c", DataType="uint16")  % 保留
ParamCfg_RmsFaultSetRsv16_u16 = myPackage.Parameter(0, DoubleProperty=0, Int32Property=int32(0), LogicalProperty=false, OnOffCharProperty="off", ColorCharProperty="red", StorageClass="YS_SelectRAMPara", HeaderFile="MCU_ParamCfg_Params.h", DefinitionFile="MCU_ParamCfg_Params.c", DataType="uint16")  % 保留
ParamCfg_RmsFaultSetRsv17_u16 = myPackage.Parameter(0, DoubleProperty=0, Int32Property=int32(0), LogicalProperty=false, OnOffCharProperty="off", ColorCharProperty="red", StorageClass="YS_SelectRAMPara", HeaderFile="MCU_ParamCfg_Params.h", DefinitionFile="MCU_ParamCfg_Params.c", DataType="uint16")  % 保留
ParamCfg_RmsFaultSetRsv18_u16 = myPackage.Parameter(0, DoubleProperty=0, Int32Property=int32(0), LogicalProperty=false, OnOffCharProperty="off", ColorCharProperty="red", StorageClass="YS_SelectRAMPara", HeaderFile="MCU_ParamCfg_Params.h", DefinitionFile="MCU_ParamCfg_Params.c", DataType="uint16")  % 保留
ParamCfg_RmsFaultSetRsv19_u16 = myPackage.Parameter(0, DoubleProperty=0, Int32Property=int32(0), LogicalProperty=false, OnOffCharProperty="off", ColorCharProperty="red", StorageClass="YS_SelectRAMPara", HeaderFile="MCU_ParamCfg_Params.h", DefinitionFile="MCU_ParamCfg_Params.c", DataType="uint16")  % 保留
ParamCfg_RmsFaultSetRsv1_u16 = myPackage.Parameter(0, DoubleProperty=0, Int32Property=int32(0), LogicalProperty=false, OnOffCharProperty="off", ColorCharProperty="red", StorageClass="YS_SelectRAMPara", HeaderFile="MCU_ParamCfg_Params.h", DefinitionFile="MCU_ParamCfg_Params.c", DataType="uint16")  % 保留
ParamCfg_RmsFaultSetRsv20_u16 = myPackage.Parameter(0, DoubleProperty=0, Int32Property=int32(0), LogicalProperty=false, OnOffCharProperty="off", ColorCharProperty="red", StorageClass="YS_SelectRAMPara", HeaderFile="MCU_ParamCfg_Params.h", DefinitionFile="MCU_ParamCfg_Params.c", DataType="uint16")  % 保留
ParamCfg_RmsFaultSetRsv21_u16 = myPackage.Parameter(0, DoubleProperty=0, Int32Property=int32(0), LogicalProperty=false, OnOffCharProperty="off", ColorCharProperty="red", StorageClass="YS_SelectRAMPara", HeaderFile="MCU_ParamCfg_Params.h", DefinitionFile="MCU_ParamCfg_Params.c", DataType="uint16")  % 保留
ParamCfg_RmsFaultSetRsv22_u16 = myPackage.Parameter(0, DoubleProperty=0, Int32Property=int32(0), LogicalProperty=false, OnOffCharProperty="off", ColorCharProperty="red", StorageClass="YS_SelectRAMPara", HeaderFile="MCU_ParamCfg_Params.h", DefinitionFile="MCU_ParamCfg_Params.c", DataType="uint16")  % 保留
ParamCfg_RmsFaultSetRsv23_u16 = myPackage.Parameter(0, DoubleProperty=0, Int32Property=int32(0), LogicalProperty=false, OnOffCharProperty="off", ColorCharProperty="red", StorageClass="YS_SelectRAMPara", HeaderFile="MCU_ParamCfg_Params.h", DefinitionFile="MCU_ParamCfg_Params.c", DataType="uint16")  % 保留
ParamCfg_RmsFaultSetRsv24_u16 = myPackage.Parameter(0, DoubleProperty=0, Int32Property=int32(0), LogicalProperty=false, OnOffCharProperty="off", ColorCharProperty="red", StorageClass="YS_SelectRAMPara", HeaderFile="MCU_ParamCfg_Params.h", DefinitionFile="MCU_ParamCfg_Params.c", DataType="uint16")  % 保留
ParamCfg_RmsFaultSetRsv25_u16 = myPackage.Parameter(0, DoubleProperty=0, Int32Property=int32(0), LogicalProperty=false, OnOffCharProperty="off", ColorCharProperty="red", StorageClass="YS_SelectRAMPara", HeaderFile="MCU_ParamCfg_Params.h", DefinitionFile="MCU_ParamCfg_Params.c", DataType="uint16")  % 保留
ParamCfg_RmsFaultSetRsv26_u16 = myPackage.Parameter(0, DoubleProperty=0, Int32Property=int32(0), LogicalProperty=false, OnOffCharProperty="off", ColorCharProperty="red", StorageClass="YS_SelectRAMPara", HeaderFile="MCU_ParamCfg_Params.h", DefinitionFile="MCU_ParamCfg_Params.c", DataType="uint16")  % 保留
ParamCfg_RmsFaultSetRsv27_u16 = myPackage.Parameter(0, DoubleProperty=0, Int32Property=int32(0), LogicalProperty=false, OnOffCharProperty="off", ColorCharProperty="red", StorageClass="YS_SelectRAMPara", HeaderFile="MCU_ParamCfg_Params.h", DefinitionFile="MCU_ParamCfg_Params.c", DataType="uint16")  % 保留
ParamCfg_RmsFaultSetRsv28_u16 = myPackage.Parameter(0, DoubleProperty=0, Int32Property=int32(0), LogicalProperty=false, OnOffCharProperty="off", ColorCharProperty="red", StorageClass="YS_SelectRAMPara", HeaderFile="MCU_ParamCfg_Params.h", DefinitionFile="MCU_ParamCfg_Params.c", DataType="uint16")  % 保留
ParamCfg_RmsFaultSetRsv29_u16 = myPackage.Parameter(10, DoubleProperty=0, Int32Property=int32(0), LogicalProperty=false, OnOffCharProperty="off", ColorCharProperty="red", StorageClass="YS_SelectRAMPara", HeaderFile="MCU_ParamCfg_Params.h", DefinitionFile="MCU_ParamCfg_Params.c", DataType="uint16")  % 保留
ParamCfg_RmsFaultSetRsv2_u16 = myPackage.Parameter(0, DoubleProperty=0, Int32Property=int32(0), LogicalProperty=false, OnOffCharProperty="off", ColorCharProperty="red", StorageClass="YS_SelectRAMPara", HeaderFile="MCU_ParamCfg_Params.h", DefinitionFile="MCU_ParamCfg_Params.c", DataType="uint16")  % 保留
ParamCfg_RmsFaultSetRsv30_u16 = myPackage.Parameter(0, DoubleProperty=0, Int32Property=int32(0), LogicalProperty=false, OnOffCharProperty="off", ColorCharProperty="red", StorageClass="YS_SelectRAMPara", HeaderFile="MCU_ParamCfg_Params.h", DefinitionFile="MCU_ParamCfg_Params.c", DataType="uint16")  % 保留
ParamCfg_RmsFaultSetRsv3_u16 = myPackage.Parameter(0, DoubleProperty=0, Int32Property=int32(0), LogicalProperty=false, OnOffCharProperty="off", ColorCharProperty="red", StorageClass="YS_SelectRAMPara", HeaderFile="MCU_ParamCfg_Params.h", DefinitionFile="MCU_ParamCfg_Params.c", DataType="uint16")  % 保留
ParamCfg_RmsFaultSetRsv4_u16 = myPackage.Parameter(0, DoubleProperty=0, Int32Property=int32(0), LogicalProperty=false, OnOffCharProperty="off", ColorCharProperty="red", StorageClass="YS_SelectRAMPara", HeaderFile="MCU_ParamCfg_Params.h", DefinitionFile="MCU_ParamCfg_Params.c", DataType="uint16")  % 保留
ParamCfg_RmsFaultSetRsv5_u16 = myPackage.Parameter(0, DoubleProperty=0, Int32Property=int32(0), LogicalProperty=false, OnOffCharProperty="off", ColorCharProperty="red", StorageClass="YS_SelectRAMPara", HeaderFile="MCU_ParamCfg_Params.h", DefinitionFile="MCU_ParamCfg_Params.c", DataType="uint16")  % 保留
ParamCfg_RmsFaultSetRsv6_u16 = myPackage.Parameter(0, DoubleProperty=0, Int32Property=int32(0), LogicalProperty=false, OnOffCharProperty="off", ColorCharProperty="red", StorageClass="YS_SelectRAMPara", HeaderFile="MCU_ParamCfg_Params.h", DefinitionFile="MCU_ParamCfg_Params.c", DataType="uint16")  % 保留
ParamCfg_RmsFaultSetRsv7_u16 = myPackage.Parameter(0, DoubleProperty=0, Int32Property=int32(0), LogicalProperty=false, OnOffCharProperty="off", ColorCharProperty="red", StorageClass="YS_SelectRAMPara", HeaderFile="MCU_ParamCfg_Params.h", DefinitionFile="MCU_ParamCfg_Params.c", DataType="uint16")  % 保留
ParamCfg_RmsFaultSetRsv8_u16 = myPackage.Parameter(0, DoubleProperty=0, Int32Property=int32(0), LogicalProperty=false, OnOffCharProperty="off", ColorCharProperty="red", StorageClass="YS_SelectRAMPara", HeaderFile="MCU_ParamCfg_Params.h", DefinitionFile="MCU_ParamCfg_Params.c", DataType="uint16")  % 保留
ParamCfg_RmsFaultSetRsv9_u16 = myPackage.Parameter(0, DoubleProperty=0, Int32Property=int32(0), LogicalProperty=false, OnOffCharProperty="off", ColorCharProperty="red", StorageClass="YS_SelectRAMPara", HeaderFile="MCU_ParamCfg_Params.h", DefinitionFile="MCU_ParamCfg_Params.c", DataType="uint16")  % 保留
ParamCfg_RotateDir_u16 = myPackage.Parameter(1, DoubleProperty=0, Int32Property=int32(0), LogicalProperty=false, OnOffCharProperty="off", ColorCharProperty="red", StorageClass="YS_SelectRAMPara", HeaderFile="MCU_ParamCfg_Params.h", DefinitionFile="MCU_ParamCfg_Params.c", DataType="uint16")  % 旋变方向选择 0：反 1：正
ParamCfg_RotateNp_u16 = myPackage.Parameter(4, DoubleProperty=0, Int32Property=int32(0), LogicalProperty=false, OnOffCharProperty="off", ColorCharProperty="red", StorageClass="YS_SelectRAMPara", HeaderFile="MCU_ParamCfg_Params.h", DefinitionFile="MCU_ParamCfg_Params.c", DataType="uint16")  % 旋变极对数
ParamCfg_Rotateresolution_u16 = myPackage.Parameter(0, DoubleProperty=0, Int32Property=int32(0), LogicalProperty=false, OnOffCharProperty="off", ColorCharProperty="red", StorageClass="YS_SelectRAMPara", HeaderFile="MCU_ParamCfg_Params.h", DefinitionFile="MCU_ParamCfg_Params.c", DataType="uint16")  % 编码器分辨率选择：0:12位，1:10位
ParamCfg_RotorFlux_u16 = myPackage.Parameter(937, DoubleProperty=0, Int32Property=int32(0), LogicalProperty=false, OnOffCharProperty="off", ColorCharProperty="red", StorageClass="YS_SelectRAMPara", HeaderFile="MCU_ParamCfg_Params.h", DefinitionFile="MCU_ParamCfg_Params.c", DataType="uint16")  % 转子磁链
ParamCfg_RpmValueDefault_u16 = myPackage.Parameter(210, DoubleProperty=0, Int32Property=int32(0), LogicalProperty=false, OnOffCharProperty="off", ColorCharProperty="red", StorageClass="YS_SelectRAMPara", HeaderFile="MCU_ParamCfg_Params.h", DefinitionFile="MCU_ParamCfg_Params.c", DataType="uint16")  % 转速过大瞬时值故障点
ParamCfg_SampleMode_u16 = myPackage.Parameter(4, DoubleProperty=0, Int32Property=int32(0), LogicalProperty=false, OnOffCharProperty="off", ColorCharProperty="red", StorageClass="YS_SelectRAMPara", HeaderFile="MCU_ParamCfg_Params.h", DefinitionFile="MCU_ParamCfg_Params.c", DataType="uint16")  % 采样类型 1 AB 3 BC 2 AC 4 ABC
ParamCfg_SampleType_u16 = myPackage.Parameter(1, DoubleProperty=0, Int32Property=int32(0), LogicalProperty=false, OnOffCharProperty="off", ColorCharProperty="red", StorageClass="YS_SelectRAMPara", HeaderFile="MCU_ParamCfg_Params.h", DefinitionFile="MCU_ParamCfg_Params.c", DataType="uint16")  % 采样方式 0 霍尔 1 电阻
ParamCfg_SensorHs_u16 = myPackage.Parameter(0, DoubleProperty=0, Int32Property=int32(0), LogicalProperty=false, OnOffCharProperty="off", ColorCharProperty="red", StorageClass="YS_SelectRAMPara", HeaderFile="MCU_ParamCfg_Params.h", DefinitionFile="MCU_ParamCfg_Params.c", DataType="uint16")  % 散热器温度传感器
ParamCfg_SensorMotor1_u16 = myPackage.Parameter(0, DoubleProperty=0, Int32Property=int32(0), LogicalProperty=false, OnOffCharProperty="off", ColorCharProperty="red", StorageClass="YS_SelectRAMPara", HeaderFile="MCU_ParamCfg_Params.h", DefinitionFile="MCU_ParamCfg_Params.c", DataType="uint16")  % 电机温度传感器选择0：传感器无效；1：PTC100/KTY82
ParamCfg_SensorMotor2_u16 = myPackage.Parameter(0, DoubleProperty=0, Int32Property=int32(0), LogicalProperty=false, OnOffCharProperty="off", ColorCharProperty="red", StorageClass="YS_SelectRAMPara", HeaderFile="MCU_ParamCfg_Params.h", DefinitionFile="MCU_ParamCfg_Params.c", DataType="uint16")  % 电机温度传感器选择0：传感器无效；1：PTC100/KTY82
ParamCfg_SensorSpeed_u16 = myPackage.Parameter(1, DoubleProperty=0, Int32Property=int32(0), LogicalProperty=false, OnOffCharProperty="off", ColorCharProperty="red", StorageClass="YS_SelectRAMPara", HeaderFile="MCU_ParamCfg_Params.h", DefinitionFile="MCU_ParamCfg_Params.c", DataType="uint16")  % 速度传感器(0未用)
ParamCfg_Sinamp_u16 = myPackage.Parameter(12935, DoubleProperty=0, Int32Property=int32(0), LogicalProperty=false, OnOffCharProperty="off", ColorCharProperty="red", StorageClass="YS_SelectRAMPara", HeaderFile="MCU_ParamCfg_Params.h", DefinitionFile="MCU_ParamCfg_Params.c", DataType="uint16")  % sin幅值偏置0.1f
ParamCfg_Sinavg_u16 = myPackage.Parameter(20530, DoubleProperty=0, Int32Property=int32(0), LogicalProperty=false, OnOffCharProperty="off", ColorCharProperty="red", StorageClass="YS_SelectRAMPara", HeaderFile="MCU_ParamCfg_Params.h", DefinitionFile="MCU_ParamCfg_Params.c", DataType="uint16")  % sin平均值偏置0.1f
ParamCfg_SlideEnable_u16 = myPackage.Parameter(0, DoubleProperty=0, Int32Property=int32(0), LogicalProperty=false, OnOffCharProperty="off", ColorCharProperty="red", StorageClass="YS_SelectRAMPara", HeaderFile="MCU_ParamCfg_Params.h", DefinitionFile="MCU_ParamCfg_Params.c", DataType="uint16")  % 滑行能量回收是否使能
ParamCfg_SmoPllKi_u16 = myPackage.Parameter(100, DoubleProperty=0, Int32Property=int32(0), LogicalProperty=false, OnOffCharProperty="off", ColorCharProperty="red", StorageClass="YS_SelectRAMPara", HeaderFile="MCU_ParamCfg_Params.h", DefinitionFile="MCU_ParamCfg_Params.c", DataType="uint16")  % 30, // smo pll的Ki值
ParamCfg_SmoPllKp_u16 = myPackage.Parameter(750, DoubleProperty=0, Int32Property=int32(0), LogicalProperty=false, OnOffCharProperty="off", ColorCharProperty="red", StorageClass="YS_SelectRAMPara", HeaderFile="MCU_ParamCfg_Params.h", DefinitionFile="MCU_ParamCfg_Params.c", DataType="uint16")  % 1500,// smo pll的Kp值 0.001
ParamCfg_SmoStartSpd_u16 = myPackage.Parameter(150, DoubleProperty=0, Int32Property=int32(0), LogicalProperty=false, OnOffCharProperty="off", ColorCharProperty="red", StorageClass="YS_SelectRAMPara", HeaderFile="MCU_ParamCfg_Params.h", DefinitionFile="MCU_ParamCfg_Params.c", DataType="uint16")  % 无位置滑膜算法切换转速值
ParamCfg_SoftVersion_u16 = myPackage.Parameter(12, DoubleProperty=0, Int32Property=int32(0), LogicalProperty=false, OnOffCharProperty="off", ColorCharProperty="red", StorageClass="YS_SelectRAMPara", HeaderFile="MCU_ParamCfg_Params.h", DefinitionFile="MCU_ParamCfg_Signals.c", DataType="uint16")  % 软件版本号
ParamCfg_Spdouttype_u16 = myPackage.Parameter(0, DoubleProperty=0, Int32Property=int32(0), LogicalProperty=false, OnOffCharProperty="off", ColorCharProperty="red", StorageClass="YS_SelectRAMPara", HeaderFile="MCU_ParamCfg_Params.h", DefinitionFile="MCU_ParamCfg_Params.c", DataType="uint16")  % 速度环输出类型 0：转矩 1：电流
ParamCfg_SpeedKc_u16 = myPackage.Parameter(20, DoubleProperty=0, Int32Property=int32(0), LogicalProperty=false, OnOffCharProperty="off", ColorCharProperty="red", StorageClass="YS_SelectRAMPara", HeaderFile="MCU_ParamCfg_Params.h", DefinitionFile="MCU_ParamCfg_Params.c", DataType="uint16")  % 速度的KC值 0.0001
ParamCfg_SpeedKd_u16 = myPackage.Parameter(0, DoubleProperty=0, Int32Property=int32(0), LogicalProperty=false, OnOffCharProperty="off", ColorCharProperty="red", StorageClass="YS_SelectRAMPara", HeaderFile="MCU_ParamCfg_Params.h", DefinitionFile="MCU_ParamCfg_Params.c", DataType="uint16")  % 速度的KD值 0.001
ParamCfg_SpeedKi_u16 = myPackage.Parameter(2, DoubleProperty=0, Int32Property=int32(0), LogicalProperty=false, OnOffCharProperty="off", ColorCharProperty="red", StorageClass="YS_SelectRAMPara", HeaderFile="MCU_ParamCfg_Params.h", DefinitionFile="MCU_ParamCfg_Params.c", DataType="uint16")  % 1, // 速度的KI值 0.0001
ParamCfg_SpeedKp_u16 = myPackage.Parameter(5, DoubleProperty=0, Int32Property=int32(0), LogicalProperty=false, OnOffCharProperty="off", ColorCharProperty="red", StorageClass="YS_SelectRAMPara", HeaderFile="MCU_ParamCfg_Params.h", DefinitionFile="MCU_ParamCfg_Params.c", DataType="uint16")  % 速度的KP值 0.001
ParamCfg_SpeedLimitStartBack_u16 = myPackage.Parameter(3000, DoubleProperty=0, Int32Property=int32(0), LogicalProperty=false, OnOffCharProperty="off", ColorCharProperty="red", StorageClass="YS_SelectRAMPara", HeaderFile="MCU_ParamCfg_Params.h", DefinitionFile="MCU_ParamCfg_Params.c", DataType="uint16")  % 倒车限速起始速度
ParamCfg_SpeedLimitStart_u16 = myPackage.Parameter(8600, DoubleProperty=0, Int32Property=int32(0), LogicalProperty=false, OnOffCharProperty="off", ColorCharProperty="red", StorageClass="YS_SelectRAMPara", HeaderFile="MCU_ParamCfg_Params.h", DefinitionFile="MCU_ParamCfg_Params.c", DataType="uint16")  % 电机降功率起始速度
ParamCfg_SpeedLimitStopBack_u16 = myPackage.Parameter(3500, DoubleProperty=0, Int32Property=int32(0), LogicalProperty=false, OnOffCharProperty="off", ColorCharProperty="red", StorageClass="YS_SelectRAMPara", HeaderFile="MCU_ParamCfg_Params.h", DefinitionFile="MCU_ParamCfg_Params.c", DataType="uint16")  % 倒车限速终止速度
ParamCfg_SpeedLimitStop_u16 = myPackage.Parameter(9000, DoubleProperty=0, Int32Property=int32(0), LogicalProperty=false, OnOffCharProperty="off", ColorCharProperty="red", StorageClass="YS_SelectRAMPara", HeaderFile="MCU_ParamCfg_Params.h", DefinitionFile="MCU_ParamCfg_Params.c", DataType="uint16")  % 电机降功率终止速度
ParamCfg_SpeedLowLimit_u16 = myPackage.Parameter(10, DoubleProperty=0, Int32Property=int32(0), LogicalProperty=false, OnOffCharProperty="off", ColorCharProperty="red", StorageClass="YS_SelectRAMPara", HeaderFile="MCU_ParamCfg_Params.h", DefinitionFile="MCU_ParamCfg_Params.c", DataType="uint16")  % 堵转保护速度进入限值
ParamCfg_SpeedMax_u16 = myPackage.Parameter(8400, DoubleProperty=0, Int32Property=int32(0), LogicalProperty=false, OnOffCharProperty="off", ColorCharProperty="red", StorageClass="YS_SelectRAMPara", HeaderFile="MCU_ParamCfg_Params.h", DefinitionFile="MCU_ParamCfg_Params.c", DataType="uint16")  % 力矩限制用最大速度 与母线电压平方成正比
ParamCfg_SpeedOutMax_u16 = myPackage.Parameter(35, DoubleProperty=0, Int32Property=int32(0), LogicalProperty=false, OnOffCharProperty="off", ColorCharProperty="red", StorageClass="YS_SelectRAMPara", HeaderFile="MCU_ParamCfg_Params.h", DefinitionFile="MCU_ParamCfg_Params.c", DataType="uint16")  % 转速环输出最大值 0.01
ParamCfg_SpeedStepB_u16 = myPackage.Parameter(10, DoubleProperty=0, Int32Property=int32(0), LogicalProperty=false, OnOffCharProperty="off", ColorCharProperty="red", StorageClass="YS_SelectRAMPara", HeaderFile="MCU_ParamCfg_Params.h", DefinitionFile="MCU_ParamCfg_Params.c", DataType="uint16")  % 速度给定步长1(第一段，稍大)
ParamCfg_SpeedStepChangeMax_u16 = myPackage.Parameter(20, DoubleProperty=0, Int32Property=int32(0), LogicalProperty=false, OnOffCharProperty="off", ColorCharProperty="red", StorageClass="YS_SelectRAMPara", HeaderFile="MCU_ParamCfg_Params.h", DefinitionFile="MCU_ParamCfg_Params.c", DataType="uint16")  % 速度变步长切换点
ParamCfg_SpeedStepS_u16 = myPackage.Parameter(4, DoubleProperty=0, Int32Property=int32(0), LogicalProperty=false, OnOffCharProperty="off", ColorCharProperty="red", StorageClass="YS_SelectRAMPara", HeaderFile="MCU_ParamCfg_Params.h", DefinitionFile="MCU_ParamCfg_Params.c", DataType="uint16")  % 速度给定步长(第二段，稍小)
ParamCfg_Stage_u16 = myPackage.Parameter(0, DoubleProperty=0, Int32Property=int32(0), LogicalProperty=false, OnOffCharProperty="off", ColorCharProperty="red", StorageClass="YS_SelectRAMPara", HeaderFile="MCU_ParamCfg_Params.h", DefinitionFile="MCU_ParamCfg_Params.c", DataType="uint16")  % 电涡流传感器标定状态机
ParamCfg_StepResv2_u16 = myPackage.Parameter(0, DoubleProperty=0, Int32Property=int32(0), LogicalProperty=false, OnOffCharProperty="off", ColorCharProperty="red", StorageClass="YS_SelectRAMPara", HeaderFile="MCU_ParamCfg_Params.h", DefinitionFile="MCU_ParamCfg_Params.c", DataType="uint16")  % 保留
ParamCfg_StepResv3_u16 = myPackage.Parameter(0, DoubleProperty=0, Int32Property=int32(0), LogicalProperty=false, OnOffCharProperty="off", ColorCharProperty="red", StorageClass="YS_SelectRAMPara", HeaderFile="MCU_ParamCfg_Params.h", DefinitionFile="MCU_ParamCfg_Params.c", DataType="uint16")  % 保留
ParamCfg_StepResv4_u16 = myPackage.Parameter(0, DoubleProperty=0, Int32Property=int32(0), LogicalProperty=false, OnOffCharProperty="off", ColorCharProperty="red", StorageClass="YS_SelectRAMPara", HeaderFile="MCU_ParamCfg_Params.h", DefinitionFile="MCU_ParamCfg_Params.c", DataType="uint16")  % 保留
ParamCfg_SysResv10_u16 = myPackage.Parameter(0, DoubleProperty=0, Int32Property=int32(0), LogicalProperty=false, OnOffCharProperty="off", ColorCharProperty="red", StorageClass="YS_SelectRAMPara", HeaderFile="MCU_ParamCfg_Params.h", DefinitionFile="MCU_ParamCfg_Params.c", DataType="uint16")  % 保留
ParamCfg_SysResv11_u16 = myPackage.Parameter(0, DoubleProperty=0, Int32Property=int32(0), LogicalProperty=false, OnOffCharProperty="off", ColorCharProperty="red", StorageClass="YS_SelectRAMPara", HeaderFile="MCU_ParamCfg_Params.h", DefinitionFile="MCU_ParamCfg_Params.c", DataType="uint16")  % 保留

ParamCfg_SysResv12_u16 = myPackage.Parameter(0, DoubleProperty=0, Int32Property=int32(0), LogicalProperty=false, OnOffCharProperty="off", ColorCharProperty="red", StorageClass="YS_SelectRAMPara", HeaderFile="MCU_ParamCfg_Params.h", DefinitionFile="MCU_ParamCfg_Params.c", DataType="uint16")  % 保留
ParamCfg_SysResv13_u16 = myPackage.Parameter(0, DoubleProperty=0, Int32Property=int32(0), LogicalProperty=false, OnOffCharProperty="off", ColorCharProperty="red", StorageClass="YS_SelectRAMPara", HeaderFile="MCU_ParamCfg_Params.h", DefinitionFile="MCU_ParamCfg_Params.c", DataType="uint16")  % 保留
ParamCfg_SysResv14_u16 = myPackage.Parameter(0, DoubleProperty=0, Int32Property=int32(0), LogicalProperty=false, OnOffCharProperty="off", ColorCharProperty="red", StorageClass="YS_SelectRAMPara", HeaderFile="MCU_ParamCfg_Params.h", DefinitionFile="MCU_ParamCfg_Params.c", DataType="uint16")  % 保留
ParamCfg_SysResv15_u16 = myPackage.Parameter(0, DoubleProperty=0, Int32Property=int32(0), LogicalProperty=false, OnOffCharProperty="off", ColorCharProperty="red", StorageClass="YS_SelectRAMPara", HeaderFile="MCU_ParamCfg_Params.h", DefinitionFile="MCU_ParamCfg_Params.c", DataType="uint16")  % 保留
ParamCfg_SysResv16_u16 = myPackage.Parameter(0, DoubleProperty=0, Int32Property=int32(0), LogicalProperty=false, OnOffCharProperty="off", ColorCharProperty="red", StorageClass="YS_SelectRAMPara", HeaderFile="MCU_ParamCfg_Params.h", DefinitionFile="MCU_ParamCfg_Params.c", DataType="uint16")  % 保留
ParamCfg_SysResv17_u16 = myPackage.Parameter(0, DoubleProperty=0, Int32Property=int32(0), LogicalProperty=false, OnOffCharProperty="off", ColorCharProperty="red", StorageClass="YS_SelectRAMPara", HeaderFile="MCU_ParamCfg_Params.h", DefinitionFile="MCU_ParamCfg_Params.c", DataType="uint16")  % 保留
ParamCfg_SysResv19_u16 = myPackage.Parameter(0, DoubleProperty=0, Int32Property=int32(0), LogicalProperty=false, OnOffCharProperty="off", ColorCharProperty="red", StorageClass="YS_SelectRAMPara", HeaderFile="MCU_ParamCfg_Params.h", DefinitionFile="MCU_ParamCfg_Params.c", DataType="uint16")  % 保留
ParamCfg_SysResv1_u16 = myPackage.Parameter(0, DoubleProperty=0, Int32Property=int32(0), LogicalProperty=false, OnOffCharProperty="off", ColorCharProperty="red", StorageClass="YS_SelectRAMPara", HeaderFile="MCU_ParamCfg_Params.h", DefinitionFile="MCU_ParamCfg_Params.c", DataType="uint16")  % 保留
ParamCfg_SysResv20_u16 = myPackage.Parameter(0, DoubleProperty=0, Int32Property=int32(0), LogicalProperty=false, OnOffCharProperty="off", ColorCharProperty="red", StorageClass="YS_SelectRAMPara", HeaderFile="MCU_ParamCfg_Params.h", DefinitionFile="MCU_ParamCfg_Params.c", DataType="uint16")  % 保留
ParamCfg_SysResv21_u16 = myPackage.Parameter(0, DoubleProperty=0, Int32Property=int32(0), LogicalProperty=false, OnOffCharProperty="off", ColorCharProperty="red", StorageClass="YS_SelectRAMPara", HeaderFile="MCU_ParamCfg_Params.h", DefinitionFile="MCU_ParamCfg_Params.c", DataType="uint16")  % 保留
ParamCfg_SysResv22_u16 = myPackage.Parameter(0, DoubleProperty=0, Int32Property=int32(0), LogicalProperty=false, OnOffCharProperty="off", ColorCharProperty="red", StorageClass="YS_SelectRAMPara", HeaderFile="MCU_ParamCfg_Params.h", DefinitionFile="MCU_ParamCfg_Params.c", DataType="uint16")  % 保留
ParamCfg_SysResv23_u16 = myPackage.Parameter(0, DoubleProperty=0, Int32Property=int32(0), LogicalProperty=false, OnOffCharProperty="off", ColorCharProperty="red", StorageClass="YS_SelectRAMPara", HeaderFile="MCU_ParamCfg_Params.h", DefinitionFile="MCU_ParamCfg_Params.c", DataType="uint16")  % 保留
ParamCfg_SysResv2_u16 = myPackage.Parameter(0, DoubleProperty=0, Int32Property=int32(0), LogicalProperty=false, OnOffCharProperty="off", ColorCharProperty="red", StorageClass="YS_SelectRAMPara", HeaderFile="MCU_ParamCfg_Params.h", DefinitionFile="MCU_ParamCfg_Params.c", DataType="uint16")  % 保留
ParamCfg_SysResv3_u16 = myPackage.Parameter(0, DoubleProperty=0, Int32Property=int32(0), LogicalProperty=false, OnOffCharProperty="off", ColorCharProperty="red", StorageClass="YS_SelectRAMPara", HeaderFile="MCU_ParamCfg_Params.h", DefinitionFile="MCU_ParamCfg_Params.c", DataType="uint16")  % 保留
ParamCfg_SysResv8_u16 = myPackage.Parameter(0, DoubleProperty=0, Int32Property=int32(0), LogicalProperty=false, OnOffCharProperty="off", ColorCharProperty="red", StorageClass="YS_SelectRAMPara", HeaderFile="MCU_ParamCfg_Params.h", DefinitionFile="MCU_ParamCfg_Params.c", DataType="uint16")  % 保留
ParamCfg_SysResv9_u16 = myPackage.Parameter(0, DoubleProperty=0, Int32Property=int32(0), LogicalProperty=false, OnOffCharProperty="off", ColorCharProperty="red", StorageClass="YS_SelectRAMPara", HeaderFile="MCU_ParamCfg_Params.h", DefinitionFile="MCU_ParamCfg_Params.c", DataType="uint16")  % 保留
ParamCfg_ThetaGain_u16 = myPackage.Parameter(0, DoubleProperty=0, Int32Property=int32(0), LogicalProperty=false, OnOffCharProperty="off", ColorCharProperty="red", StorageClass="YS_SelectRAMPara", HeaderFile="MCU_ParamCfg_Params.h", DefinitionFile="MCU_ParamCfg_Params.c", DataType="uint16")  % 角度补偿最大值 0.001
ParamCfg_TigbtLimitStart_u16 = myPackage.Parameter(85, DoubleProperty=0, Int32Property=int32(0), LogicalProperty=false, OnOffCharProperty="off", ColorCharProperty="red", StorageClass="YS_SelectRAMPara", HeaderFile="MCU_ParamCfg_Params.h", DefinitionFile="MCU_ParamCfg_Params.c", DataType="uint16")  % IGBT降功率起始温度
ParamCfg_TigbtLimitStop_u16 = myPackage.Parameter(95, DoubleProperty=0, Int32Property=int32(0), LogicalProperty=false, OnOffCharProperty="off", ColorCharProperty="red", StorageClass="YS_SelectRAMPara", HeaderFile="MCU_ParamCfg_Params.h", DefinitionFile="MCU_ParamCfg_Params.c", DataType="uint16")  % IGBT降功率终止温度
ParamCfg_TorqlookupRpmStep_u16 = myPackage.Parameter(400, DoubleProperty=0, Int32Property=int32(0), LogicalProperty=false, OnOffCharProperty="off", ColorCharProperty="red", StorageClass="YS_SelectRAMPara", HeaderFile="MCU_ParamCfg_Params.h", DefinitionFile="MCU_ParamCfg_Params.c", DataType="uint16")  % 查表转速步长
ParamCfg_TorqlookupTorqStep_u16 = myPackage.Parameter(20, DoubleProperty=0, Int32Property=int32(0), LogicalProperty=false, OnOffCharProperty="off", ColorCharProperty="red", StorageClass="YS_SelectRAMPara", HeaderFile="MCU_ParamCfg_Params.h", DefinitionFile="MCU_ParamCfg_Params.c", DataType="uint16")  % 查表转矩步长 0.01
ParamCfg_TorqueFixEnable_u16 = myPackage.Parameter(0, DoubleProperty=0, Int32Property=int32(0), LogicalProperty=false, OnOffCharProperty="off", ColorCharProperty="red", StorageClass="YS_SelectRAMPara", HeaderFile="MCU_ParamCfg_Params.h", DefinitionFile="MCU_ParamCfg_Params.c", DataType="uint16")  % 扭矩拟合使能
ParamCfg_UdCoeff_u16 = myPackage.Parameter(0, DoubleProperty=0, Int32Property=int32(0), LogicalProperty=false, OnOffCharProperty="off", ColorCharProperty="red", StorageClass="YS_SelectRAMPara", HeaderFile="MCU_ParamCfg_Params.h", DefinitionFile="MCU_ParamCfg_Params.c", DataType="uint16")  % d轴电感解耦系数
ParamCfg_UdcDefValue_u16 = myPackage.Parameter(0, DoubleProperty=0, Int32Property=int32(0), LogicalProperty=false, OnOffCharProperty="off", ColorCharProperty="red", StorageClass="YS_SelectRAMPara", HeaderFile="MCU_ParamCfg_Params.h", DefinitionFile="MCU_ParamCfg_Params.c", DataType="uint16")  % 母线电压偏置默认值
ParamCfg_UdcDownLimt_u16 = myPackage.Parameter(0, DoubleProperty=0, Int32Property=int32(0), LogicalProperty=false, OnOffCharProperty="off", ColorCharProperty="red", StorageClass="YS_SelectRAMPara", HeaderFile="MCU_ParamCfg_Params.h", DefinitionFile="MCU_ParamCfg_Params.c", DataType="uint16")  % 母线电压最小偏置
ParamCfg_UdcLowerLimitStart72v_u16 = myPackage.Parameter(65, DoubleProperty=0, Int32Property=int32(0), LogicalProperty=false, OnOffCharProperty="off", ColorCharProperty="red", StorageClass="YS_SelectRAMPara", HeaderFile="MCU_ParamCfg_Params.h", DefinitionFile="MCU_ParamCfg_Params.c", DataType="uint16")  % 72V母线电压低降功率起始电压
ParamCfg_UdcLowerLimitStart_u16 = myPackage.Parameter(54, DoubleProperty=0, Int32Property=int32(0), LogicalProperty=false, OnOffCharProperty="off", ColorCharProperty="red", StorageClass="YS_SelectRAMPara", HeaderFile="MCU_ParamCfg_Params.h", DefinitionFile="MCU_ParamCfg_Params.c", DataType="uint16")  % 60V母线电压低降功率起始电压
ParamCfg_UdcLowerLimitStop72v_u16 = myPackage.Parameter(63, DoubleProperty=0, Int32Property=int32(0), LogicalProperty=false, OnOffCharProperty="off", ColorCharProperty="red", StorageClass="YS_SelectRAMPara", HeaderFile="MCU_ParamCfg_Params.h", DefinitionFile="MCU_ParamCfg_Params.c", DataType="uint16")  % 72V母线电压低降功率终止电压
ParamCfg_UdcLowerLimitStop_u16 = myPackage.Parameter(52, DoubleProperty=0, Int32Property=int32(0), LogicalProperty=false, OnOffCharProperty="off", ColorCharProperty="red", StorageClass="YS_SelectRAMPara", HeaderFile="MCU_ParamCfg_Params.h", DefinitionFile="MCU_ParamCfg_Params.c", DataType="uint16")  % 60V母线电压低降功率终止电压
ParamCfg_UdcUpLimitStart72v_u16 = myPackage.Parameter(91, DoubleProperty=0, Int32Property=int32(0), LogicalProperty=false, OnOffCharProperty="off", ColorCharProperty="red", StorageClass="YS_SelectRAMPara", HeaderFile="MCU_ParamCfg_Params.h", DefinitionFile="MCU_ParamCfg_Params.c", DataType="uint16")  % 72V母线电压高降功率起始电压
ParamCfg_UdcUpLimitStart_u16 = myPackage.Parameter(76, DoubleProperty=0, Int32Property=int32(0), LogicalProperty=false, OnOffCharProperty="off", ColorCharProperty="red", StorageClass="YS_SelectRAMPara", HeaderFile="MCU_ParamCfg_Params.h", DefinitionFile="MCU_ParamCfg_Params.c", DataType="uint16")  % 60V母线电压高降功率起始电压
ParamCfg_UdcUpLimitStop72v_u16 = myPackage.Parameter(93, DoubleProperty=0, Int32Property=int32(0), LogicalProperty=false, OnOffCharProperty="off", ColorCharProperty="red", StorageClass="YS_SelectRAMPara", HeaderFile="MCU_ParamCfg_Params.h", DefinitionFile="MCU_ParamCfg_Params.c", DataType="uint16")  % 72V母线电压高降功率终止电压
ParamCfg_UdcUpLimitStop_u16 = myPackage.Parameter(78, DoubleProperty=0, Int32Property=int32(0), LogicalProperty=false, OnOffCharProperty="off", ColorCharProperty="red", StorageClass="YS_SelectRAMPara", HeaderFile="MCU_ParamCfg_Params.h", DefinitionFile="MCU_ParamCfg_Params.c", DataType="uint16")  % 60V母线电压高降功率终止电压
ParamCfg_UdcUpLimt_u16 = myPackage.Parameter(20, DoubleProperty=0, Int32Property=int32(0), LogicalProperty=false, OnOffCharProperty="off", ColorCharProperty="red", StorageClass="YS_SelectRAMPara", HeaderFile="MCU_ParamCfg_Params.h", DefinitionFile="MCU_ParamCfg_Params.c", DataType="uint16")  % 母线电压最大偏置
ParamCfg_UeCoeff_u16 = myPackage.Parameter(0, DoubleProperty=0, Int32Property=int32(0), LogicalProperty=false, OnOffCharProperty="off", ColorCharProperty="red", StorageClass="YS_SelectRAMPara", HeaderFile="MCU_ParamCfg_Params.h", DefinitionFile="MCU_ParamCfg_Params.c", DataType="uint16")  % 反电势解耦系数
ParamCfg_UqCoeff_u16 = myPackage.Parameter(0, DoubleProperty=0, Int32Property=int32(0), LogicalProperty=false, OnOffCharProperty="off", ColorCharProperty="red", StorageClass="YS_SelectRAMPara", HeaderFile="MCU_ParamCfg_Params.h", DefinitionFile="MCU_ParamCfg_Params.c", DataType="uint16")  % q轴电感解耦系数
ParamCfg_VMaxCarAcc_u16 = myPackage.Parameter(0, DoubleProperty=0, Int32Property=int32(0), LogicalProperty=false, OnOffCharProperty="off", ColorCharProperty="red", StorageClass="YS_SelectRAMPara", HeaderFile="MCU_ParamCfg_Params.h", DefinitionFile="MCU_ParamCfg_Params.c", DataType="uint16")  % 最大油门采样电压
ParamCfg_VMinCarAcc_u16 = myPackage.Parameter(0, DoubleProperty=0, Int32Property=int32(0), LogicalProperty=false, OnOffCharProperty="off", ColorCharProperty="red", StorageClass="YS_SelectRAMPara", HeaderFile="MCU_ParamCfg_Params.h", DefinitionFile="MCU_ParamCfg_Params.c", DataType="uint16")  % 最小油门采样电压
ParamCfg_Vc1Enable_u16 = myPackage.Parameter(0, DoubleProperty=0, Int32Property=int32(0), LogicalProperty=false, OnOffCharProperty="off", ColorCharProperty="red", StorageClass="YS_SelectRAMPara", HeaderFile="MCU_ParamCfg_Params.h", DefinitionFile="MCU_ParamCfg_Params.c", DataType="uint16")  % 电压环1使能标志
ParamCfg_Vc2Enable_u16 = myPackage.Parameter(0, DoubleProperty=0, Int32Property=int32(0), LogicalProperty=false, OnOffCharProperty="off", ColorCharProperty="red", StorageClass="YS_SelectRAMPara", HeaderFile="MCU_ParamCfg_Params.h", DefinitionFile="MCU_ParamCfg_Params.c", DataType="uint16")  % 电压环2使能标志
ParamCfg_Vc3Enable_u16 = myPackage.Parameter(0, DoubleProperty=0, Int32Property=int32(0), LogicalProperty=false, OnOffCharProperty="off", ColorCharProperty="red", StorageClass="YS_SelectRAMPara", HeaderFile="MCU_ParamCfg_Params.h", DefinitionFile="MCU_ParamCfg_Params.c", DataType="uint16")  % 电压3环使能
ParamCfg_VdqDest_u16 = myPackage.Parameter(950, DoubleProperty=0, Int32Property=int32(0), LogicalProperty=false, OnOffCharProperty="off", ColorCharProperty="red", StorageClass="YS_SelectRAMPara", HeaderFile="MCU_ParamCfg_Params.h", DefinitionFile="MCU_ParamCfg_Params.c", DataType="uint16")  % Vdq调节目标值 0.001 (永磁机有效)
ParamCfg_VehicleCalibrationFlg_u16 = myPackage.Parameter(1, DoubleProperty=0, Int32Property=int32(0), LogicalProperty=false, OnOffCharProperty="off", ColorCharProperty="red", StorageClass="YS_SelectRAMPara", HeaderFile="MCU_ParamCfg_Params.h", DefinitionFile="MCU_ParamCfg_Params.c", DataType="uint16")  % 整车标定模式标志 0：仅整车 1：整车+标定
ParamCfg_VscopeChannel1_u16 = myPackage.Parameter(0, DoubleProperty=0, Int32Property=int32(0), LogicalProperty=false, OnOffCharProperty="off", ColorCharProperty="red", StorageClass="YS_SelectRAMPara", HeaderFile="MCU_ParamCfg_Params.h", DefinitionFile="MCU_ParamCfg_Params.c", DataType="uint16")  % 保留
ParamCfg_VscopeChannel2_u16 = myPackage.Parameter(1, DoubleProperty=0, Int32Property=int32(0), LogicalProperty=false, OnOffCharProperty="off", ColorCharProperty="red", StorageClass="YS_SelectRAMPara", HeaderFile="MCU_ParamCfg_Params.h", DefinitionFile="MCU_ParamCfg_Params.c", DataType="uint16")  % 保留
ParamCfg_VscopeChannel3_u16 = myPackage.Parameter(2, DoubleProperty=0, Int32Property=int32(0), LogicalProperty=false, OnOffCharProperty="off", ColorCharProperty="red", StorageClass="YS_SelectRAMPara", HeaderFile="MCU_ParamCfg_Params.h", DefinitionFile="MCU_ParamCfg_Params.c", DataType="uint16")  % 保留
ParamCfg_VscopeChannel4_u16 = myPackage.Parameter(3, DoubleProperty=0, Int32Property=int32(0), LogicalProperty=false, OnOffCharProperty="off", ColorCharProperty="red", StorageClass="YS_SelectRAMPara", HeaderFile="MCU_ParamCfg_Params.h", DefinitionFile="MCU_ParamCfg_Params.c", DataType="uint16")  % 保留
ParamCfg_WeakCalcEnable_u16 = myPackage.Parameter(1, DoubleProperty=0, Int32Property=int32(0), LogicalProperty=false, OnOffCharProperty="off", ColorCharProperty="red", StorageClass="YS_SelectRAMPara", HeaderFile="MCU_ParamCfg_Params.h", DefinitionFile="MCU_ParamCfg_Params.c", DataType="uint16")  % 变电压弱磁计算使能
ParamCfg_WeakIdMax_u16 = myPackage.Parameter(450, DoubleProperty=0, Int32Property=int32(0), LogicalProperty=false, OnOffCharProperty="off", ColorCharProperty="red", StorageClass="YS_SelectRAMPara", HeaderFile="MCU_ParamCfg_Params.h", DefinitionFile="MCU_ParamCfg_Params.c", DataType="uint16")  % 弱磁最大电流
ParamCfg_WeakIdMin_u16 = myPackage.Parameter(0, DoubleProperty=0, Int32Property=int32(0), LogicalProperty=false, OnOffCharProperty="off", ColorCharProperty="red", StorageClass="YS_SelectRAMPara", HeaderFile="MCU_ParamCfg_Params.h", DefinitionFile="MCU_ParamCfg_Params.c", DataType="uint16")  % 弱磁最小电流
ParamCfg_WeakidKi_u16 = myPackage.Parameter(50, DoubleProperty=0, Int32Property=int32(0), LogicalProperty=false, OnOffCharProperty="off", ColorCharProperty="red", StorageClass="YS_SelectRAMPara", HeaderFile="MCU_ParamCfg_Params.h", DefinitionFile="MCU_ParamCfg_Params.c", DataType="uint16")  % 弱磁计算KI值
ParamCfg_WeakidKp_u16 = myPackage.Parameter(300, DoubleProperty=0, Int32Property=int32(0), LogicalProperty=false, OnOffCharProperty="off", ColorCharProperty="red", StorageClass="YS_SelectRAMPara", HeaderFile="MCU_ParamCfg_Params.h", DefinitionFile="MCU_ParamCfg_Params.c", DataType="uint16")  % 弱磁计算KP值
ParamCfg_ZeroTorqueNoworkSpeed_u16 = myPackage.Parameter(80, DoubleProperty=0, Int32Property=int32(0), LogicalProperty=false, OnOffCharProperty="off", ColorCharProperty="red", StorageClass="YS_SelectRAMPara", HeaderFile="MCU_ParamCfg_Params.h", DefinitionFile="MCU_ParamCfg_Params.c", DataType="uint16")  % 零扭矩关管转速
ParamCfg_ZeroTorqueWorkSpeed_u16 = myPackage.Parameter(100, DoubleProperty=0, Int32Property=int32(0), LogicalProperty=false, OnOffCharProperty="off", ColorCharProperty="red", StorageClass="YS_SelectRAMPara", HeaderFile="MCU_ParamCfg_Params.h", DefinitionFile="MCU_ParamCfg_Params.c", DataType="uint16")  % 零扭矩开管转速
ParamCfg_IaValueDefault_u16 = myPackage.Parameter(600, DoubleProperty=0, Int32Property=int32(0), LogicalProperty=false, OnOffCharProperty="off", ColorCharProperty="red", StorageClass="YS_SelectRAMPara", HeaderFile="MCU_ParamCfg_Params.h", DefinitionFile="MCU_ParamCfg_Params.c", DataType="uint16")  % A相瞬时值故障点
ParamCfg_IbValueDefault_u16 = myPackage.Parameter(600, DoubleProperty=0, Int32Property=int32(0), LogicalProperty=false, OnOffCharProperty="off", ColorCharProperty="red", StorageClass="YS_SelectRAMPara", HeaderFile="MCU_ParamCfg_Params.h", DefinitionFile="MCU_ParamCfg_Params.c", DataType="uint16")  % B相瞬时值故障点
ParamCfg_IcValueDefault_u16 = myPackage.Parameter(600, DoubleProperty=0, Int32Property=int32(0), LogicalProperty=false, OnOffCharProperty="off", ColorCharProperty="red", StorageClass="YS_SelectRAMPara", HeaderFile="MCU_ParamCfg_Params.h", DefinitionFile="MCU_ParamCfg_Params.c", DataType="uint16")  % C相电流瞬时值故障点