% Simulink data dictionary MCU_SpeedCal_Sldd.sldd
% references PublicParameters.sldd
% references MCU_ParamCfg_Sldd_objects.sldd

M_SpeedCal_Speed20msABS_f32 = myPackage.Signal(DoubleProperty=0, Int32Property=int32(0), LogicalProperty=false, OnOffCharProperty="off", ColorCharProperty="red", StorageClass="YS_SelectRAMSignal", HeaderFile="MCU_SpeedCal_Signals.h", DefinitionFile="MCU_SpeedCal_Signals.c", DataType="single")