% Simulink data dictionary MCU_Stateflow_Datadictionary_objects.sldd
% references PublicParameters.sldd
% references MCU_ParamCfg_Sldd_objects.sldd

M_State_CurrentPolarCoordinatesFlg_i16 = myPackage.Signal(DoubleProperty=0, Int32Property=int32(0), LogicalProperty=false, OnOffCharProperty="off", ColorCharProperty="red", StorageClass="YS_SelectRAMSignal", HeaderFile="MCU_Stateflow_Signals.h", DefinitionFile="MCU_Stateflow_Signals.c", DataType="int16")
M_State_WorkCmdSourceModeCmd_u16 = myPackage.Signal(DoubleProperty=0, Int32Property=int32(0), LogicalProperty=false, OnOffCharProperty="off", ColorCharProperty="red", StorageClass="YS_SelectRAMSignal", HeaderFile="MCU_Stateflow_Signals.h", DefinitionFile="MCU_Stateflow_Signals.c", DataType="uint16")
M_State_WorkCmdSourceRunCmd_u16 = myPackage.Signal(DoubleProperty=0, Int32Property=int32(0), LogicalProperty=false, OnOffCharProperty="off", ColorCharProperty="red", StorageClass="YS_SelectRAMSignal", HeaderFile="MCU_Stateflow_Signals.h", DefinitionFile="MCU_Stateflow_Signals.c", DataType="uint16")
M_State_WorkCmdSourceTorqueCmd_s32 = myPackage.Signal(DoubleProperty=0, Int32Property=int32(0), LogicalProperty=false, OnOffCharProperty="off", ColorCharProperty="red", StorageClass="YS_SelectRAMSignal", HeaderFile="MCU_Stateflow_Signals.h", DefinitionFile="MCU_Stateflow_Signals.c", DataType="single")
M_State_WorkCmdSourceTorqueCmd_u16 = myPackage.Signal(DoubleProperty=0, Int32Property=int32(0), LogicalProperty=false, OnOffCharProperty="off", ColorCharProperty="red", StorageClass="YS_SelectRAMSignal", HeaderFile="MCU_Stateflow_Signals.h", DefinitionFile="MCU_Stateflow_Signals.c", DataType="uint16")
M_State_WorkCmdTestbedCurrentCmd_s32 = myPackage.Signal(DoubleProperty=0, Int32Property=int32(0), LogicalProperty=false, OnOffCharProperty="off", ColorCharProperty="red", StorageClass="YS_SelectRAMSignal", HeaderFile="MCU_Stateflow_Signals.h", DefinitionFile="MCU_Stateflow_Signals.c", DataType="single")
M_State_WorkCmdTestbedDischargeCmd_u16 = myPackage.Signal(DoubleProperty=0, Int32Property=int32(0), LogicalProperty=false, OnOffCharProperty="off", ColorCharProperty="red", StorageClass="YS_SelectRAMSignal", HeaderFile="MCU_Stateflow_Signals.h", DefinitionFile="MCU_Stateflow_Signals.c", DataType="uint16")
M_State_WorkCmdTestbedIsdCmd_s32 = myPackage.Signal(DoubleProperty=0, Int32Property=int32(0), LogicalProperty=false, OnOffCharProperty="off", ColorCharProperty="red", StorageClass="YS_SelectRAMSignal", HeaderFile="MCU_Stateflow_Signals.h", DefinitionFile="MCU_Stateflow_Signals.c", DataType="single")
M_State_WorkCmdTestbedIsqCmd_s32 = myPackage.Signal(DoubleProperty=0, Int32Property=int32(0), LogicalProperty=false, OnOffCharProperty="off", ColorCharProperty="red", StorageClass="YS_SelectRAMSignal", HeaderFile="MCU_Stateflow_Signals.h", DefinitionFile="MCU_Stateflow_Signals.c", DataType="single")
M_State_WorkCmdTestbedModeCmd_u16 = myPackage.Signal(DoubleProperty=0, Int32Property=int32(0), LogicalProperty=false, OnOffCharProperty="off", ColorCharProperty="red", StorageClass="YS_SelectRAMSignal", HeaderFile="MCU_Stateflow_Signals.h", DefinitionFile="MCU_Stateflow_Signals.c", DataType="uint16")
M_State_WorkCmdTestbedRunCmd_u16 = myPackage.Signal(DoubleProperty=0, Int32Property=int32(0), LogicalProperty=false, OnOffCharProperty="off", ColorCharProperty="red", StorageClass="YS_SelectRAMSignal", HeaderFile="MCU_Stateflow_Signals.h", DefinitionFile="MCU_Stateflow_Signals.c", DataType="uint16")
M_State_WorkCmdTestbedSpeedCmd_s32 = myPackage.Signal(DoubleProperty=0, Int32Property=int32(0), LogicalProperty=false, OnOffCharProperty="off", ColorCharProperty="red", StorageClass="YS_SelectRAMSignal", HeaderFile="MCU_Stateflow_Signals.h", DefinitionFile="MCU_Stateflow_Signals.c", DataType="single")
M_State_WorkCmdTestbedThetaCmd_s32 = myPackage.Signal(DoubleProperty=0, Int32Property=int32(0), LogicalProperty=false, OnOffCharProperty="off", ColorCharProperty="red", StorageClass="YS_SelectRAMSignal", HeaderFile="MCU_Stateflow_Signals.h", DefinitionFile="MCU_Stateflow_Signals.c", DataType="single")
M_State_WorkCmdTestbedTorqueCmd_s32 = myPackage.Signal(DoubleProperty=0, Int32Property=int32(0), LogicalProperty=false, OnOffCharProperty="off", ColorCharProperty="red", StorageClass="YS_SelectRAMSignal", HeaderFile="MCU_Stateflow_Signals.h", DefinitionFile="MCU_Stateflow_Signals.c", DataType="single")
M_State_WorkCmdTestbed_FreqCmd_s32 = myPackage.Signal(DoubleProperty=0, Int32Property=int32(0), LogicalProperty=false, OnOffCharProperty="off", ColorCharProperty="red", StorageClass="YS_SelectRAMSignal", HeaderFile="MCU_Stateflow_Signals.h", DefinitionFile="MCU_Stateflow_Signals.c", DataType="single")
M_State_WorkCmdVehicleDischargeCmd_u16 = myPackage.Signal(DoubleProperty=0, Int32Property=int32(0), LogicalProperty=false, OnOffCharProperty="off", ColorCharProperty="red", StorageClass="YS_SelectRAMSignal", HeaderFile="MCU_Stateflow_Signals.h", DefinitionFile="MCU_Stateflow_Signals.c", DataType="uint16")
M_State_WorkCmdVehicleTorqueCmd_s32 = myPackage.Signal(DoubleProperty=0, Int32Property=int32(0), LogicalProperty=false, OnOffCharProperty="off", ColorCharProperty="red", StorageClass="YS_SelectRAMSignal", HeaderFile="MCU_Stateflow_Signals.h", DefinitionFile="MCU_Stateflow_Signals.c", DataType="single")
M_State_WorkStateTestBedWorkEn_u16 = myPackage.Signal(DoubleProperty=0, Int32Property=int32(0), LogicalProperty=false, OnOffCharProperty="off", ColorCharProperty="red", StorageClass="YS_SelectRAMSignal", HeaderFile="MCU_Stateflow_Signals.h", DefinitionFile="MCU_Stateflow_Signals.c", DataType="uint16")
M_State_WorkState_u16 = myPackage.Signal(DoubleProperty=0, Int32Property=int32(0), LogicalProperty=false, OnOffCharProperty="off", ColorCharProperty="red", StorageClass="YS_SelectRAMSignal", HeaderFile="MCU_Stateflow_Signals.h", DefinitionFile="MCU_Stateflow_Signals.c", DataType="uint16")
M_State_ZeroTorqueFlag_u16 = myPackage.Signal(DoubleProperty=0, Int32Property=int32(0), LogicalProperty=false, OnOffCharProperty="off", ColorCharProperty="red", StorageClass="YS_SelectRAMSignal", HeaderFile="MCU_Stateflow_Signals.h", DefinitionFile="MCU_Stateflow_Signals.c", DataType="uint16")
M_State_WorkCmdSourceCurrentCmd_s32 = myPackage.Signal(DoubleProperty=0, Int32Property=int32(0), LogicalProperty=false, OnOffCharProperty="off", ColorCharProperty="red", StorageClass="YS_SelectRAMSignal", HeaderFile="MCU_Stateflow_Signals.h", DefinitionFile="MCU_Stateflow_Signals.c", DataType="single")
M_State_WorkCmdSourceFreqCmd_s32 = myPackage.Signal(DoubleProperty=0, Int32Property=int32(0), LogicalProperty=false, OnOffCharProperty="off", ColorCharProperty="red", StorageClass="YS_SelectRAMSignal", HeaderFile="MCU_Stateflow_Signals.h", DefinitionFile="MCU_Stateflow_Signals.c", DataType="single")
M_State_WorkCmdSourceIsdCmd_s32 = myPackage.Signal(DoubleProperty=0, Int32Property=int32(0), LogicalProperty=false, OnOffCharProperty="off", ColorCharProperty="red", StorageClass="YS_SelectRAMSignal", HeaderFile="MCU_Stateflow_Signals.h", DefinitionFile="MCU_Stateflow_Signals.c", DataType="single")
M_State_WorkCmdSourceIsqCmd_s32 = myPackage.Signal(DoubleProperty=0, Int32Property=int32(0), LogicalProperty=false, OnOffCharProperty="off", ColorCharProperty="red", StorageClass="YS_SelectRAMSignal", HeaderFile="MCU_Stateflow_Signals.h", DefinitionFile="MCU_Stateflow_Signals.c", DataType="single")
M_State_WorkCmdSourceSpeedCmd_s32 = myPackage.Signal(DoubleProperty=0, Int32Property=int32(0), LogicalProperty=false, OnOffCharProperty="off", ColorCharProperty="red", StorageClass="YS_SelectRAMSignal", HeaderFile="MCU_Stateflow_Signals.h", DefinitionFile="MCU_Stateflow_Signals.c", DataType="single")
M_State_WorkCmdSourceThetaCmd_s32 = myPackage.Signal(DoubleProperty=0, Int32Property=int32(0), LogicalProperty=false, OnOffCharProperty="off", ColorCharProperty="red", StorageClass="YS_SelectRAMSignal", HeaderFile="MCU_Stateflow_Signals.h", DefinitionFile="MCU_Stateflow_Signals.c", DataType="single")
M_State_WorkCmdMcCurrentCmd_s32 = myPackage.Signal(DoubleProperty=0, Int32Property=int32(0), LogicalProperty=false, OnOffCharProperty="off", ColorCharProperty="red", StorageClass="YS_SelectRAMSignal", HeaderFile="MCU_Stateflow_Signals.h", DefinitionFile="MCU_Stateflow_Signals.c", DataType="single")
M_State_WorkCmdMcFreqCmd_s32 = myPackage.Signal(DoubleProperty=0, Int32Property=int32(0), LogicalProperty=false, OnOffCharProperty="off", ColorCharProperty="red", StorageClass="YS_SelectRAMSignal", HeaderFile="MCU_Stateflow_Signals.h", DefinitionFile="MCU_Stateflow_Signals.c", DataType="single")
M_State_WorkCmdMcIsdCmd_s32 = myPackage.Signal(DoubleProperty=0, Int32Property=int32(0), LogicalProperty=false, OnOffCharProperty="off", ColorCharProperty="red", StorageClass="YS_SelectRAMSignal", HeaderFile="MCU_Stateflow_Signals.h", DefinitionFile="MCU_Stateflow_Signals.c", DataType="single")
M_State_WorkCmdMcIsqCmd_s32 = myPackage.Signal(DoubleProperty=0, Int32Property=int32(0), LogicalProperty=false, OnOffCharProperty="off", ColorCharProperty="red", StorageClass="YS_SelectRAMSignal", HeaderFile="MCU_Stateflow_Signals.h", DefinitionFile="MCU_Stateflow_Signals.c", DataType="single")
M_State_WorkCmdMcSpeedCmd_s32 = myPackage.Signal(DoubleProperty=0, Int32Property=int32(0), LogicalProperty=false, OnOffCharProperty="off", ColorCharProperty="red", StorageClass="YS_SelectRAMSignal", HeaderFile="MCU_Stateflow_Signals.h", DefinitionFile="MCU_Stateflow_Signals.c", DataType="single")
M_State_WorkCmdMcThetaCmd_s32 = myPackage.Signal(DoubleProperty=0, Int32Property=int32(0), LogicalProperty=false, OnOffCharProperty="off", ColorCharProperty="red", StorageClass="YS_SelectRAMSignal", HeaderFile="MCU_Stateflow_Signals.h", DefinitionFile="MCU_Stateflow_Signals.c", DataType="single")
M_State_WorkCmdMcTorqueCmd_s32 = myPackage.Signal(DoubleProperty=0, Int32Property=int32(0), LogicalProperty=false, OnOffCharProperty="off", ColorCharProperty="red", StorageClass="YS_SelectRAMSignal", HeaderFile="MCU_Stateflow_Signals.h", DefinitionFile="MCU_Stateflow_Signals.c", DataType="single")
M_State_WorkStateMcModeSelect_u16 = myPackage.Signal(DoubleProperty=0, Int32Property=int32(0), LogicalProperty=false, OnOffCharProperty="off", ColorCharProperty="red", StorageClass="YS_SelectRAMSignal", HeaderFile="MCU_Stateflow_Signals.h", DefinitionFile="MCU_Stateflow_Signals.c", DataType="uint16")
M_State_WorkStateMcRunCmd_u16 = myPackage.Signal(DoubleProperty=0, Int32Property=int32(0), LogicalProperty=false, OnOffCharProperty="off", ColorCharProperty="red", StorageClass="YS_SelectRAMSignal", HeaderFile="MCU_Stateflow_Signals.h", DefinitionFile="MCU_Stateflow_Signals.c", DataType="uint16")
M_State_SelfCheckOverFlg_u16 = myPackage.Signal(DoubleProperty=0, Int32Property=int32(0), LogicalProperty=false, OnOffCharProperty="off", ColorCharProperty="red", StorageClass="YS_SelectRAMSignal", HeaderFile="MCU_Stateflow_Signals.h", DefinitionFile="MCU_Stateflow_Signals.c", DataType="uint16")
M_State_ClosePWMFlag_u16 = myPackage.Signal(DoubleProperty=0, Int32Property=int32(0), LogicalProperty=false, OnOffCharProperty="off", ColorCharProperty="red", StorageClass="YS_SelectRAMSignal", HeaderFile="MCU_Stateflow_Signals.h", DefinitionFile="MCU_Stateflow_Signals.c", DataType="uint16")
M_State_PrechargeOverFlag_u16 = myPackage.Signal(DoubleProperty=0, Int32Property=int32(0), LogicalProperty=false, OnOffCharProperty="off", ColorCharProperty="red", StorageClass="YS_SelectRAMSignal", HeaderFile="MCU_Stateflow_Signals.h", DefinitionFile="MCU_Stateflow_Signals.c", DataType="uint16")
M_State_WorkCmdCurrentCmd_s32 = myPackage.Signal(DoubleProperty=0, Int32Property=int32(0), LogicalProperty=false, OnOffCharProperty="off", ColorCharProperty="red", StorageClass="YS_SelectRAMSignal", HeaderFile="MCU_Stateflow_Signals.h", DefinitionFile="MCU_Stateflow_Signals.c", DataType="single")
M_State_WorkCmdDischargeCmd_u16 = myPackage.Signal(DoubleProperty=0, Int32Property=int32(0), LogicalProperty=false, OnOffCharProperty="off", ColorCharProperty="red", StorageClass="YS_SelectRAMSignal", HeaderFile="MCU_Stateflow_Signals.h", DefinitionFile="MCU_Stateflow_Signals.c", DataType="uint16")
M_State_WorkCmdFreqCmd_s32 = myPackage.Signal(DoubleProperty=0, Int32Property=int32(0), LogicalProperty=false, OnOffCharProperty="off", ColorCharProperty="red", StorageClass="YS_SelectRAMSignal", HeaderFile="MCU_Stateflow_Signals.h", DefinitionFile="MCU_Stateflow_Signals.c", DataType="single")
M_State_WorkCmdIsdCmd_s32 = myPackage.Signal(DoubleProperty=0, Int32Property=int32(0), LogicalProperty=false, OnOffCharProperty="off", ColorCharProperty="red", StorageClass="YS_SelectRAMSignal", HeaderFile="MCU_Stateflow_Signals.h", DefinitionFile="MCU_Stateflow_Signals.c", DataType="single")
M_State_WorkCmdIsqCmd_s32 = myPackage.Signal(DoubleProperty=0, Int32Property=int32(0), LogicalProperty=false, OnOffCharProperty="off", ColorCharProperty="red", StorageClass="YS_SelectRAMSignal", HeaderFile="MCU_Stateflow_Signals.h", DefinitionFile="MCU_Stateflow_Signals.c", DataType="single")
M_State_WorkCmdSpeedCmd_s32 = myPackage.Signal(DoubleProperty=0, Int32Property=int32(0), LogicalProperty=false, OnOffCharProperty="off", ColorCharProperty="red", StorageClass="YS_SelectRAMSignal", HeaderFile="MCU_Stateflow_Signals.h", DefinitionFile="MCU_Stateflow_Signals.c", DataType="single")
M_State_WorkCmdThetaCmd_s32 = myPackage.Signal(DoubleProperty=0, Int32Property=int32(0), LogicalProperty=false, OnOffCharProperty="off", ColorCharProperty="red", StorageClass="YS_SelectRAMSignal", HeaderFile="MCU_Stateflow_Signals.h", DefinitionFile="MCU_Stateflow_Signals.c", DataType="single")
M_State_WorkCmdTorqueCmd_s32 = myPackage.Signal(DoubleProperty=0, Int32Property=int32(0), LogicalProperty=false, OnOffCharProperty="off", ColorCharProperty="red", StorageClass="YS_SelectRAMSignal", HeaderFile="MCU_Stateflow_Signals.h", DefinitionFile="MCU_Stateflow_Signals.c", DataType="single")
M_State_WorkStateModeSelect_u16 = myPackage.Signal(DoubleProperty=0, Int32Property=int32(0), LogicalProperty=false, OnOffCharProperty="off", ColorCharProperty="red", StorageClass="YS_SelectRAMSignal", HeaderFile="MCU_Stateflow_Signals.h", DefinitionFile="MCU_Stateflow_Signals.c", DataType="uint16")
M_State_WorkStateRunCmd_u16 = myPackage.Signal(DoubleProperty=0, Int32Property=int32(0), LogicalProperty=false, OnOffCharProperty="off", ColorCharProperty="red", StorageClass="YS_SelectRAMSignal", HeaderFile="MCU_Stateflow_Signals.h", DefinitionFile="MCU_Stateflow_Signals.c", DataType="uint16")
M_State_WorkCmdModeCmd_u16 = myPackage.Signal(DoubleProperty=0, Int32Property=int32(0), LogicalProperty=false, OnOffCharProperty="off", ColorCharProperty="red", StorageClass="YS_SelectRAMSignal", HeaderFile="MCU_Stateflow_Signals.h", DefinitionFile="MCU_Stateflow_Signals.c", DataType="uint16")
M_State_CommandSource_i16 = myPackage.Signal(DoubleProperty=0, Int32Property=int32(0), LogicalProperty=false, OnOffCharProperty="off", ColorCharProperty="red", StorageClass="YS_SelectRAMSignal", HeaderFile="MCU_Stateflow_Signals.h", DefinitionFile="MCU_Stateflow_Signals.c", DataType="int16")
M_State_WorkCmdVehicleRunCmd_u16 = myPackage.Signal(DoubleProperty=0, Int32Property=int32(0), LogicalProperty=false, OnOffCharProperty="off", ColorCharProperty="red", StorageClass="YS_SelectRAMSignal", HeaderFile="MCU_Stateflow_Signals.h", DefinitionFile="MCU_Stateflow_Signals.c", DataType="uint16")  % 从CAN上解析得到
M_State_WorkCmdSourceDischargeCmd_u16 = myPackage.Signal(DoubleProperty=0, Int32Property=int32(0), LogicalProperty=false, OnOffCharProperty="off", ColorCharProperty="red", StorageClass="YS_SelectRAMSignal", HeaderFile="MCU_Stateflow_Signals.h", DefinitionFile="MCU_Stateflow_Signals.c", DataType="uint16")
M_State_WorkStateModeSelectBefore_u16 = myPackage.Signal(DoubleProperty=0, Int32Property=int32(0), LogicalProperty=false, OnOffCharProperty="off", ColorCharProperty="red", StorageClass="YS_SelectRAMSignal", HeaderFile="MCU_Stateflow_Signals.h", DefinitionFile="MCU_Stateflow_Signals.c", DataType="uint16")
M_State_WorkStateBefore_u16 = myPackage.Signal(DoubleProperty=0, Int32Property=int32(0), LogicalProperty=false, OnOffCharProperty="off", ColorCharProperty="red", StorageClass="YS_SelectRAMSignal", HeaderFile="MCU_Stateflow_Signals.h", DefinitionFile="MCU_Stateflow_Signals.c", DataType="uint16")
M_State_WorkCmdRunCmd_u16 = myPackage.Signal(DoubleProperty=0, Int32Property=int32(0), LogicalProperty=false, OnOffCharProperty="off", ColorCharProperty="red", StorageClass="YS_SelectRAMSignal", HeaderFile="MCU_Stateflow_Signals.h", DefinitionFile="MCU_Stateflow_Signals.c", DataType="uint16")
M_State_WorkCmdAnalogModeCmd_u16 = myPackage.Signal(DoubleProperty=0, Int32Property=int32(0), LogicalProperty=false, OnOffCharProperty="off", ColorCharProperty="red", StorageClass="YS_SelectRAMSignal", HeaderFile="MCU_Stateflow_Signals.h", DefinitionFile="MCU_Stateflow_Signals.c", DataType="uint16")
M_State_WorkCmdAnalogRunCmd_u16 = myPackage.Signal(DoubleProperty=0, Int32Property=int32(0), LogicalProperty=false, OnOffCharProperty="off", ColorCharProperty="red", StorageClass="YS_SelectRAMSignal", HeaderFile="MCU_Stateflow_Signals.h", DefinitionFile="MCU_Stateflow_Signals.c", DataType="uint16")
M_State_WorkCmdAnalogSpeedCmd_s32 = myPackage.Signal(DoubleProperty=0, Int32Property=int32(0), LogicalProperty=false, OnOffCharProperty="off", ColorCharProperty="red", StorageClass="YS_SelectRAMSignal", HeaderFile="MCU_Stateflow_Signals.h", DefinitionFile="MCU_Stateflow_Signals.c", DataType="single")
M_State_WorkCmdAnalogTorqueCmd_s32 = myPackage.Signal(DoubleProperty=0, Int32Property=int32(0), LogicalProperty=false, OnOffCharProperty="off", ColorCharProperty="red", StorageClass="YS_SelectRAMSignal", HeaderFile="MCU_Stateflow_Signals.h", DefinitionFile="MCU_Stateflow_Signals.c", DataType="single")
M_State_SpeedCal2ms_s32 = myPackage.Signal(DoubleProperty=0, Int32Property=int32(0), LogicalProperty=false, OnOffCharProperty="off", ColorCharProperty="red", StorageClass="YS_SelectRAMSignal", HeaderFile="MCU_Stateflow_Signals.h", DefinitionFile="MCU_Stateflow_Signals.c", DataType="single")
M_State_SpeedCtrlCmdFilter_s32 = myPackage.Signal(DoubleProperty=0, Int32Property=int32(0), LogicalProperty=false, OnOffCharProperty="off", ColorCharProperty="red", StorageClass="YS_SelectRAMSignal", HeaderFile="MCU_Stateflow_Signals.h", DefinitionFile="MCU_Stateflow_Signals.c", DataType="single")