% Simulink data dictionary MCU_VoltLoopCal.sldd
% references PublicParameters.sldd
% references MCU_ParamCfg_Sldd_objects.sldd

UDQ_LIMIT_ABS = Simulink.Parameter(1.2, StorageClass="Define", HeaderFile="VoltLoop_Define.h", DataType="single")
VOLTLOOP_KP = Simulink.Parameter(0.15, StorageClass="Define", HeaderFile="VoltLoop_Define.h", DataType="single")
VOLTLOOP_KI = Simulink.Parameter(0.1, StorageClass="Define", HeaderFile="VoltLoop_Define.h", DataType="single")