% Simulink data dictionary PublicParameters.sldd

WORKING = myPackage.Parameter(2, DoubleProperty=0, Int32Property=int32(0), LogicalProperty=false, OnOffCharProperty="off", ColorCharProperty="red", StorageClass="ImportedExtern", DataType="uint16")
STANDBY = myPackage.Parameter(1, DoubleProperty=0, Int32Property=int32(0), LogicalProperty=false, OnOffCharProperty="off", ColorCharProperty="red", StorageClass="ImportedExtern", DataType="uint16")
SHUTDOWN = myPackage.Parameter(4, DoubleProperty=0, Int32Property=int32(0), LogicalProperty=false, OnOffCharProperty="off", ColorCharProperty="red", StorageClass="ImportedExtern", DataType="uint16")
FAULT = myPackage.Parameter(3, DoubleProperty=0, Int32Property=int32(0), LogicalProperty=false, OnOffCharProperty="off", ColorCharProperty="red", StorageClass="ImportedExtern", DataType="uint16")
cVvvfOpenMode = myPackage.Parameter(4, DoubleProperty=0, Int32Property=int32(0), LogicalProperty=false, OnOffCharProperty="off", ColorCharProperty="red", StorageClass="ImportedExtern", DataType="uint16")
cTorqueLoopMode = myPackage.Parameter(1, DoubleProperty=0, Int32Property=int32(0), LogicalProperty=false, OnOffCharProperty="off", ColorCharProperty="red", StorageClass="ImportedExtern", DataType="uint16")
cSingleBoardMode = myPackage.Parameter(6, DoubleProperty=0, Int32Property=int32(0), LogicalProperty=false, OnOffCharProperty="off", ColorCharProperty="red", StorageClass="ImportedExtern", DataType="uint16")
cSpeedLoopMode = myPackage.Parameter(2, DoubleProperty=0, Int32Property=int32(0), LogicalProperty=false, OnOffCharProperty="off", ColorCharProperty="red", StorageClass="ImportedExtern", DataType="uint16")
cParaRecogMode = myPackage.Parameter(5, DoubleProperty=0, Int32Property=int32(0), LogicalProperty=false, OnOffCharProperty="off", ColorCharProperty="red", StorageClass="ImportedExtern", DataType="uint16")
cNoneMode = myPackage.Parameter(0, DoubleProperty=0, Int32Property=int32(0), LogicalProperty=false, OnOffCharProperty="off", ColorCharProperty="red", StorageClass="ImportedExtern", DataType="uint16")
cCurrentLoopMode = myPackage.Parameter(3, DoubleProperty=0, Int32Property=int32(0), LogicalProperty=false, OnOffCharProperty="off", ColorCharProperty="red", StorageClass="ImportedExtern", DataType="uint16")
cAgeingMode = myPackage.Parameter(7, DoubleProperty=0, Int32Property=int32(0), LogicalProperty=false, OnOffCharProperty="off", ColorCharProperty="red", StorageClass="ImportedExtern", DataType="uint16")
POWER_ON = myPackage.Parameter(0, DoubleProperty=0, Int32Property=int32(0), LogicalProperty=false, OnOffCharProperty="off", ColorCharProperty="red", StorageClass="ImportedExtern", DataType="uint16")
NEGATIVE = myPackage.Parameter(0, DoubleProperty=0, Int32Property=int32(0), LogicalProperty=false, OnOffCharProperty="off", ColorCharProperty="red", StorageClass="ImportedExtern", DataType="uint16")
VEHICLE = myPackage.Parameter(0, DoubleProperty=0, Int32Property=int32(0), LogicalProperty=false, OnOffCharProperty="off", ColorCharProperty="red", StorageClass="ImportedExtern", DataType="uint16")
BC_SAMPLE = myPackage.Parameter(3, DoubleProperty=0, Int32Property=int32(0), LogicalProperty=false, OnOffCharProperty="off", ColorCharProperty="red", StorageClass="ImportedExtern", DataType="uint16")
AC_SAMPLE = myPackage.Parameter(2, DoubleProperty=0, Int32Property=int32(0), LogicalProperty=false, OnOffCharProperty="off", ColorCharProperty="red", StorageClass="ImportedExtern", DataType="uint16")
ABC_SAMPLE = myPackage.Parameter(4, DoubleProperty=0, Int32Property=int32(0), LogicalProperty=false, OnOffCharProperty="off", ColorCharProperty="red", StorageClass="ImportedExtern", DataType="uint16")
AB_SAMPLE = myPackage.Parameter(1, DoubleProperty=0, Int32Property=int32(0), LogicalProperty=false, OnOffCharProperty="off", ColorCharProperty="red", StorageClass="ImportedExtern", DataType="uint16")
ANALOG = myPackage.Parameter(2, DoubleProperty=0, Int32Property=int32(0), LogicalProperty=false, OnOffCharProperty="off", ColorCharProperty="red", StorageClass="ImportedExtern", DataType="uint16")
TESTBED = myPackage.Parameter(1, DoubleProperty=0, Int32Property=int32(0), LogicalProperty=false, OnOffCharProperty="off", ColorCharProperty="red", StorageClass="ImportedExtern", DataType="uint16")
MAIN_CPU_FRE = myPackage.Parameter(200, DoubleProperty=0, Int32Property=int32(0), LogicalProperty=false, OnOffCharProperty="off", ColorCharProperty="red", StorageClass="Define", DataType="uint16")
MOTORDIR = myPackage.Parameter(0, DoubleProperty=0, Int32Property=int32(0), LogicalProperty=false, OnOffCharProperty="off", ColorCharProperty="red", StorageClass="Define", DataType="uint8")
DEPOWER_NO_FLAG = myPackage.Parameter(0, DoubleProperty=0, Int32Property=int32(0), LogicalProperty=false, OnOffCharProperty="off", ColorCharProperty="red", StorageClass="Define", DataType="uint8")
DEPOWER_FLAG = myPackage.Parameter(1, DoubleProperty=0, Int32Property=int32(0), LogicalProperty=false, OnOffCharProperty="off", ColorCharProperty="red", StorageClass="Define", DataType="uint8")
TWISTGRIP_UP = Simulink.Parameter(1.1, StorageClass="Define", DataType="single")
TWISTGRIP_VTH_HIGH = Simulink.Parameter(3.8, StorageClass="Define", DataType="single")
TWISTGRIP_VTH_UP = Simulink.Parameter(0.5, StorageClass="Define", DataType="single")
PWM_PERIOD_H = myPackage.Parameter(700, DoubleProperty=0, Int32Property=int32(0), LogicalProperty=false, OnOffCharProperty="off", ColorCharProperty="red", StorageClass="Define", DataType="uint16")

GEAR = enum(DefaultValue="R_GEAR", StorageType="uint16")
  R_GEAR = 0
  L_GEAR = 1
  M_GEAR = 2
  H_GEAR = 3
  P_GEAR = 4

PTIME = Simulink.Parameter(500, StorageClass="Define", DataType="uint16")