% Simulink data dictionary ActDisCharge_Sldd.sldd
% references PublicParameters.sldd
% references MCU_ParamCfg_Sldd_objects.sldd

C_ActDischarge_DischgTim_u16 = myPackage.Parameter(1500, DoubleProperty=0, Int32Property=int32(0), LogicalProperty=false, OnOffCharProperty="off", ColorCharProperty="red", StorageClass="YS_SelectRAMPara", HeaderFile="MCU_ActDisCharge_Params.h", DefinitionFile="MCU_ActDisCharge_Params.c", DataType="uint16")
M_ActDisCharge_ActDischgStd_u8 = myPackage.Signal(DoubleProperty=0, Int32Property=int32(0), LogicalProperty=false, OnOffCharProperty="off", ColorCharProperty="red", StorageClass="YS_SelectRAMSignal", HeaderFile="MCU_ActDisCharge_Signals.h", DefinitionFile="MCU_ActDisCharge_Signals.c", DataType="uint8", InitialValue="0")
M_ActDisCharge_ActDischgCmd_u8 = myPackage.Signal(DoubleProperty=0, Int32Property=int32(0), LogicalProperty=false, OnOffCharProperty="off", ColorCharProperty="red", StorageClass="YS_SelectRAMSignal", HeaderFile="MCU_ActDisCharge_Signals.h", DefinitionFile="MCU_ActDisCharge_Signals.c", DataType="uint8", InitialValue="0")