% Simulink data dictionary MCU_CtrlCmd.sldd
% references MCU_ParamCfg_Sldd_objects.sldd
% references PublicParameters.sldd

M_CtrlCmd_Test_f32 = myPackage.Signal(DoubleProperty=0, Int32Property=int32(0), LogicalProperty=false, OnOffCharProperty="off", ColorCharProperty="red", StorageClass="YS_SelectRAMSignal", HeaderFile="MCU_CtrlCmd_Signals.h", DefinitionFile="MCU_CtrlCmd_Signals.c", DataType="single", Unit="-", InitialValue="None")  % 故障状态信号总线
TWISTGRIP_HIGH = Simulink.Parameter(3.3, StorageClass="Define", DataType="single")
Trq_coeff_Arr_HSP_60V = myPackage.Parameter([100 100 100 100 100 100 100 100 100 100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 0], DoubleProperty=0, Int32Property=int32(0), LogicalProperty=false, OnOffCharProperty="off", ColorCharProperty="red", StorageClass="YS_SelectRAMPara", HeaderFile="MCU_CtrlCmd.h", DefinitionFile="MCU_CtrlCmd.c", DataType="uint16")
Trq_coeff_Arr_HSP_72V = myPackage.Parameter([100 100 100 100 100 100 100 100 100 100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 0], DoubleProperty=0, Int32Property=int32(0), LogicalProperty=false, OnOffCharProperty="off", ColorCharProperty="red", StorageClass="YS_SelectRAMPara", HeaderFile="MCU_CtrlCmd.h", DefinitionFile="MCU_CtrlCmd.c", DataType="uint16")
Trq_coeff_Arr_LSP_60V = myPackage.Parameter([60 60 60 60 60 60 60 60 60 60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 0], DoubleProperty=0, Int32Property=int32(0), LogicalProperty=false, OnOffCharProperty="off", ColorCharProperty="red", StorageClass="YS_SelectRAMPara", HeaderFile="MCU_CtrlCmd.h", DefinitionFile="MCU_CtrlCmd.c", DataType="uint16")
Trq_coeff_Arr_MSP_60V = myPackage.Parameter([80 80 80 80 80 80 80 80 80 80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 0], DoubleProperty=0, Int32Property=int32(0), LogicalProperty=false, OnOffCharProperty="off", ColorCharProperty="red", StorageClass="YS_SelectRAMPara", HeaderFile="MCU_CtrlCmd.h", DefinitionFile="MCU_CtrlCmd.c", DataType="uint16")
Trq_coeff_Arr_MSP_72V = myPackage.Parameter([80 80 80 80 80 80 80 80 80 80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 0], DoubleProperty=0, Int32Property=int32(0), LogicalProperty=false, OnOffCharProperty="off", ColorCharProperty="red", StorageClass="YS_SelectRAMPara", HeaderFile="MCU_CtrlCmd.h", DefinitionFile="MCU_CtrlCmd.c", DataType="uint16")
Trq_coeff_Arr_Back_60V = myPackage.Parameter([92 88 75 62 49 36 23 10 2 0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 0], DoubleProperty=0, Int32Property=int32(0), LogicalProperty=false, OnOffCharProperty="off", ColorCharProperty="red", StorageClass="YS_SelectRAMPara", HeaderFile="MCU_CtrlCmd.h", DefinitionFile="MCU_CtrlCmd.c", DataType="uint16")
Trq_coeff_Arr_Back_72V = myPackage.Parameter([96 88 75 62 49 36 23 10 2 0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 0], DoubleProperty=0, Int32Property=int32(0), LogicalProperty=false, OnOffCharProperty="off", ColorCharProperty="red", StorageClass="YS_SelectRAMPara", HeaderFile="MCU_CtrlCmd.h", DefinitionFile="MCU_CtrlCmd.c", DataType="uint16")
Trq_coeff_Arr_LSP_72V = myPackage.Parameter([60 60 60 60 60 60 60 60 60 60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 0], DoubleProperty=0, Int32Property=int32(0), LogicalProperty=false, OnOffCharProperty="off", ColorCharProperty="red", StorageClass="YS_SelectRAMPara", HeaderFile="MCU_CtrlCmd.h", DefinitionFile="MCU_CtrlCmd.c", DataType="uint16")