% Simulink data dictionary MCU_HillHold.sldd
% references PublicParameters.sldd
% references MCU_ParamCfg_Sldd_objects.sldd

M_HillHold_HillHoldFlg = myPackage.Signal(DoubleProperty=0, Int32Property=int32(0), LogicalProperty=false, OnOffCharProperty="off", ColorCharProperty="red", StorageClass="YS_SelectRAMSignal", HeaderFile="MCU_HillHold_Signals.h", DefinitionFile="MCU_HillHold_Signals.c", DataType="uint8", Unit="-")