% Simulink data dictionary MCU_IdqMap.sldd
% references PublicParameters.sldd
% references MCU_ParamCfg_Sldd_objects.sldd

M_IdqMap_MapSpeed_f32 = myPackage.Signal(DoubleProperty=0, Int32Property=int32(0), LogicalProperty=false, OnOffCharProperty="off", ColorCharProperty="red", StorageClass="YS_SelectRAMSignal", HeaderFile="MCU_IdqMap.h", DefinitionFile="MCU_IdqMap.c", DataType="single")
RPM_CELL = myPackage.Parameter(21, DoubleProperty=0, Int32Property=int32(0), LogicalProperty=false, OnOffCharProperty="off", ColorCharProperty="red", StorageClass="Define", DataType="int16")
TOR_CELL = myPackage.Parameter(71, DoubleProperty=0, Int32Property=int32(0), LogicalProperty=false, OnOffCharProperty="off", ColorCharProperty="red", StorageClass="Define", DataType="int16")