% Simulink data dictionary MCU_LowSpeed.sldd
% references PublicParameters.sldd
% references MCU_ParamCfg_Sldd_objects.sldd

M_LowSpeed_FastFlag_u8 = myPackage.Signal(DoubleProperty=0, Int32Property=int32(0), LogicalProperty=false, OnOffCharProperty="off", ColorCharProperty="red", StorageClass="YS_SelectRAMSignal", HeaderFile="MCU_LowSpeed_Signals.h", DefinitionFile="MCU_LowSpeed_Signals.c", DataType="uint8")