% Simulink data dictionary MCU_PreCharge.sldd
% references PublicParameters.sldd
% references MCU_ParamCfg_Sldd_objects.sldd

M_PreCharge_OverFlg = myPackage.Signal(DoubleProperty=0, Int32Property=int32(0), LogicalProperty=false, OnOffCharProperty="off", ColorCharProperty="red", StorageClass="YS_SelectRAMSignal", HeaderFile="MCU_PreCharge_Signals.h", DefinitionFile="MCU_PreCharge_Signals.c", DataType="uint8", Unit="-")