% Simulink data dictionary SpeedCtrl.sldd
% references PublicParameters.sldd
% references MCU_ParamCfg_Sldd_objects.sldd

M_SpeedCtrl_Test_u8 = myPackage.Signal(DoubleProperty=0, Int32Property=int32(0), LogicalProperty=false, OnOffCharProperty="off", ColorCharProperty="red", StorageClass="YS_SelectRAMSignal", HeaderFile="TorqureCtrl_Signals.h", DefinitionFile="TorqureCtrl_Signals.c", DataType="uint8")