% Simulink data dictionary TorqueCtrl.sldd
% references PublicParameters.sldd
% references MCU_ParamCfg_Sldd_objects.sldd

M_TorqureCtrl_Test_u8 = myPackage.Signal(DoubleProperty=0, Int32Property=int32(0), LogicalProperty=false, OnOffCharProperty="off", ColorCharProperty="red", StorageClass="YS_SelectRAMSignal", HeaderFile="TorqureCtrl_Signals.h", DefinitionFile="TorqureCtrl_Signals.c", DataType="uint8")
C_TorqueCtrl_MaxTrqTable_u16 = myPackage.Parameter([137 137 120 100 90 80 70 60 52 43 36 31 26 23 21 17 15 12 10 9 7 6], DoubleProperty=0, Int32Property=int32(0), LogicalProperty=false, OnOffCharProperty="off", ColorCharProperty="red", StorageClass="YS_SelectRAMPara", HeaderFile="TorqureCtrl_Params.h", DefinitionFile="TorqureCtrl_Params.c", DataType="uint16")
C_TorqueCtrl_MaxTrqIndex_u16 = myPackage.Parameter([0 1 2 3 4 5 6 7 8 9 10 11 12 13 14 15 16 17 18 19 20 21], DoubleProperty=0, Int32Property=int32(0), LogicalProperty=false, OnOffCharProperty="off", ColorCharProperty="red", StorageClass="YS_SelectRAMPara", HeaderFile="TorqureCtrl_Params.h", DefinitionFile="TorqureCtrl_Params.c", DataType="uint16")
C_TorqueCtrl_PowerCoeff60V_u16 = myPackage.Parameter(repmat(100, 1, 22), DoubleProperty=0, Int32Property=int32(0), LogicalProperty=false, OnOffCharProperty="off", ColorCharProperty="red", StorageClass="YS_SelectRAMPara", HeaderFile="TorqureCtrl_Params.h", DefinitionFile="TorqureCtrl_Params.c", DataType="uint16")
C_TorqueCtrl_PowerCoeff72V_u16 = myPackage.Parameter(repmat(100, 1, 22), DoubleProperty=0, Int32Property=int32(0), LogicalProperty=false, OnOffCharProperty="off", ColorCharProperty="red", StorageClass="YS_SelectRAMPara", HeaderFile="TorqureCtrl_Params.h", DefinitionFile="TorqureCtrl_Params.c", DataType="uint16")